# Grasshopper definition Exterior_wall_element_tool_JvE.gh (Grasshopper 1.0.7)
# plug-ins: Human UI, GH_CPython

# ----
# TOGGLE TRUE FOR USER INTERFACE
human_ui_interface = BooleanToggle(True)

# ----
# DB SUBSTRUCTURE
reset_database = BooleanToggle(False)
max_length_mm = Panel("5000")
min_depth_mm = Panel("50")
max_depth_mm = Panel("90")
database_amount = Panel("500")
min_length_mm = Panel("10")
min_width_mm = Panel("30")
max_width_mm = Panel("60")
int = Integer(database_amount)
int_2 = Integer(max_length_mm)
int_3 = Integer(max_depth_mm)
int_4 = Integer(min_length_mm)
int_5 = Integer(min_width_mm)
int_6 = Integer(max_width_mm)
int_7 = Integer(min_depth_mm)

# ----
# DB CLADDING
reset_database_2 = BooleanToggle(True)
min_height_mm = Panel("100")
database_amount_2 = Panel("500")
min_length_mm_2 = Panel("10")
max_length_mm_2 = Panel("5000")
max_height_mm = Panel("250")
min_depth_mm_2 = Panel("10")
max_depth_mm_2 = Panel("30")
int_8 = Integer(database_amount_2)
int_9 = Integer(max_length_mm_2)
int_10 = Integer(min_length_mm_2)
int_11 = Integer(min_height_mm)
int_12 = Integer(max_height_mm)
int_13 = Integer(min_depth_mm_2)
int_14 = Integer(max_depth_mm_2)

# ----
# DATABASE INFILL
reset_database_3 = BooleanToggle(True)
database_amount_3 = Panel("500")
min_length_mm_3 = Panel("10")
max_length_mm_3 = Panel("5000")
min_witdh_mm = Panel("60")
max_width_mm_2 = Panel("90")
min_depth_mm_3 = Panel("160")
max_depth_mm_3 = Panel("200")
int_15 = Integer(database_amount_3)
int_16 = Integer(min_length_mm_3)
int_17 = Integer(max_length_mm_3)
int_18 = Integer(min_witdh_mm)
int_19 = Integer(max_width_mm_2)
int_20 = Integer(max_depth_mm_3)
int_21 = Integer(min_depth_mm_3)

# ----
# SEARCH QUERY
panel = Panel("SELECT length_wood, width_wood, depth_wood, wood_id FROM wood_dimensions WHERE depth_wood >= 160 AND depth_wood <= 200;")
panel_2 = Panel("SELECT length_wood, width_wood, depth_wood, wood_id FROM wood_dimensions WHERE depth_wood >= 50 AND depth_wood <= 90;")
panel_3 = Panel("SELECT length_wood, width_wood, depth_wood, wood_id FROM wood_dimensions WHERE depth_wood >= 10 AND depth_wood <= 30;")

# ----
# CLASSES
py__classes = GhPythonScript()  # -> out, a
# ---------- py__classes: Python ----------
print('import succes') 

class wood_structural():
    def __init__(self, length, width, depth, db_id):
        self.length = length
        self.width = width
        self.depth = depth
        self.id = db_id
        
    def print_data(self):
        print(self.length, self.width, self.depth, self.id)


class wood_substructure(wood_structural):
    pass


class wood_cladding():
    def __init__(self, length, height, depth, db_id):
        self.length = length
        self.height = height
        self.depth = depth
        self.id = db_id


class coordinates_segments():
    def __init__(self, x_cor_start, z_cor_start, x_cor_end, z_cor_end):
        self.x_cor_start = x_cor_start
        self.z_cor_start = z_cor_start
        self.x_cor_end = x_cor_end
        self.z_cor_end = z_cor_end
        
    def print_cor(self):
        print(self.x_cor_start, self.z_cor_start, self.x_cor_end, self.z_cor_end)


class coordinates_segments_cladding(coordinates_segments):
    pass
# ---------- end py__classes ----------

centre_to_centre_distance = Panel("600")
substructure_min_length = Panel("300")
depth_wall_element = Panel("250")
int_22 = Integer(centre_to_centre_distance)
int_23 = Integer(substructure_min_length)
int_24 = Integer(depth_wall_element)

# ----
# WALL DIMENSIONS
width = Slider(5000, range=2000..10000)
height = Slider(3000, range=2000..5000)
width_door = Slider(900, range=800..1600)
position_door = Slider(1000, range=0..10000)
height_window = Slider(1000, range=0..10000)
height_door = Slider(2000, range=2000..3000)
width_window = Slider(1500, range=0..10000)
position_window_x = Slider(2500, range=0..10000)
position_window_y = Slider(1000, range=0..10000)
slider = CreateSlider(Slider=width, ShowBounds=False, ShowTicks=False, ShowTooltip=False, ShowValLabel=True, showLabel=True)
slider_2 = CreateSlider(Slider=height, SnapValue=100, ShowBounds=False, ShowTicks=False, ShowTooltip=False, ShowValLabel=True, showLabel=True)
slider_3 = CreateSlider(Slider=width_door, SnapValue=10, ShowBounds=False, ShowTicks=False, ShowTooltip=False, ShowValLabel=True, showLabel=True)
slider_4 = CreateSlider(
    Slider=height_door,
    SnapValue=10,
    ShowBounds=False,
    ShowTicks=False,
    ShowTooltip=False,
    ShowValLabel=True,
    showLabel=True)
slider_5 = CreateSlider(Slider=position_door, ShowBounds=False, ShowTicks=False, ShowTooltip=False, ShowValLabel=True, showLabel=True)
slider_6 = CreateSlider(
    Slider=width_window,
    SnapValue=10,
    ShowBounds=False,
    ShowTicks=False,
    ShowTooltip=False,
    ShowValLabel=True,
    showLabel=True)
slider_7 = CreateSlider(
    Slider=height_window,
    SnapValue=10,
    ShowBounds=False,
    ShowTicks=False,
    ShowTooltip=False,
    ShowValLabel=True,
    showLabel=True)
slider_8 = CreateSlider(
    Slider=position_window_x,
    SnapValue=10,
    ShowBounds=False,
    ShowTicks=False,
    ShowTooltip=False,
    ShowValLabel=True,
    showLabel=True)
slider_9 = CreateSlider(
    Slider=position_window_y,
    SnapValue=10,
    ShowBounds=False,
    ShowTicks=False,
    ShowTooltip=False,
    ShowValLabel=True,
    showLabel=True)
values = ValueListener(Elements=slider, SomeProperty=True)  # -> Values, Indices
values_2 = ValueListener(Elements=slider_2, SomeProperty=True)  # -> Values, Indices
values_3 = ValueListener(Elements=slider_3, SomeProperty=True)  # -> Values, Indices
values_4 = ValueListener(Elements=slider_4, SomeProperty=True)  # -> Values, Indices
values_5 = ValueListener(Elements=slider_5, SomeProperty=True)  # -> Values, Indices
values_6 = ValueListener(Elements=slider_6, SomeProperty=True)  # -> Values, Indices
values_7 = ValueListener(Elements=slider_7, SomeProperty=True)  # -> Values, Indices
values_8 = ValueListener(Elements=slider_8, SomeProperty=True)  # -> Values, Indices
values_9 = ValueListener(Elements=slider_9, SomeProperty=True)  # -> Values, Indices

# ----
# HUMAN UI
# (INTERFACE)
number_slider = Slider(2, range=0..10)

separator = CreateSeparator(Thickness=number_slider, Horizontal=True, Color=RGB(0, 0, 0))

# ---- group: DOOR
checkbox = CreateCheckbox(Label="ADD DOOR", StartingValue=False)
merge = Merge(Data1=checkbox, Data2=slider_3, Data3=slider_4, Data4=slider_5)
values_10 = ValueListener(Elements=checkbox, SomeProperty=True)  # -> Values, Indices
expander = CreateExpander(UIElements=merge, Header="DOOR", Open=True)

# ---- group: WINDOW
checkbox_2 = CreateCheckbox(Label="ADD WINDOW", StartingValue=False)
merge_2 = Merge(Data1=checkbox_2, Data2=slider_6, Data3=slider_7, Data4=slider_8, Data5=slider_9)
expander_2 = CreateExpander(UIElements=merge_2, Header="WINDOW", Open=True)
values_11 = ValueListener(Elements=checkbox_2, SomeProperty=True)  # -> Values, Indices

# ---- group: checkbox
checkbox_3 = CreateCheckbox(Label="EXPORT 3D MODELS ", StartingValue=False)
checkbox_4 = CreateCheckbox(Label="BAKE GEOMETRY", StartingValue=False)
checkbox_5 = CreateCheckbox(Label="PREVIEW 3D MODEL & CALCULATE", StartingValue=False)
values_12 = ValueListener(Elements=checkbox_4, SomeProperty=True)  # -> Values, Indices
values_13 = ValueListener(Elements=checkbox_3, SomeProperty=True)  # -> Values, Indices
values_14 = ValueListener(Elements=checkbox_5, SomeProperty=True)  # -> Values, Indices

# ---- group: DIMENISIONS WALL
label = CreateLabel(LabelText="DIMENSIONS WALL", LabelSize=Slider(15, range=0..20), Justification=0)
merge_3 = Merge(Data1=label, Data3=slider, Data4=slider_2, Data5=checkbox_5, Data6=checkbox_4, Data7=checkbox_3)

# ----
# DATABASE INPUT
# RESET DATABASE
toggle = BooleanToggle(True)
reset_database_4 = Button()

# ---- group: DATABASE SUB STRUCTURE
py__db_substructure = GhPythonScript(
    x=reset_database_4,
    Database_amount=int,
    Min_length=int_4,
    Max_length=int_2,
    Min_width=int_5,
    Max_width=int_6,
    Min_depth=int_7,
    Max_depth=int_3)  # -> out, database_substructure
# ---------- py__db_substructure: Python ----------
"""Generates the substructure data voor the database.
    All the variables that start with an underscore and capital letter are direct inputs
    Inputs:
        _Database_amount: number of wood in database for substructure
        _Min_length: minimal length in mm of wood for substructure
        _Max_length: maximum length in mm of wood for substructure 
        _Min_width: minimal width in mm of wood for substructure
        _Max_width: maximum width in mm of wood for substructure
        _Min_depth: minimal depth in mm of wood for substructure 
        _Max_depth: maximum depth in mm of wood for substructure
    Output:
        database_substructure: list with wood dimensions for substructure"""

import random

database_substructure = []

for i in range(0,_Database_amount):
    length = random.randrange(_Min_length, _Max_length + 1 ,10)
    width = random.randrange(_Min_width, _Max_width + 1 ,10)
    depth = random.randrange(_Min_depth, _Max_depth + 1 ,10)
    piece_of_wood = (length, width, depth)
    database_substructure.append(piece_of_wood)
# ---------- end py__db_substructure ----------
panel_4 = Panel(py__db_substructure.database_substructure)

# ---- group: DATABASE CLADDING
py__db_cladding = GhPythonScript(
    x=reset_database_4,
    Database_amount=int_8,
    Min_length=int_10,
    Max_length=int_9,
    Min_height=int_11,
    Max_height=int_12,
    Min_depth=int_13,
    Max_depth=int_14)  # -> out, database_cladding
# ---------- py__db_cladding: Python ----------
"""Generates the cladding data voor the database.
    All the variables that start with an underscore and capital letter are direct inputs
    Inputs:
        _Database_amount: number of wood in database for cladding
        _Min_length: minimal length in mm of wood for cladding
        _Max_length: maximum length in mm of wood for cladding 
        _Min_width: minimal width in mm of wood for cladding
        _Max_width: maximum width in mm of wood for cladding
        _Min_depth: minimal depth in mm of wood for cladding 
        _Max_depth: maximum depth in mm of wood for cladding
    Output:
        database_cladding: list with wood dimensions for cladding"""

import random 

database_cladding = []

for i in range(0, _Database_amount):
    length = random.randrange(_Min_length, _Max_length + 1, 10)
    height = random.randrange(_Min_height, _Max_height + 1, 10)
    depth = random.randrange(_Min_depth, _Max_depth + 1, 1)
    piece_of_cladding = (length, height, depth)
    database_cladding.append(piece_of_cladding)
# ---------- end py__db_cladding ----------
panel_5 = Panel(py__db_cladding.database_cladding)

# ---- group: DATABASE STRUCTURAL
py__db_structural_infill = GhPythonScript(
    x=reset_database_4,
    Database_amount=int_15,
    Min_length=int_16,
    Max_length=int_17,
    Min_width=int_18,
    Max_width=int_19,
    Min_depth=int_21,
    Max_depth=int_20)  # -> out, structural_database
# ---------- py__db_structural_infill: Python ----------
"""Generates the structural infill data voor the database.
    All the variables that start with an underscore and capital letter are direct inputs
    Inputs:
        _Database_amount: number of wood in database for structural infill
        _Min_length: minimal length in mm of wood for structural infill
        _Max_length: maximum length in mm of wood for structural infill 
        _Min_width: minimal width in mm of wood for structural infill
        _Max_width: maximum width in mm of wood for structural infill
        _Min_depth: minimal depth in mm of wood for structural infill 
        _Max_depth: maximum depth in mm of wood for structural infill
    Output:
        structural_database: list with wood dimensions"""

import random

structural_database = []

for i in range(0,_Database_amount):
    length = random.randrange(_Min_length, _Max_length + 1, 10)
    width = random.randrange(_Min_width, _Max_width + 1, 10)
    depth = random.randrange(_Min_depth, _Max_depth + 1, 10)
    piece_of_wood =(length, width, depth)
    structural_database.append(piece_of_wood)
# ---------- end py__db_structural_infill ----------
panel_6 = Panel(py__db_structural_infill.structural_database)

# ----
merge_4 = Merge(
    Data1=py__db_structural_infill.structural_database,
    Data2=py__db_substructure.database_substructure,
    Data3=py__db_cladding.database_cladding)
py__import_data_to_db = Py_ImportDataToDb(Apply=toggle, Waste_wood_data=merge_4)  # -> output; inputs Apply: list, Waste_wood_data: list
#   port Apply: [required] - type = string] - []default = ""]
# ---------- py__import_data_to_db: Python ----------
""" Combines data and sents it to PostgreSQL database.
    Inputs:
        _Apply: boolean toggle to sent data to database
    Output:
        output: conformation when data is sent. 

"""


def clear_data(): 
    #deletes existing data in database
    import psycopg2 as pg2
    conn = pg2.connect(database='hout', user='postgres', password='baksteen')
    cur = conn.cursor() 
    cur.execute("TRUNCATE wood_dimensions RESTART IDENTITY ")
    conn.commit()
    print('data removed')

def apply_data():
    #applies data to database
    for piece_of_wood in _Waste_wood_data:
        length = piece_of_wood[0]
        width = piece_of_wood[1]
        depth = piece_of_wood[2]
        strength_class = 'C18'
        collector_id = random.randint(1,6)

        cur.execute("INSERT INTO wood_dimensions(length_wood,width_wood,depth_wood,strength_class,collector_id)\
        VALUES (%s,%s,%s,%s,%s)",(length,width,depth,strength_class,collector_id));
        conn.commit()

    print('data import succes')
    return 'data import succes'
    

import psycopg2 as pg2
import random

conn = pg2.connect(database='hout', user='postgres', password='baksteen')
cur = conn.cursor()

if _Apply == True:
    clear_data()
    output = apply_data()
# ---------- end py__import_data_to_db ----------
panel_7 = Panel(py__import_data_to_db)

# ----
# DATABASE OUTPUT
py__extract_data_from_db = Py_ExtractDataFromDb(x=reset_database_4, Structural_query=panel, Substructure_query=panel_2, Cladding_query=panel_3)  # -> database, check; inputs x: list
# ---------- py__extract_data_from_db: Python ----------
""" Extracts data from PostgreSQL database.
    Inputs:
        x: reset toggle to extract new data
        _Structural_query: query to select wood suitable for structural infill
        _Substructure_query: query to select wood suitable for the substructure
        _Cladding_query: query to select wood suitable for the cladding
    Output:
        database: list of extracted data 
        check: first line of data to check if data was extracted

"""
import psycopg2 as pg2
import ctypes.wintypes
import pickle



def import_data(query, database): 
    cur.execute(query)
    conn.commit()
    data_set = cur.fetchall()
    print('data imported')
    for data in data_set:
        database.append(data)
        

database_infill = [] 
database_substructure = [] 
database_cladding = [] 

conn = pg2.connect(
    database='hout',
    user = 'postgres', 
    password = 'baksteen')
cur = conn.cursor()

import_data(_Structural_query, database_infill)
import_data(_Substructure_query, database_substructure)
import_data(_Cladding_query, database_cladding)

total_database = (database_infill, database_substructure, database_cladding)

CSIDL_PERSONAL = 5       # My Documents
SHGFP_TYPE_CURRENT = 0   # Get current, not default value
buf = ctypes.create_unicode_buffer(ctypes.wintypes.MAX_PATH)
ctypes.windll.shell32.SHGetFolderPathW(None, CSIDL_PERSONAL, None, SHGFP_TYPE_CURRENT, buf)


# filename
fname = buf.value + "\Exterior wall element tool\database_pickle"
print(fname)
#fname = "C:/Users/jvane/OneDrive/Building Technology/GRADUATION/GRASSHOPPER/database_pickle"
# filehandle
fhandle = open(fname, 'wb')
# dump data to file
pickle.dump(total_database, fhandle, protocol=2)
# close file
fhandle.close()
# output file
database = fname

check = database_infill[0]
print(check)
check = database_substructure[0]
print(check)
check = database_cladding[0]
print(check)
# ---------- end py__extract_data_from_db ----------
py__distribute_data = GhPythonScript(Database=py__extract_data_from_db.database)  # -> out, structural_database, database_substructure, database_cladding
# ---------- py__distribute_data: Python ----------
"""distributes the data from the database in 3 classes and designated list.
    All the variables that start with an underscore and capital letter are direct inputs
    Inputs:
        _Database: list with data
    Output:
        structural_database: list with wood in structural class
        database_substructure: list with wood in substructure class
        database_cladding: list with wood in cladding class"""


import ctypes.wintypes
import sys

CSIDL_PERSONAL = 5       # My Documents
SHGFP_TYPE_CURRENT = 0   # Get current, not default value
buf = ctypes.create_unicode_buffer(ctypes.wintypes.MAX_PATH)
ctypes.windll.shell32.SHGetFolderPathW(None, CSIDL_PERSONAL, None, SHGFP_TYPE_CURRENT, buf)

install_path = buf.value + "\Exterior wall element tool\wood_classes"
sys.path.append(install_path)

from classes_wood import * 
import pickle
import operator

fhandle = open(_Database, 'rb')
total_database = pickle.load(fhandle)
fhandle.close()

database_infill_list = total_database[0]
database_substructure_list = total_database[1]
database_cladding_list = total_database[2]

structural_database = []
database_substructure = []
database_cladding = []

for wood in database_infill_list:
    piece_of_wood = wood_structural(wood[0], wood[1], wood[2], wood[3])
    structural_database.append(piece_of_wood)

structural_database.sort(key = operator.attrgetter('length'))

for wood in database_substructure_list:
    piece_of_wood = wood_substructure(wood[0], wood[1], wood[2], wood[3])
    database_substructure.append(piece_of_wood)

database_substructure.sort(key = operator.attrgetter('length'))
database_substructure.sort(key = operator.attrgetter('depth'))

for wood in database_cladding_list:
    piece_of_cladding = wood_cladding(wood[0], wood[1], wood[2], wood[3])
    database_cladding.append(piece_of_cladding)

database_cladding.sort(key = operator.attrgetter('length'))
database_cladding.sort(key = operator.attrgetter('height'), reverse = True)
# ---------- end py__distribute_data ----------
panel_8 = Panel(py__extract_data_from_db.check)

# ----
# SEGMENT CALCULATION
py__divide_wall_in_segments = GhPythonScript(
    Width_wall=values.Values,
    Height_wall=values_2.Values,
    Door=values_10.Values,
    Start_door=values_5.Values,
    Width_door=values_3.Values,
    Height_door=values_4.Values,
    Start_x_window=values_8.Values,
    Start_z_window=values_9.Values,
    Width_window=values_6.Values,
    Height_window=values_7.Values,
    Database_infill=py__distribute_data.structural_database,
    Ctc_distance=int_22,
    Window=values_11.Values)  # -> out, rectangles, segments, cladding_segments; inputs Database_infill: list
# ---------- py__divide_wall_in_segments: Python ----------
"""Divides the wall in multiple segments
    All the variables that start with an underscore and capital letter are direct inputs
    Inputs:
        _Width_wall: width of the wall in mm 
        _Height_wall: height of the wall in mm 
        _Door: boolean toggle, if True apply door
        _Start_door: x coordinate of start door
        _Height_door: height of the door in mm 
        _Start_x_window: x coordinate where window starts
        _Start_z_window: z coordinate where window starts
        _Width_window: width of the window in mm
        _Height_window: height of the window in mm 
        _Database_infill: list with wood for structural infill
        _Ctc_distance: centre to centre distance between studs in mm
        _Window: boolean toggle, if True apply window
    Output:
        rectangle: list with rectangle geometry for preview in Rhino
        segments: list with dimensions and positions of segments for structural infill & substructure 
        cladding_segments: list with dimensions and positions of segments for cladding
        database_substructure: list with wood in substructure class
        database_cladding: list with wood in cladding class"""
        
import Rhino.Geometry as rg
import math
from classes_wood import * 

rectangles = [] 
segments = []
pt0 = rg.Point3d(0, 0, 0)
height_point = rg.Point3d(0, 1, 0)
zaxis = height_point-pt0
plane = rg.Plane(pt0, zaxis)

width_segments = [] 
cladding_segments = [] 

def number_segments(x_start, z_start, x_end, z_end): 
    """Calculate how many segments are required for these dimensions"""
    width_element = x_end - x_start
    height_element = z_end - z_start
    max_width = int((_Database_infill[-1].length**2 - height_element**2)**0.5)

    while max_width < width_element:
        segment_width = math.floor(max_width / _Ctc_distance) * _Ctc_distance 
        width_element -= segment_width
        segment = coordinates_segments(x_start, z_start, x_start + segment_width, z_end)
        segments.append(segment)
        x_start = x_start + segment_width
        
    if max_width > width_element:
        segment = coordinates_segments(x_start, z_start, x_end, z_end)
        segments.append(segment)

def rectangle_wall(_Width_wall, _Height_wall):
    """Generate 2d outline of wall for preview in Rhino """
    pt0 = rg.Point3d(0, 0, 0)
    pt1 = rg.Point3d(_Width_wall, 0, _Height_wall)
    rectangle = rg.Rectangle3d(plane,pt0, pt1)
    rectangles.append(rectangle) 


def rectangle_door(_Start_door, _Width_door, _Height_door):
    """Generate 2d outline of door for preview in Rhino """
    pt0 = rg.Point3d(_Start_door, 0, 0)
    pt1 = rg.Point3d(_Start_door + _Width_door, 0, _Height_door)
    rectangle = rg.Rectangle3d(plane,pt0, pt1)
    rectangles.append(rectangle) 


def rectangle_window(_Start_x_window, _Start_z_window, _Width_window, _Height_window): 
    """Generate 2d outline of window for preview in Rhino """
    pt0 = rg.Point3d(_Start_x_window, 0, _Start_z_window)
    pt1 = rg.Point3d(_Start_x_window + _Width_window, 0, _Start_z_window + _Height_window)
    rectangle = rg.Rectangle3d(plane,pt0, pt1)
    rectangles.append(rectangle) 


if _Door == False and _Window == False:
    rectangle_wall(_Width_wall, _Height_wall) 
    number_segments(0, 0, _Width_wall, _Height_wall)
    cladding_segments.append(coordinates_segments_cladding(0, 0, _Width_wall, _Height_wall))

if _Door == True and _Window == False:
    rectangle_wall(_Width_wall, _Height_wall) 
    rectangle_door(_Start_door, _Width_door, _Height_door)
    
    number_segments(0, 0, _Start_door, _Height_wall)
    number_segments(_Start_door, _Height_door, _Start_door + _Width_door, _Height_wall)
    number_segments(_Start_door + _Width_door, 0, _Width_wall, _Height_wall)
    
    cladding_segments.append(coordinates_segments_cladding(0, 0, _Start_door, _Height_door))
    cladding_segments.append(coordinates_segments_cladding(_Start_door + _Width_door, 0, _Width_wall, _Height_door))
    cladding_segments.append(coordinates_segments_cladding(0, _Height_door, _Width_wall, _Height_wall))

if _Door == False and _Window == True: 
    rectangle_wall(_Width_wall, _Height_wall) 
    rectangle_window(_Start_x_window, _Start_z_window, _Width_window, _Height_window)
    
    number_segments(0, 0, _Start_x_window, _Height_wall)
    number_segments(_Start_x_window, 0, _Start_x_window + _Width_window, _Start_z_window)
    number_segments(_Start_x_window, _Start_z_window + _Height_window, _Start_x_window + _Width_window, _Height_wall)
    number_segments(_Start_x_window + _Width_window, 0, _Width_wall, _Height_wall)
    
    cladding_segments.append(coordinates_segments_cladding(0, 0, _Width_wall, _Start_z_window))
    cladding_segments.append(coordinates_segments_cladding(0, _Start_z_window + _Height_window, _Width_wall, _Height_wall))
    cladding_segments.append(coordinates_segments_cladding(0, _Start_z_window, _Start_x_window, _Start_z_window + _Height_window))
    cladding_segments.append(coordinates_segments_cladding(_Start_x_window + _Width_window, _Start_z_window, _Width_wall, _Start_z_window + _Height_window))

if _Door == True and _Window == True:
    rectangle_wall(_Width_wall, _Height_wall) 
    rectangle_door(_Start_door, _Width_door, _Height_door)
    rectangle_window(_Start_x_window, _Start_z_window, _Width_window, _Height_window)
    
    if _Start_x_window < _Start_door:
        number_segments(0, 0, _Start_x_window, _Height_wall)
        number_segments(_Start_x_window, 0, _Start_x_window + _Width_window, _Start_z_window)
        number_segments(_Start_x_window, _Start_z_window + _Height_window, _Start_x_window + _Width_window, _Height_wall)
        number_segments(_Start_x_window + _Width_window, 0, _Start_door, _Height_wall)
        number_segments(_Start_door, _Height_door, _Start_door + _Width_door, _Height_wall)
        number_segments(_Start_door + _Width_door, 0, _Width_wall, _Height_wall)
        
        cladding_segments.append(coordinates_segments_cladding(0, 0, _Start_door, _Start_z_window))
        cladding_segments.append(coordinates_segments_cladding(0, _Start_z_window + _Height_window, _Start_door, _Height_wall))
        cladding_segments.append(coordinates_segments_cladding(0, _Start_z_window, _Start_x_window, _Start_z_window + _Height_window))
        cladding_segments.append(coordinates_segments_cladding(_Start_x_window + _Width_window, _Start_z_window, _Start_door, _Start_z_window + _Height_window))
        cladding_segments.append(coordinates_segments_cladding(_Start_door + _Width_door, 0, _Width_wall, _Height_door))
        cladding_segments.append(coordinates_segments_cladding(_Start_door, _Height_door, _Width_wall, _Height_wall))
        
    else:
        number_segments(0, 0, _Start_door, _Height_wall)
        number_segments(_Start_door, _Height_door, _Start_door + _Width_door, _Height_wall)
        number_segments(_Start_door + _Width_door, 0, _Start_x_window, _Height_wall)
        number_segments(_Start_x_window, 0, _Start_x_window + _Width_window, _Start_z_window)
        number_segments(_Start_x_window, _Start_z_window + _Height_window, _Start_x_window + _Width_window, _Height_wall)
        number_segments(_Start_x_window + _Width_window, 0, _Width_wall, _Height_wall)
        
        cladding_segments.append(coordinates_segments_cladding(0, 0, _Start_door, _Height_door))
        cladding_segments.append(coordinates_segments_cladding(0, _Height_door, _Start_door + _Width_door, _Height_wall))
        cladding_segments.append(coordinates_segments_cladding(_Start_door + _Width_door, 0, _Width_wall, _Start_z_window)) 
        cladding_segments.append(coordinates_segments_cladding(_Start_door + _Width_door, _Start_z_window, _Start_x_window, _Start_z_window + _Height_window)) 
        cladding_segments.append(coordinates_segments_cladding(_Start_door + _Width_door, _Start_z_window + _Height_window, _Width_wall, _Height_wall)) 
        cladding_segments.append(coordinates_segments_cladding(_Start_x_window + _Width_window, _Start_z_window, _Width_wall, _Start_z_window + _Height_window))
# ---------- end py__divide_wall_in_segments ----------

# ----
# STRUCTURAL INFILL & SUBSTRUCTURE
py__structural_infill_substructure = GhPythonScript(
    Generate=values_14.Values,
    Segments=py__divide_wall_in_segments.segments,
    Ctc_distance=int_22,
    Min_length_substructure_piece=int_23,
    Waste_wood_database=py__distribute_data.structural_database,
    Database_substructure=py__distribute_data.database_substructure,
    Depth_wall_element=int_24)  # -> geometry_infill_vertical, geometry_infill_horizontal, geometry_infill_bracing, geometry_infill_studs, geometry_substructure, geometry_infill_booldifference, total_infill_used, total_waste_infill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; inputs Segments: list, Waste_wood_database: list, Database_substructure: list
# ---------- py__structural_infill_substructure: Python ----------
"""Generates the geometry for the structural infill & substructure and calculates the waste
    All the variables that start with an underscore and capital letter are direct inputs
    Inputs:
        _Generate: Boolean toggle, if True apply
        _Segments: list with dimensions and positions of segments
        _Ctc_distance: centre to centre distance between studs in mm
        _Min_length_substructure_piece: minimal length that a piece of substructure can have in mm
        _Waste_wood_database: list with wood for structural infill
        _Database_substructure: list with wood for substructure
        _Depth_wall_element: depth of the exterior wall element in mm 

    Output:
        geometry_infill_vertical: list with breps for vertical frame
        geometry_infill_horizontal: list with breps for horizontal frame
        geometry_infill_bracing: list with breps for bracing 
        geometry_infill_studs: list with brep for studs
        total_infill_used: meter of wood used for structural infill
        total_waste_infill: waste in meter for structural infill
        total_infill_required: meter of wood required for structural infill
        total_substructure_used: meter of wood used for substructure
        total_waste_substructure: waste in meter for substructure
        total_substructure_required: meter of wood required for substructure 
        beams_selected_framing_ver: list of wood selected for vertical framing
        beams_selected_framing_hor: list of wood selected for horizontal framing
        beams_selected_bracing: list of wood selected for bracing
        beams_selected_studs: list of wood selected for studs
        beams_selected_substructure: list of wood selected for substructure
        """

import Rhino.Geometry as rg
import random
import math
import operator
import itertools
 

class select_structural:
    def __init__(self, selected_wood, waste, geometry): 
        self.selected_wood = selected_wood
        self.waste = waste
        self.geometry = geometry


def outer_frame_vertical(required_length, _Waste_wood_database, position):
    """Selects wood from db and generates geometry for vertical frame"""
    #pick piece of wood from database for vertical outer frame (left & right) 
    chosen_beam = next(beam for beam in _Waste_wood_database if beam.length >= required_length)
    
    #determine additional waste with picked piece of wood
    waste = chosen_beam.length - required_length
    
    if position == 'left': #0 = outerleft vertical 
        pt0 = rg.Point3d(seg_ver.x_cor_start,0, seg_ver.z_cor_start)
        pt1 = rg.Point3d(seg_ver.x_cor_start + chosen_beam.width, chosen_beam.depth, seg_ver.z_cor_end)
        x_start = seg_ver.x_cor_start
        z_start = seg_ver.z_cor_start 
        z_end = seg_ver.z_cor_end
        
    if position == 'right': #1 = outerright vertical
        pt0 = rg.Point3d(seg_ver.x_cor_end -chosen_beam.width, 0, seg_ver.z_cor_start)
        pt1 = rg.Point3d(seg_ver.x_cor_end, chosen_beam.depth, seg_ver.z_cor_end)
        x_start = seg_ver.x_cor_end -chosen_beam.width
        z_start = seg_ver.z_cor_start
        z_end = seg_ver.z_cor_end
        
    # generate geometry in grasshopper
    box = rg.BoundingBox(pt0, pt1)
    brep = box.ToBrep()
    
    #generate substructure for stud
    picked_sub = select_substructure (chosen_beam, required_length, _Database_substructure, x_start, z_start, z_end)
    return select_structural(chosen_beam, waste, brep), picked_sub
    

def outer_frame_horizontal(required_length, _Waste_wood_database, position):
    """Selects wood from db and generates geometry for horizontal frame"""
    #pick piece of wood from database for horizontal outerframe (top & bottom) 
    chosen_beam = next(beam for beam in _Waste_wood_database if beam.length >= required_length)
    
    #determine additional waste with picked piece of wood
    waste = chosen_beam.length - required_length

    if position == 'bottom': 
        pt0 = rg.Point3d(seg_ver.x_cor_start, 0, seg_ver.z_cor_start)
        pt1 = rg.Point3d(seg_ver.x_cor_end, chosen_beam.width, seg_ver.z_cor_start + chosen_beam.depth)
        
    if position == 'top':  
        pt0 = rg.Point3d(seg_ver.x_cor_start, 0, seg_ver.z_cor_end -chosen_beam.depth)
        pt1 = rg.Point3d(seg_ver.x_cor_end, chosen_beam.width, seg_ver.z_cor_end)
        
    # generate geometry in grasshopper
    box = rg.BoundingBox(pt0, pt1)
    brep = box.ToBrep()

    return select_structural(chosen_beam, waste, brep)
    

def inner_studs(required_length, _Waste_wood_database, stud_position):
    """Selects wood from db and generates geometry for vertical frame"""
    #pick piece of wood from database for vertical outer frame (left & right) 
    chosen_beam = next(beam for beam in _Waste_wood_database if beam.length >= required_length)
    waste = chosen_beam.length - required_length
    
    #generate bottom stud geometry
    pt0 = rg.Point3d(seg_ver.x_cor_start + stud_position, 0, seg_ver.z_cor_start)  
    pt1 = rg.Point3d(seg_ver.x_cor_start + stud_position + chosen_beam.width, chosen_beam.depth, seg_ver.z_cor_start + required_length)
    x_start = seg_ver.x_cor_start + stud_position
    z_start = seg_ver.z_cor_start 
    z_end = seg_ver.z_cor_start + required_length
    box = rg.BoundingBox(pt0, pt1)
    brep = box.ToBrep()

    picked_sub = select_substructure (chosen_beam, required_length, _Database_substructure, x_start, z_start, z_end)
    return select_structural(chosen_beam, waste, brep), picked_sub
    

def bracing (height_segment, width_segment, beams_selected_bracing, _Waste_wood_database):
    """Selects wood from db and generates geometry for bracing"""
    #determine dimensions right triangle for pythagoras calculation
    bracing_width = width_segment - beams_selected_framing[0+fr_counter].width - beams_selected_framing[1+fr_counter].width  
    bracing_height = height_segment - beams_selected_framing[2+fr_counter].depth - beams_selected_framing[3+fr_counter].depth  
    bracing_length = round((bracing_width**2 + bracing_height**2)**0.5)
    
    #pick piece of waste wood from database for bracing
    chosen_beam = next(beam for beam in _Waste_wood_database if beam.length >= bracing_length)
    waste = chosen_beam.length - bracing_length
    
    #calculation 
    tan = bracing_width / bracing_height
    y = math.degrees(math.atan(tan))
    corner = 90 - y 
    extra_x = math.sin(math.radians(corner)) * (0.5 * chosen_beam.depth)
    extra_z = math.cos(math.radians(corner)) * (0.5 * chosen_beam.depth)
    
    pt1 = rg.Point3d(beams_selected_framing[0+fr_counter].width + seg_ver.x_cor_start - extra_x , 0, seg_ver.z_cor_end - beams_selected_framing[3+fr_counter].depth - extra_z)
    pt2 = rg.Point3d(seg_ver.x_cor_end-beams_selected_framing[1+fr_counter].width - extra_x , 0, seg_ver.z_cor_start + beams_selected_framing[2+fr_counter].depth - extra_z)
    
    if tan < 1:
        box_1 = rg.Point3d(0,0,0) 
        box_2 = rg.Point3d(chosen_beam.depth, chosen_beam.width, -bracing_length)
        zaxis = pt1-pt2
    
    if tan >= 1:
        box_1 = rg.Point3d(0,0,0) 
        box_2 = rg.Point3d(chosen_beam.depth, -chosen_beam.width, bracing_length)
        zaxis = pt2-pt1

    plane = rg.Plane(pt1, zaxis)
    box = rg.BoundingBox(box_1,box_2)
    bracing_geo = rg.Box(plane, box) 
    return select_structural(chosen_beam, waste, bracing_geo)


def intersection_formula (x_position, height_segment):
    """Formula to determine height of the studs"""
    #determine the formula of the bracing so the length of the bottom and top stud can be termined on every position along the slope
    a = (height_segment - beams_selected_framing[2+fr_counter].depth - beams_selected_framing[3+fr_counter].depth) / (width_segment- beams_selected_framing[0+fr_counter].width - beams_selected_framing[1+fr_counter].width)
    b = height_segment - beams_selected_framing[2+fr_counter].depth - beams_selected_framing[3+fr_counter].depth
    y = -a * x_position + b 
    length_bottom_stud = round(y + beams_selected_framing[2+fr_counter].depth) 
    return length_bottom_stud
    

def geo_bottom_stud (chosen_bottom_stud, bottom_stud_length, stud_position):

    #generate bottom stud geometry
    pt0 = rg.Point3d(seg_ver.x_cor_start + stud_position, 0, seg_ver.z_cor_start)  
    pt1 = rg.Point3d(seg_ver.x_cor_start + stud_position + chosen_bottom_stud.width, chosen_bottom_stud.depth, seg_ver.z_cor_start + bottom_stud_length)
    x_start = seg_ver.x_cor_start + stud_position
    z_start = seg_ver.z_cor_start 
    z_end = seg_ver.z_cor_start + bottom_stud_length
    box = rg.BoundingBox(pt0, pt1)
    brep = box.ToBrep()

    picked_bot_sub = select_substructure (chosen_bottom_stud, bottom_stud_length, _Database_substructure, x_start, z_start, z_end)
    return brep, picked_bot_sub


def geo_top_stud (chosen_top_stud, top_stud_length, stud_positiont):

    #generate top stud geometry
    center_align = (chosen_bottom_stud.width - chosen_top_stud.width) / 2
    pt0 = rg.Point3d(seg_ver.x_cor_start + stud_position + center_align, 0, seg_ver.z_cor_start + bottom_stud_length)
    pt1 = rg.Point3d(seg_ver.x_cor_start + stud_position + center_align + chosen_top_stud.width, chosen_top_stud.depth, seg_ver.z_cor_end)
    x_start = seg_ver.x_cor_start + stud_position + center_align
    z_start = seg_ver.z_cor_start + bottom_stud_length 
    z_end = seg_ver.z_cor_end
    box = rg.BoundingBox(pt0, pt1)
    brep = box.ToBrep()
    
    picked_top_sub = select_substructure (chosen_top_stud, top_stud_length, _Database_substructure, x_start, z_start, z_end)
    return brep, picked_top_sub


def select_substructure (beam_infill, required_length, _Database_substructure, x_start, z_start, z_end):
    """Selects wood from db and generates geometry for substructure"""
    beam_pair = []
    
    #determine required depth for the substructure piece so that the complete substructre is alligned
    depth_required = _Depth_wall_element - beam_infill.depth
    length_required = required_length
    
    #picks the option to complete the substructure with 1 piece
    suitable_beams = iter([beam_sub for beam_sub in _Database_substructure if beam_sub.depth == depth_required and beam_sub.length >= length_required])
    chosen_beam = next(suitable_beams)

    #temp list with all the possible pieces that are longer then min required length and smaller then the required length.
    beams_selected_temp = [beam.length for beam in _Database_substructure if 
    beam.length >= _Min_length_substructure_piece and beam.length < length_required and beam.depth == depth_required]

    #looks for all the options where the total length of two pieces is smaller then thet total length of 1 piece. 
    for numbers in itertools.combinations(beams_selected_temp,2):
        if sum(numbers) >= length_required and sum(numbers) < chosen_beam.length:
            beam_pair.append(numbers)
            
    #if there is no combination of two pieces, the single piece is picked
    if beam_pair == []: 
        waste = chosen_beam.length - length_required

        pt0 = rg.Point3d(x_start, beam_infill.depth, z_start)
        pt1 = rg.Point3d(x_start+chosen_beam.width, beam_infill.depth+chosen_beam.depth, z_end)
        box = rg.BoundingBox(pt0, pt1)
        brep = box.ToBrep()
        
        return [select_structural(chosen_beam, waste, brep)]

    #otherwise the combination that generates the least waste is selected
    else:
        beam_pair.sort(key=sum)
        beam_pair_1 = next(beam for beam in _Database_substructure if beam.length == beam_pair[0][0] and beam.depth == depth_required)
        beam_pair_2 = next(beam for beam in _Database_substructure if beam.length == beam_pair[0][1] and beam.depth == depth_required and beam.id != beam_pair_1.id)

        pt0 = rg.Point3d(x_start, beam_infill.depth, z_start)
        pt1 = rg.Point3d(x_start + beam_pair_1.width, beam_infill.depth+beam_pair_1.depth, z_start + beam_pair_1.length)
        box = rg.BoundingBox(pt0, pt1)
        brep_1 = box.ToBrep()
        
        pt0 = rg.Point3d(x_start, beam_infill.depth, z_start + beam_pair_1.length)
        pt1 = rg.Point3d(x_start +beam_pair_2.width, beam_infill.depth+beam_pair_2.depth, z_end)
        box = rg.BoundingBox(pt0, pt1)
        brep_2 = box.ToBrep()
        
        waste = (sum(beam_pair[0]) - length_required) / 2 

        return select_structural(beam_pair_1, waste, brep_1), select_structural(beam_pair_2, waste, brep_2)


structural_infill_waste = []
substructure_waste = []
structural_infill_used = [] 
end_of_life = [] 

beams_selected_bracing = [] 
beams_selected_framing_hor = [] 
beams_selected_framing_ver = [] 
beams_selected_framing = []
beams_selected_studs = []

beams_selected_substructure = []  

geometry_infill_booldifference = []
geometry_infill_horizontal = [] 
geometry_infill_vertical = []  
geometry_infill_studs = [] 
geometry_infill_bracing = [] 
geometry_substructure = []

fr_counter = 0 
br_counter = 0 

if _Generate: 
    for seg_ver in _Segments: 
        width_segment = seg_ver.x_cor_end - seg_ver.x_cor_start
        height_segment = seg_ver.z_cor_end - seg_ver.z_cor_start

        picked_ver_frame = outer_frame_vertical(height_segment, _Waste_wood_database, 'left')
        _Waste_wood_database.remove(picked_ver_frame[0].selected_wood)
        structural_infill_waste.append(picked_ver_frame[0].waste)
        beams_selected_framing_ver.append(picked_ver_frame[0].selected_wood)
        beams_selected_framing.append(picked_ver_frame[0].selected_wood)
        structural_infill_used.append(picked_ver_frame[0].selected_wood.length)
        geometry_infill_vertical.append(picked_ver_frame[0].geometry)
        if height_segment > 1500: 
            geometry_infill_booldifference.append(picked_ver_frame[0].geometry)
            
        for substructure in picked_ver_frame[1]:
            beams_selected_substructure.append(substructure.selected_wood)
            _Database_substructure.remove(substructure.selected_wood)
            geometry_substructure.append(substructure.geometry)
            substructure_waste.append(substructure.waste)
        
        picked_ver_frame_2 = outer_frame_vertical(height_segment, _Waste_wood_database, 'right')
        _Waste_wood_database.remove(picked_ver_frame_2[0].selected_wood)
        structural_infill_waste.append(picked_ver_frame_2[0].waste)
        beams_selected_framing_ver.append(picked_ver_frame_2[0].selected_wood)
        beams_selected_framing.append(picked_ver_frame_2[0].selected_wood)
        structural_infill_used.append(picked_ver_frame_2[0].selected_wood.length)
        geometry_infill_vertical.append(picked_ver_frame_2[0].geometry)
        if height_segment > 1500: 
            geometry_infill_booldifference.append(picked_ver_frame_2[0].geometry)
        
        for substructure in picked_ver_frame_2[1]:
            beams_selected_substructure.append(substructure.selected_wood)
            _Database_substructure.remove(substructure.selected_wood)
            geometry_substructure.append(substructure.geometry)
            substructure_waste.append(substructure.waste)
                
        picked_hor = outer_frame_horizontal(width_segment, _Waste_wood_database, 'bottom')
        _Waste_wood_database.remove(picked_hor.selected_wood)
        structural_infill_waste.append(picked_hor.waste)
        beams_selected_framing_hor.append(picked_hor.selected_wood)
        beams_selected_framing.append(picked_hor.selected_wood)
        structural_infill_used.append(picked_hor.selected_wood.length)
        geometry_infill_horizontal.append(picked_hor.geometry)
        
        picked_hor2 = outer_frame_horizontal(width_segment, _Waste_wood_database, 'top') 
        structural_infill_waste.append(picked_hor2.waste)
        beams_selected_framing_hor.append(picked_hor2.selected_wood)
        beams_selected_framing.append(picked_hor2.selected_wood)
        structural_infill_used.append(picked_hor2.selected_wood.length)
        geometry_infill_horizontal.append(picked_hor2.geometry)
        
        
        reuse = (height_segment - beams_selected_framing_hor[-1].depth - beams_selected_framing_hor[-2].depth + width_segment) * 2
        end_of_life.append(reuse)

        if height_segment < 1500 or width_segment < _Ctc_distance:
            stud_step = 450
            stud_position = stud_step
            while stud_position < width_segment:
                #determine required length for bottom & top stud
                stud_length = height_segment
                picked_inner = inner_studs(stud_length, _Waste_wood_database, stud_position)
                
                _Waste_wood_database.remove(picked_inner[0].selected_wood)
                structural_infill_waste.append(picked_inner[0].waste)
                beams_selected_studs.append(picked_inner[0].selected_wood)
                structural_infill_used.append(picked_inner[0].selected_wood.length)
                geometry_infill_studs.append(picked_inner[0].geometry)
                
                for substructure in picked_inner[1]:
                    beams_selected_substructure.append(substructure.selected_wood)
                    _Database_substructure.remove(substructure.selected_wood)
                    geometry_substructure.append(substructure.geometry)
                    substructure_waste.append(substructure.waste)
                
                stud_position = stud_position + stud_step
                reuse = stud_length - beams_selected_framing_hor[-1].depth - beams_selected_framing_hor[-2].depth
                end_of_life.append(reuse)
                
            fr_counter += 4 
            #inner_studs(stud_length, _Waste_wood_database, width_segment)
        
        else: 
            picked_bracing = bracing(height_segment, width_segment, beams_selected_bracing, _Waste_wood_database)
            _Waste_wood_database.remove(picked_bracing.selected_wood)
            structural_infill_waste.append(picked_bracing.waste)
            beams_selected_bracing.append(picked_bracing.selected_wood)
            structural_infill_used.append(picked_bracing.selected_wood.length)
            geometry_infill_bracing.append(picked_bracing.geometry)
        
            stud_position = _Ctc_distance

            while stud_position < width_segment:
                #determine required length for bottom & top stud
                bottom_stud_length = intersection_formula (stud_position, height_segment)
                top_stud_length = height_segment - bottom_stud_length 
                margin = 0 
                controle = False
                
                while controle == False:
                    suitable_bottom_studs = iter([beam for beam in _Waste_wood_database if beam.length >= bottom_stud_length + margin])
                    chosen_bottom_stud = next(suitable_bottom_studs) 
                    
                    #restrictions top studs based on bottom stud, top stud cannot be wider or deeper then bottom stud
                    suitable_top_studs = iter([beam for beam in _Waste_wood_database if beam.length >= top_stud_length 
                    and beam.width <= chosen_bottom_stud.width
                    and beam.depth == chosen_bottom_stud.depth 
                    and beam.length < top_stud_length + 150
                    and beam.id != chosen_bottom_stud.id])
                    
                    chosen_top_stud = next(suitable_top_studs, 0)
                    
                    #if no top stud is suitable, a different bottom stud is selected
                    if chosen_top_stud == 0:
                        margin +=1
        
                    else: 
                        controle = True
                        
                        #determine waste bottom stud & remove bottom studs from database
                        waste = chosen_bottom_stud.length - bottom_stud_length
                        _Waste_wood_database.remove(chosen_bottom_stud)
                        structural_infill_waste.append(waste)
                        beams_selected_studs.append(chosen_bottom_stud)
                        structural_infill_used.append(chosen_bottom_stud.length)
                        
                        picked_bot_stud = geo_bottom_stud (chosen_bottom_stud, bottom_stud_length, stud_position)
                        geometry_infill_studs.append(picked_bot_stud[0])
                        for substructure in picked_bot_stud[1]:
                            beams_selected_substructure.append(substructure.selected_wood)
                            _Database_substructure.remove(substructure.selected_wood)
                            geometry_substructure.append(substructure.geometry)
                            substructure_waste.append(substructure.waste)
                            
                            
                        #determine waste top stud & remove top studs from database
                        waste = chosen_top_stud.length - top_stud_length
                        _Waste_wood_database.remove(chosen_top_stud)
                        structural_infill_waste.append(waste)
                        beams_selected_studs.append(chosen_top_stud)
                        structural_infill_used.append(chosen_top_stud.length)
                        
                        picked_top_stud = geo_top_stud(chosen_top_stud, top_stud_length, stud_position)
                        geometry_infill_studs.append(picked_top_stud[0])
                        for substructure in picked_top_stud[1]:
                            beams_selected_substructure.append(substructure.selected_wood)
                            _Database_substructure.remove(substructure.selected_wood)
                            geometry_substructure.append(substructure.geometry)
                            substructure_waste.append(substructure.waste)                     
                        
                        
                        stud_position = stud_position + _Ctc_distance
                        reuse = height_segment - beams_selected_framing_hor[-1].depth - beams_selected_framing_hor[-2].depth - beams_selected_bracing[-1].depth
                        end_of_life.append(reuse)
            fr_counter += 4 
            br_counter += 1 
    
    #calculate the total waste of the structural infill + substructure
    total_waste = sum(structural_infill_waste) + sum(substructure_waste) 
    
    total_infill = beams_selected_bracing + beams_selected_framing + beams_selected_studs
    total_infill_used = round(sum(structural_infill_used)/1000,2)
    total_waste_infill = round(sum(structural_infill_waste)/1000,2)
    total_infill_required =  round((sum(structural_infill_used)/1000)-(sum(structural_infill_waste)/1000),2)
    
    substructure_used = [wood.length for wood in beams_selected_substructure]
    total_substructure_used = round(sum(substructure_used)/1000,2)
    total_waste_substructure = round(sum(substructure_waste)/1000,2)
    total_substructure_required = round(sum(substructure_used)/1000 - sum(substructure_waste)/1000,2)
    total_infill_used_2 = sum(structural_infill_used)/1000
    total_substructure_used_2 = sum(substructure_used)/1000
    reuse_end_of_life = round(sum(end_of_life)/1000,2)
    
    total_volume = [] 

    #check to see if no piece of wood was selected twice from the database
    print('\n') 
    print('structural_infill') 
    total_infill.sort(key = operator.attrgetter('id'))
    for balk in total_infill:
        balk.print_data()
        volume = (balk.length / 1000) * (balk.width / 1000) * (balk.depth / 1000)
        total_volume.append(volume) 
    
    #check to see if no piece of wood was selected twice from the database
    print('\n') 
    print('substructure') 
    beams_selected_substructure.sort(key = operator.attrgetter('id'))
    for balk in beams_selected_substructure:
        balk.print_data()
        volume = (balk.length / 1000) * (balk.width / 1000) * (balk.depth / 1000)
        total_volume.append(volume) 
        
    total_volume_def = sum(total_volume) 
    print(total_volume_def)
# ---------- end py__structural_infill_substructure ----------

# ----
# CLADDING
py__cladding = GhPythonScript(
    Generate=values_14.Values,
    Database_cladding=py__distribute_data.database_cladding,
    Ctc_distance=int_22,
    Cladding_segments=py__divide_wall_in_segments.cladding_segments)  # -> out, geometry_cladding, total_cladding_waste, total_cladding_used, total_cladding_required, wood_selected_cladding; inputs Database_cladding: list, Cladding_segments: list
# ---------- py__cladding: Python ----------
"""Generates the geometry for the cladding and calculates the waste
    All the variables that start with an underscore and capital letter are direct inputs
    Inputs:
        _Generate: Boolean toggle, if True apply
        _Database_cladding: list with wood for cladding
        _Ctc_distance: centre to centre distance between studs in mm
        _Cladding_segments: list with dimensions and positions of segments for cladding

    Output:
        geometry_claddingl: list with breps for cladding
        total_cladding_waste: waste in meter for cladding
        total_claddding_used: meter of wood used for cladding
        total_cladding_required: meter of wood required for cladding
        wood_selected_cladding: list of wood selected for cladding
        """

import Rhino.Geometry as rg
import itertools
import math

class cladding:
    def __init__(self, selected_wood_clad, geometry_clad): 
        self.selected_wood_clad = selected_wood_clad
        self.geometry_clad = geometry_clad

def cladding_geometry (required_length, current_height, piece_height, x_start, x_end, z_start, z_end, height_segment):
    """Selects wood from db and generates geometry for cladding"""
    picked_cladding = next(clad for clad in _Database_cladding if clad.height == piece_height and clad.length == required_length)

    pt0 = rg.Point3d(x_start, 250, z_start + current_height)
    pt1 = rg.Point3d(x_end, 250 + picked_cladding.depth, z_start + current_height + piece_height)
    if current_height + piece_height > height_segment:
        pt1 = rg.Point3d(x_end, 250 + picked_cladding.depth, z_end)
    box = rg.BoundingBox(pt0, pt1)
    brep = box.ToBrep()

    return cladding(picked_cladding, brep)


cladding_waste = [] 
geometry_cladding = []
wood_selected_cladding = []  

if _Generate: 
    for segment in _Cladding_segments: 
        height_segment = segment.z_cor_end - segment.z_cor_start
        width_segment = segment.x_cor_end - segment.x_cor_start
        x_start = segment.x_cor_start
        
        cladding_selected_temp = []  
        current_height = 0 
        marge = 0 
        
        #calculate the max allowed cladding pieces in x-direction
        max_number_pieces = int(math.floor(width_segment / (_Ctc_distance*2)))
        
        min_length_clad = 2*_Ctc_distance
        if width_segment < 2*_Ctc_distance:
            min_length_clad = width_segment
        
        #marge prevents the happening of infinite while loop
        while marge < 1000:
            if current_height > height_segment:
                break
        
            #start finding cladding with the highest height cladding 
            piece_height = _Database_cladding[0].height
            
            #continue until it is tried with the lowest height cladding 
            while piece_height >= _Database_cladding[-1].height:
                #generate list with all the cladding with the same height
                cladding_same_height = [clad.length for clad in _Database_cladding if clad.height == piece_height and clad.length >= min_length_clad]
                
                if current_height >= height_segment:
                    break
        
                #see if the total width of the wall can be covered with one piece of cladding
                for clad_len in cladding_same_height[:]:
                     if clad_len >= width_segment and clad_len <= width_segment + marge:
                        cladding_same_height.remove(clad_len)
                        waste = clad_len - width_segment
                        cladding_waste.append(waste)
                        picked = cladding_geometry (clad_len, current_height, piece_height, segment.x_cor_start, segment.x_cor_end, segment.z_cor_start, segment.z_cor_end, height_segment)
                       
                        wood_selected_cladding.append(picked.selected_wood_clad)
                        _Database_cladding.remove(picked.selected_wood_clad)
                        geometry_cladding.append(picked.geometry_clad)
                        
                        current_height += piece_height
                        
                if current_height >= height_segment:
                            break
                
                #see if the width of the wall can be covered with n pieces of cladding, to a maximum of calculated max_number_pieces
                for x_pieces in range(2,max_number_pieces+1):
                    for numbers in itertools.combinations(cladding_same_height,x_pieces):
                        x_start = segment.x_cor_start 
                        if current_height >= height_segment:
                            break
                        if sum(numbers) >= width_segment and sum(numbers) <= width_segment + marge: 
                            check =  all(elem in cladding_same_height for elem in numbers)
                            if check:
                                for counter in range(0,x_pieces):
                                    if counter == x_pieces - 1:
                                        picked_1 = cladding_geometry (numbers[counter], current_height, piece_height, x_start, segment.x_cor_end, segment.z_cor_start, segment.z_cor_end, height_segment)
                                        wood_selected_cladding.append(picked_1.selected_wood_clad) 
                                        _Database_cladding.remove(picked_1.selected_wood_clad)
                                        geometry_cladding.append(picked_1.geometry_clad)
                                    else:
                                        picked_2 = cladding_geometry (numbers[counter], current_height, piece_height, x_start, x_start + numbers[counter], segment.z_cor_start, segment.z_cor_end, height_segment)
                                        wood_selected_cladding.append(picked_2.selected_wood_clad) 
                                        _Database_cladding.remove(picked_2.selected_wood_clad)
                                        geometry_cladding.append(picked_2.geometry_clad)
                                    x_start += numbers[counter]
                                    cladding_same_height.remove(numbers[counter])
                                
                                waste = sum(numbers) - width_segment
                                cladding_waste.append(waste)
                                current_height += piece_height
                
                piece_height -= 10 
            marge += 10
        
        #calculate the amount of waste 
        cladding_used = [length.length for length in wood_selected_cladding]
        total_cladding_used = round(sum(cladding_used)/1000,2)
        total_cladding_waste = round(sum(cladding_waste)/1000,2)
        total_cladding_required = round((sum(cladding_used)/1000)-(sum(cladding_waste)/1000),2)
# ---------- end py__cladding ----------

brep = Brep(py__structural_infill_substructure.geometry_infill_booldifference)

# ----
# BAKING & GEOMETRY EXPORT
brep_2 = Brep(py__structural_infill_substructure.geometry_infill_bracing)
brep_3 = Brep(py__structural_infill_substructure.geometry_infill_studs)
brep_4 = Brep(py__structural_infill_substructure.geometry_infill_horizontal)
brep_5 = Brep(py__structural_infill_substructure.geometry_infill_vertical)
py__booleandifference = GhPythonScript(Generate=values_12.Values, Bracing=brep_2, Studs=brep_3, Framing=brep, Horizontal_frame=brep_4, Vertical_frame=brep_5)  # -> out, bracing_geo, vertical_frame_geo, studs_geo, next_step; inputs Bracing: list of Brep, Studs: list of Brep, Framing: list of Brep, Horizontal_frame: list of Brep, Vertical_frame: list of Brep
# ---------- py__booleandifference: Python ----------
"""Peformes a BooleanDifference operation on the breps
    All the variables that start with an underscore and capital letter are direct inputs
    Inputs:
        _Generate: Boolean toggle, if True apply
        _Bracing: list with breps used for bracing
        _Studs: list with breps used for the studs
        _Framing: list with breps used with vertical frame that also have bracing
        _Horizontal_frame: list with breps used for the horizontal frame
        _Vertical_frame: list with breps used for the vertical frame

    Output:
        bracing_geo: list with modified breps for bracing
        vertical_frame_geo: list with modified breps for the vertical frame
        studs_geo: list with modified breps for the studs 
        next_step: Boolean toggle, allow next step to happen when boolean difference is complete
"""

import Rhino.Geometry as rg

if _Generate: 
    bracing_geo = rg.Brep.CreateBooleanDifference(_Bracing, _Horizontal_frame, 0.01)
    bracing_geo = rg.Brep.CreateBooleanDifference(bracing_geo, _Framing, 0.01)
    vertical_frame_diff = rg.Brep.CreateBooleanDifference(_Vertical_frame, _Horizontal_frame, 0.01)
    vertical_frame_geo = rg.Brep.CreateBooleanDifference(vertical_frame_diff, bracing_geo, 0.01)
    studs_diff = rg.Brep.CreateBooleanDifference(_Studs, _Horizontal_frame, 0.01)
    studs_geo = rg.Brep.CreateBooleanDifference(studs_diff, bracing_geo, 0.01)

    #removes any unwanted geometry that is generated when the bracing sticks out of the wall element. 
    bracing_geo = [brep for brep in bracing_geo if brep.GetVolume() > 100000]
    
    #This assures that the export or bake can only happens when the Boolean difference is complete 
    next_step = True
    

else: 
    next_step = False
# ---------- end py__booleandifference ----------
brep_6 = Brep(py__booleandifference.vertical_frame_geo)
brep_7 = Brep(brep_4)
brep_8 = Brep(py__booleandifference.studs_geo)
brep_9 = Brep(py__structural_infill_substructure.geometry_substructure)
brep_10 = Brep(py__cladding.geometry_cladding)

brep_11 = Brep([brep_2, brep_3, brep_4, brep_5, brep_9, brep_10])

# ----
# WASTE WOOD STATISTICS
py_calculations = GhPythonScript(
    Total_infill_used=py__structural_infill_substructure.total_infill_used,
    Total_waste_infill=py__structural_infill_substructure.total_waste_infill,
    Total_infill_required=py__structural_infill_substructure.total_infill_required,
    Total_substructure_used=py__structural_infill_substructure.total_substructure_used,
    Total_waste_substructure=py__structural_infill_substructure.total_waste_substructure,
    Total_substructure_required=py__structural_infill_substructure.total_substructure_required,
    Total_cladding_used=py__cladding.total_cladding_used,
    Total_cladding_waste=py__cladding.total_cladding_waste,
    Total_cladding_required=py__cladding.total_cladding_required,
    End_of_life=py__structural_infill_substructure.reuse_end_of_life,
    Breps=brep_11)  # -> total_infill_used, total_waste_infill, total_infill_required, total_substructure_used, total_waste_substructure, total_substructure_required, total_cladding_used, total_cladding_waste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; inputs Breps: list of Brep
# ---------- py_calculations: Python ----------
"""Transforms the waste wood data in a string for the exterior wall element tool
All the variables that start with an underscore and capital letter are direct inputs"""

total_infill_used = 'strucutral infill used: '+ str(_Total_infill_used) + 'm'
total_waste_infill = 'strucutral infill waste: '+ str(_Total_waste_infill) + 'm'
total_infill_required =  'structural infill required: ' + str(_Total_infill_required) + 'm'

total_substructure_used = 'substructure used: '+ str(_Total_substructure_used) + 'm'
total_waste_substructure = 'substructure waste: '+ str(_Total_waste_substructure) + 'm'
total_substructure_required =  'substructure required: ' + str(_Total_substructure_required) + 'm'

total_cladding_used = 'total cladding used: ' + str(_Total_cladding_used) + 'm'
total_cladding_waste = 'total cladding waste: ' + str(_Total_cladding_waste) + 'm'
total_cladding_required = 'total cladding required: ' + str(_Total_cladding_required) + 'm'

total_wood_used = 'Total wood used: ' + str(_Total_infill_used + _Total_substructure_used + _Total_cladding_used) + 'm'
total_waste = 'Total waste: ' + str(_Total_waste_infill + _Total_waste_substructure + _Total_cladding_waste) + 'm'

end_of_life = _End_of_life + _Total_substructure_used + _Total_cladding_used
end_of_life_txt = 'End of life reusable: ' + str(end_of_life) + 'm'
end_of_life_per = round(end_of_life / (_Total_infill_used + _Total_substructure_used + _Total_cladding_used) * 100)
end_of_life_waste = 100 - end_of_life_per

volume = bracing_geo = [piece_wood.GetVolume() for piece_wood in _Breps]
total_volume = round(sum(volume)/1000000)
total_volume_dm3 = 'Total volume: ' + str(total_volume) + ' dm3'
weight = round(500 * (total_volume/1000))
weight_kg = 'Total weight: ' + str(weight) + ' kg'
# ---------- end py_calculations ----------
panel_9 = Panel(py_calculations.end_of_life_txt)
panel_10 = Panel(py_calculations.total_waste_infill)
panel_11 = Panel(py_calculations.total_infill_used)
panel_12 = Panel(py_calculations.total_infill_required)
panel_13 = Panel(py_calculations.total_substructure_used)
panel_14 = Panel(py_calculations.total_waste_substructure)
panel_15 = Panel(py_calculations.total_substructure_required)
panel_16 = Panel(py_calculations.total_cladding_used)
panel_17 = Panel(py_calculations.total_cladding_waste)
panel_18 = Panel(py_calculations.total_cladding_required)

panel_19 = Panel(py_calculations.total_volume_dm3)
panel_20 = Panel(py_calculations.weight_kg)
brep_12 = Brep(py__booleandifference.bracing_geo)

brep_13 = Brep(flatten([brep_7, brep_6, brep_9, brep_10, brep_8, brep_12]))
py__export_geometry_to_3dm_files = GhPythonScript(
    Export=values_13.Values,
    Active=py__booleandifference.next_step,
    Bracing_geo=brep_12,
    Vertical_frame_geo=brep_6,
    Horizontal_frame_geo=brep_7,
    Studs_geo=brep_8,
    Substructure_geo=brep_9,
    Cladding_geo=brep_10,
    Beams_selected_framing_ver=py__structural_infill_substructure.beams_selected_framing_ver,
    Beams_selected_framing_hor=py__structural_infill_substructure.beams_selected_framing_hor,
    Beams_selected_bracing=py__structural_infill_substructure.beams_selected_bracing,
    Beams_selected_studs=py__structural_infill_substructure.beams_selected_studs,
    Beams_selected_substructure=py__structural_infill_substructure.beams_selected_substructure,
    Wood_selected_cladding=py__cladding.wood_selected_cladding,
    Layer="Layer 01")  # -> id_list, toggle; inputs Bracing_geo: list, Vertical_frame_geo: list, Horizontal_frame_geo: list, Studs_geo: list, Substructure_geo: list, Cladding_geo: list, Beams_selected_framing_ver: list, Beams_selected_framing_hor: list, Beams_selected_bracing: list, Beams_selected_studs: list, Beams_selected_substructure: list, Wood_selected_cladding: list
# ---------- py__export_geometry_to_3dm_files: Python ----------
"""exports each baked brep to a seperate 3dm file 
    All the variables that start with an underscore and capital letter are direct inputs
    Inputs:
        _Active: Boolean toggle, if True apply
        _Bracing_geo: list with breps for bracing
        _Vertical_frame_geo: list with breps for the vertical frame
        _Horizontal_frame_geo: list with breps for the vertical frame
        _Studs_geo: list with breps for the studs 
        _Substructure_geo: list with breps for the substructure
        _Cladding_geo: list with breps for the cladding
        _Beams_selected_framing_ver: list of wood selected for vertical framing
        _Beams_selected_framing_hor: list of wood selected for horizontal framing
        _Beams_selected_bracing: list of wood selected for bracing
        _Beams_selected_studs: list of wood selected for studs
        _Beams_selected_substructure: list of wood selected for substructure
        _Wood_selected_cladding: list of wood selected for cladding
        _Layer: layer where geometry needs to be baked in

    Output:
        id_list: list with all the id numbers of the exported wood
        toggle: Boolean toggle, allow next step to happen when export is complete
"""
import ctypes.wintypes
import rhinoscriptsyntax as rs
import scriptcontext as sc
import Rhino   

def export_file (geometry, wood_list):
    """Bakes brep to Rhino and exports it to 3dm file"""
    counter = 0 
    for brep in geometry:
        id_list.append(wood_list[counter].id)
        brep_id = brep
        sc.doc = ghdoc
        doc_object = rs.coercerhinoobject(brep_id)
        baked_geo = doc_object.Geometry
        attributes = doc_object.Attributes
        sc.doc = Rhino.RhinoDoc.ActiveDoc
        rs.UnselectAllObjects()
        baked_obj = sc.doc.Objects.Add(baked_geo, attributes)
        rs.ObjectLayer(baked_obj, _Layer)
        rs.SelectObject(baked_obj)
        filepath = save_dir + 'id_' + str(wood_list[counter].id)
        rs.Command('_-Export "'+ filepath + '.3dm" _Enter _Enter')
        counter += 1 

id_list = [] 
toggle = False

CSIDL_PERSONAL = 5       # My Documents
SHGFP_TYPE_CURRENT = 0   # Get current, not default value
buf = ctypes.create_unicode_buffer(ctypes.wintypes.MAX_PATH)
ctypes.windll.shell32.SHGetFolderPathW(None, CSIDL_PERSONAL, None, SHGFP_TYPE_CURRENT, buf)

save_dir = buf.value + "\\Exterior wall element tool\\Exported 3dm files\\"

#export every geometry to a folder with the correlating ID number as file name
if _Export and _Active: 
    rs.UnselectAllObjects()
    export_file(_Vertical_frame_geo, _Beams_selected_framing_ver)
    export_file(_Horizontal_frame_geo, _Beams_selected_framing_hor)
    export_file(_Studs_geo, _Beams_selected_studs)
    export_file(_Bracing_geo, _Beams_selected_bracing)
    export_file(_Substructure_geo, _Beams_selected_substructure)
    export_file(_Cladding_geo, _Wood_selected_cladding)
        
    sc.doc = Rhino.RhinoDoc.ActiveDoc
    objs = rs.ObjectsByLayer(_Layer)
    rs.DeleteObjects(objs)
    toggle = True
# ---------- end py__export_geometry_to_3dm_files ----------
py__bake_geometry = GhPythonScript(Active=py__booleandifference.next_step, Geometry=brep_13, Layer="Default")  # inputs Geometry: list
# ---------- py__bake_geometry: Python ----------
"""Bakes the geometry to a rhino file
    All the variables that start with an underscore and capital letter are direct inputs
    Inputs:
        _Active: Boolean toggle, if True apply
        _Geometry: list with breps
        _Layer: layer where geometry needs to be baked in
"""
import rhinoscriptsyntax as rs
import scriptcontext as sc
import Rhino   

if _Active: 
    for brep in _Geometry:
        brep_id = brep
        sc.doc = ghdoc
        doc_object = rs.coercerhinoobject(brep_id)
        baked_geo = doc_object.Geometry
        attributes = doc_object.Attributes
        sc.doc = Rhino.RhinoDoc.ActiveDoc
        baked_geo = sc.doc.Objects.Add(baked_geo, attributes)

#remove the baked geometry when the toggle is off
else: 
    sc.doc = Rhino.RhinoDoc.ActiveDoc
    objs = rs.ObjectsByLayer(_Layer)
    rs.DeleteObjects(objs)
# ---------- end py__bake_geometry ----------

panel_21 = Panel(py__export_geometry_to_3dm_files.id_list)
py__remove_used_wood_from_db = Py_RemoveUsedWoodFromDb(Apply=py__export_geometry_to_3dm_files.toggle, Id_list=py__export_geometry_to_3dm_files.id_list)  # inputs Apply: list, Id_list: list
#   port Apply: [required] - type = string] - []default = ""]
# ---------- py__remove_used_wood_from_db: Python ----------
""" Deletes used wood from SQL database.
    Inputs:
        _Apply: boolean toggle to start data the sciprt
        _Id_list: List with id numbers of the wood that needs to be deleted
    Output:
        output: conformation when data is removed. 

"""


def delete_id(id_number): 
    #deletes existing data in database  
    cur.execute("DELETE FROM wood_dimensions WHERE wood_id = (%s)", (id_number,));
    conn.commit()
    print(str(id_number) + ' removed')

import psycopg2 as pg2
import random

if _Apply == True:
    conn = pg2.connect(database='hout', user='postgres', password='baksteen')
    cur = conn.cursor()
    for id_number in _Id_list:
        delete_id(id_number)
# ---------- end py__remove_used_wood_from_db ----------

panel_22 = Panel("""Reusable (%)
Not reusable (%)""")
panel_23 = Panel("""0
1""")
chart = CreateChart(Data=panel_23, Names=panel_22, ChartType=0)
chartappearance = ChartAppearance(ChartToModify=chart, Colors=[ColourSwatch(SwatchColor=RGB(93, 176, 170)), ColourSwatch(SwatchColor=RGB(102, 204, 197))])
setchart = SetChartContents(
    ChartToModify=chart,
    NewChartValues=[py_calculations.end_of_life_per, py_calculations.end_of_life_waste],
    Title="End of life",
    SubTitle=panel_9)

panel_24 = Panel("""Infill waste (m)
Substructure waste (m)
Cladding waste (m)""")
panel_25 = Panel(py_calculations.total_waste)
panel_26 = Panel("""0
1
2""")
chart_2 = CreateChart(Data=panel_26, Names=panel_24, ChartType=0)
chartappearance_2 = ChartAppearance(
    ChartToModify=chart_2,
    Colors=[ColourSwatch(SwatchColor=RGB(163, 201, 189)), ColourSwatch(SwatchColor=RGB(121, 173, 157)), ColourSwatch(SwatchColor=RGB(127, 161, 150))])
setchart_2 = SetChartContents(
    ChartToModify=chart_2,
    NewChartValues=[py__structural_infill_substructure.total_waste_infill, py__structural_infill_substructure.total_waste_substructure, py__cladding.total_cladding_waste],
    NewChartNames=panel_24,
    Title=panel_25)

panel_27 = Panel("""Infill used (m)
Substructure used (m)
Cladding used (m)""")
panel_28 = Panel(py_calculations.total_wood_used)
panel_29 = Panel("""0
1
2""")
chart_3 = CreateChart(Data=panel_29, Names=panel_27, ChartType=0)
chartappearance_3 = ChartAppearance(
    ChartToModify=chart_3,
    Colors=[ColourSwatch(SwatchColor=RGB(227, 168, 168)), ColourSwatch(SwatchColor=RGB(196, 33, 33)), ColourSwatch(SwatchColor=RGB(245, 27, 27))])
setchart_3 = SetChartContents(
    ChartToModify=chart_3,
    NewChartValues=[py__structural_infill_substructure.total_infill_used_2, py__structural_infill_substructure.total_substructure_used_2, py__cladding.total_cladding_used],
    Title=panel_28)

# ---- group: calculations
panel_30 = Panel("Placeholder")
label_2 = CreateLabel(LabelText=panel_30, LabelSize=18, Justification=0)
label_3 = CreateLabel(LabelText=panel_30, LabelSize=18, Justification=0)
label_4 = CreateLabel(LabelText=panel_30, LabelSize=18, Justification=0)
merge_5 = Merge(
    Data1=panel_19,
    Data2=panel_20,
    Data3=panel_12,
    Data4=panel_11,
    Data5=panel_10,
    Data6=panel_15,
    Data7=panel_13,
    Data8=panel_14,
    Data9=panel_18,
    Data10=panel_16,
    Data11=panel_17)  # -> flatten(Result)
label_5 = CreateLabel(LabelText=panel_30, LabelSize=18, Justification=0)
label_6 = CreateLabel(LabelText=panel_30, LabelSize=18, Justification=0)
label_7 = CreateLabel(LabelText=panel_30, LabelSize=18, Justification=0)
label_8 = CreateLabel(LabelText=panel_30, LabelSize=18, Justification=0)
label_9 = CreateLabel(LabelText=panel_30, LabelSize=18, Justification=0)
label_10 = CreateLabel(LabelText=panel_30, LabelSize=18, Justification=0)
separator_2 = CreateSeparator(Thickness=number_slider, Horizontal=True, Color=RGB(0, 0, 0))
separator_3 = CreateSeparator(Thickness=number_slider, Horizontal=True, Color=RGB(0, 0, 0))

# ----
label_11 = CreateLabel(LabelText=panel_30, LabelSize=18, Justification=0)
label_12 = CreateLabel(LabelText=panel_30, LabelSize=18, Justification=0)

# ---- group: calculations (continued)
setlabel = SetLabelContents(
    LabelToModify=[label_2, label_4, label_3, label_6, label_7, label_5, label_8, label_10, label_9, label_12, label_11],
    NewLabelContents=merge_5)
merge_6 = Merge(
    Data1=chart_3,
    Data2=chart_2,
    Data3=chart,
    Data4=label_2,
    Data5=label_4,
    Data6=separator,
    Data7=label_3,
    Data8=label_6,
    Data9=label_7,
    Data10=separator_2,
    Data11=label_5,
    Data12=label_8,
    Data13=label_10,
    Data14=separator_3,
    Data15=label_9,
    Data16=label_12,
    Data17=label_11)
expander_3 = CreateExpander(UIElements=merge_6, Header="CALCULATIONS", Open=False)

# ----
merge_7 = Merge(Data1=merge_3, Data2=expander_3, Data3=expander, Data4=expander_2)
launchwin = LaunchWindow(
    Show=human_ui_interface,
    Name="Exterior wall element tool",
    Width=370,
    Height=400,
    ChildStatus=0,
    EnableHorizScroll=False)
addelems = AddElements(Window=launchwin, Elements=flatten(merge_7), DoVLChecking=True)  # -> AddedElements, ElementNames
