# Grasshopper definition Prototype_Playground.gh (Grasshopper 1.0.7)
# plug-ins: GH_CPython

toggle = BooleanToggle(True)

reset = BooleanToggle(False)
python = PythonScript(x=Toggle(False), Reset=reset, Delay=Slider(371, range=0..2000))  # -> Boolean; inputs Reset: Boolean
# ---------- python: Python ----------
import time
import Grasshopper as gh

def updateComponent(interval):
    
    """ Updates this component, similar to using a grasshopper timer """
    
    # Define callback action
    def callBack(e):
        ghenv.Component.ExpireSolution(False)
        
    # Get grasshopper document
    ghDoc = ghenv.Component.OnPingDocument()
    
    # Schedule this component to expire
    ghDoc.ScheduleSolution(interval,gh.Kernel.GH_Document.GH_ScheduleDelegate(callBack))

if x: 
    # Instantiate/reset persistent boolean 
    if "pb" not in globals() or Reset:
        pb = True
    
    # Flip persistent boolean 
    pb = not pb
    
    # Update component
    updateComponent(Delay)
    
    # Output boolean
    Boolean = pb
# ---------- end python ----------
panel = Panel(toggle)

# ----
# CLASSES
classes = GhPythonScript()  # -> out, a
# ---------- classes: Python ----------
print('import succes') 

class wood_structural():
    def __init__(self, length, width, depth, db_id):
        self.length = length
        self.width = width
        self.depth = depth
        self.id = db_id
        
    def print_data(self):
        print(self.length, self.width, self.depth, self.id)


class wood_substructure(wood_structural):
    pass


class wood_cladding():
    def __init__(self, length, height, depth, db_id):
        self.length = length
        self.height = height
        self.depth = depth
        self.id = db_id


class coordinates_segments():
    def __init__(self, x_cor_start, z_cor_start, x_cor_end, z_cor_end):
        self.x_cor_start = x_cor_start
        self.z_cor_start = z_cor_start
        self.x_cor_end = x_cor_end
        self.z_cor_end = z_cor_end
        
    def print_cor(self):
        print(self.x_cor_start, self.z_cor_start, self.x_cor_end, self.z_cor_end)


class coordinates_segments_cladding(coordinates_segments):
    pass
# ---------- end classes ----------

# ----
# DB SUBSTRUCTURE
reset_database = BooleanToggle(False)
min_depth_mm = Panel("50")
max_depth_mm = Panel("90")
database_amount = Panel("250")
min_length_mm = Panel("10")
max_length_mm = Panel("4000")
min_width_mm = Panel("30")
max_width_mm = Panel("60")
int = Integer(database_amount)
int_2 = Integer(max_length_mm)
int_3 = Integer(max_depth_mm)
int_4 = Integer(min_length_mm)
int_5 = Integer(min_width_mm)
int_6 = Integer(max_width_mm)
int_7 = Integer(min_depth_mm)

# ----
# DB CLADDING
reset_database_2 = BooleanToggle(True)
database_amount_2 = Panel("200")
min_length_mm_2 = Panel("10")
max_length_mm_2 = Panel("4000")
min_height_mm = Panel("100")
max_height_mm = Panel("250")
min_depth_mm_2 = Panel("10")
max_depth_mm_2 = Panel("30")
int_8 = Integer(database_amount_2)
int_9 = Integer(max_length_mm_2)
int_10 = Integer(min_length_mm_2)
int_11 = Integer(min_height_mm)
int_12 = Integer(max_height_mm)
int_13 = Integer(min_depth_mm_2)
int_14 = Integer(max_depth_mm_2)

# ----
# DATABASE INPUT
# DATABASE INFILL
reset_database_3 = BooleanToggle(True)
database_amount_3 = Panel("200")
min_length_mm_3 = Panel("10")
max_length_mm_3 = Panel("4000")
min_witdh_mm = Panel("60")
max_width_mm_2 = Panel("90")
min_depth_mm_3 = Panel("160")
max_depth_mm_3 = Panel("200")
int_15 = Integer(database_amount_3)
int_16 = Integer(min_length_mm_3)
int_17 = Integer(max_length_mm_3)
int_18 = Integer(min_witdh_mm)
int_19 = Integer(max_width_mm_2)
int_20 = Integer(max_depth_mm_3)
int_21 = Integer(min_depth_mm_3)

# ---- group: DATABASE SUB STRUCTURE
db_substructure = GhPythonScript(
    x=toggle,
    database_amount=int,
    min_length=int_4,
    max_length=int_2,
    min_width=int_5,
    max_width=int_6,
    min_depth=int_7,
    max_depth=int_3)  # -> out, database_substructure
# ---------- db_substructure: Python ----------
import random
from classes_wood import * 
import operator

if x: 
    database_substructure = []
    id = 1
    
    for i in range(0,database_amount):
        length = random.randrange(min_length, max_length+1 ,10)
        width = random.randrange(min_width, max_width+1 ,10)
        depth = random.randrange(min_depth, max_depth+1 ,10)
        piece_of_wood = wood_substructure(length, width, depth, id)
        database_substructure.append(piece_of_wood)
        id += 1
        
    database_substructure.sort(key = operator.attrgetter('length'))
    database_substructure.sort(key = operator.attrgetter('depth'))
# ---------- end db_substructure ----------
panel_2 = Panel(db_substructure.database_substructure)

# ---- group: DATABASE CLADDING
db_cladding = GhPythonScript(
    x=toggle,
    database_amount=int_8,
    min_length=int_10,
    max_length=int_9,
    min_height=int_11,
    max_height=int_12,
    min_depth=int_13,
    max_depth=int_14)  # -> out, database_cladding
# ---------- db_cladding: Python ----------
from classes_wood import * 
import operator
import random 

if x:
    database_cladding = []
    id = 1
    
    for i in range(0,database_amount):
        length = random.randrange(min_length, max_length+1, 10)
        height = random.randrange(min_height, max_height+1, 10)
        depth = random.randrange(min_depth, max_depth+1, 1)
        piece_of_cladding = wood_cladding(length, height, depth, id)
        database_cladding.append(piece_of_cladding)
        id += 1
    
    database_cladding.sort(key = operator.attrgetter('length'))
    database_cladding.sort(key = operator.attrgetter('height'), reverse = True)
# ---------- end db_cladding ----------
panel_3 = Panel(db_cladding.database_cladding)

# ---- group: DATABASE STRUCTURAL
db_structural_infill = GhPythonScript(
    x=toggle,
    database_amount=int_15,
    min_length=int_16,
    max_length=int_17,
    min_width=int_18,
    max_width=int_19,
    min_depth=int_21,
    max_depth=int_20)  # -> out, structural_database
# ---------- db_structural_infill: Python ----------
import ctypes.wintypes
import sys

CSIDL_PERSONAL = 5       # My Documents
SHGFP_TYPE_CURRENT = 0   # Get current, not default value
buf = ctypes.create_unicode_buffer(ctypes.wintypes.MAX_PATH)
ctypes.windll.shell32.SHGetFolderPathW(None, CSIDL_PERSONAL, None, SHGFP_TYPE_CURRENT, buf)

install_path = buf.value + "\Exterior wall element tool\wood_classes"
sys.path.append(install_path)

from classes_wood import * 
import random
import operator


if x: 
    structural_database = []
    id = 1 
    
    for i in range(0,database_amount):
        length = random.randrange(min_length, max_length+1, 10)
        width = random.randrange(min_width,max_width+1, 10)
        depth = random.randrange(min_depth,max_depth+1, 10)
        piece_of_wood =wood_structural(length, width, depth, id)
        structural_database.append(piece_of_wood)
        id += 1 
    
    
    structural_database.sort(key = operator.attrgetter('length'))
# ---------- end db_structural_infill ----------
panel_4 = Panel(db_structural_infill.structural_database)

# ----
height = Slider(2500, range=0..10000)
width = Slider(3000, range=0..10000)
centre_to_centre_distance = Panel("600")
substructure_min_length = Panel("300")
max_depth_substructure_mm = Panel("200")
int_22 = Integer(centre_to_centre_distance)
int_23 = Integer(substructure_min_length)
int_24 = Integer(max_depth_substructure_mm)

# ----
# SEGMENT CALCULATION
segments_coordinates = GhPythonScript(width_wall=width, height_wall=height, database_infill=db_structural_infill.structural_database, ctc_distance=int_22)  # -> out, rectangles, segments, cladding_segments; inputs database_infill: list
# ---------- segments_coordinates: Python ----------
import Rhino.Geometry as rg
import math
from classes_wood import * 

rectangles = [] 
segments = []
pt0 = rg.Point3d(0, 0, 0)
height_point = rg.Point3d(0, 1, 0)
zaxis = height_point-pt0
plane = rg.Plane(pt0, zaxis)

width_segments = [] 
cladding_segments = [] 

#er moet nog wel rekening mee gehouden dat de database kleiner word!!!!
def number_segments(x_start, z_start, x_end, z_end): 
    width_element = x_end - x_start
    height_element = z_end - z_start
    max_width = int((database_infill[-1].length**2 - height_element**2)**0.5)

    while max_width < width_element:
        segment_width = math.floor(max_width / ctc_distance) * ctc_distance 
        width_element -= segment_width
        segment = coordinates_segments(x_start, z_start, x_start + segment_width, z_end)
        segments.append(segment)
        x_start = x_start + segment_width
        
    if max_width > width_element:
        segment = coordinates_segments(x_start, z_start, x_end, z_end)
        segments.append(segment)

def rectangle_wall(width_wall, height_wall):
    pt0 = rg.Point3d(0, 0, 0)
    pt1 = rg.Point3d(width_wall, 0, height_wall)
    rectangle = rg.Rectangle3d(plane,pt0, pt1)
    rectangles.append(rectangle) 


def rectangle_door(start_door, width_door, height_door):
    pt0 = rg.Point3d(start_door, 0, 0)
    pt1 = rg.Point3d(start_door + width_door, 0, height_door)
    rectangle = rg.Rectangle3d(plane,pt0, pt1)
    rectangles.append(rectangle) 


def rectangle_window(start_x_window, start_z_window, width_window, height_window): 
    pt0 = rg.Point3d(start_x_window, 0, start_z_window)
    pt1 = rg.Point3d(start_x_window + width_window, 0, start_z_window + height_window)
    rectangle = rg.Rectangle3d(plane,pt0, pt1)
    rectangles.append(rectangle) 


rectangle_wall(width_wall, height_wall) 
number_segments(0, 0, width_wall, height_wall)
cladding_segments.append(coordinates_segments_cladding(0, 0, width_wall, height_wall))
# ---------- end segments_coordinates ----------

# ----
# STRUCTURAL INFILL & SUBSTRUCTURE
structural_infill_substructure = GhPythonScript(
    generate=toggle,
    segments=segments_coordinates.segments,
    ctc_distance=int_22,
    min_length_substructure_piece=int_23,
    waste_wood_database=db_structural_infill.structural_database,
    database_substructure=db_substructure.database_substructure,
    max_depth_structural_infill=int_24)  # -> out, total_infill_used, total_waste_infill, total_infill_required, total_substructure_used, total_waste_substructure, total_substructure_required; inputs segments: list, waste_wood_database: list, database_substructure: list
# ---------- structural_infill_substructure: Python ----------
import rhinoscriptsyntax as rs
import Rhino.Geometry as rg
import random
import math
import operator
import itertools


def outer_frame_vertical(required_length, waste_wood_database, position):
    #pick piece of wood from database for vertical outer frame (left & right) 
    chosen_beam = next(beam for beam in waste_wood_database if beam.length >= required_length)
    
    #determine additional waste with picked piece of wood
    waste = chosen_beam.length - required_length
    waste_wood_database.remove(chosen_beam)
    structural_infill_waste.append(waste)
    beams_selected_framing_ver.append(chosen_beam)
    beams_selected_framing.append(chosen_beam)
    structural_infill_used.append(chosen_beam.length)
    
    if position == 0: #0 = outerleft vertical 
        pt0 = rg.Point3d(seg_ver.x_cor_start,0, seg_ver.z_cor_start)
        pt1 = rg.Point3d(seg_ver.x_cor_start + chosen_beam.width, chosen_beam.depth, seg_ver.z_cor_end)
        x_start = seg_ver.x_cor_start
        z_start = seg_ver.z_cor_start 
        z_end = seg_ver.z_cor_end
        
    if position == 1: #1 = outerright vertical
        pt0 = rg.Point3d(seg_ver.x_cor_end -chosen_beam.width, 0, seg_ver.z_cor_start)
        pt1 = rg.Point3d(seg_ver.x_cor_end, chosen_beam.depth, seg_ver.z_cor_end)
        x_start = seg_ver.x_cor_end -chosen_beam.width
        z_start = seg_ver.z_cor_start
        z_end = seg_ver.z_cor_end
        
    # generate geometry in grasshopper
    box = rg.BoundingBox(pt0, pt1)
    brep = box.ToBrep()
    geometry_infill_vertical.append(brep)
    
    #generate substructure for stud
    select_substructure (chosen_beam, required_length, database_substructure, x_start, z_start, z_end)
    
    
def outer_frame_horizontal(required_length, waste_wood_database, position):
    #pick piece of wood from database for horizontal outerframe (top & bottom) 
    chosen_beam = next(beam for beam in waste_wood_database if beam.length >= required_length)
    
    #determine additional waste with picked piece of wood
    waste = chosen_beam.length - required_length
    waste_wood_database.remove(chosen_beam)
    structural_infill_waste.append(waste)
    beams_selected_framing_hor.append(chosen_beam)
    beams_selected_framing.append(chosen_beam)
    structural_infill_used.append(chosen_beam.length)
    
    if position == 0: #0 = bottom horizontal 
        pt0 = rg.Point3d(seg_ver.x_cor_start, 0, seg_ver.z_cor_start)
        pt1 = rg.Point3d(seg_ver.x_cor_end, chosen_beam.width, seg_ver.z_cor_start + chosen_beam.depth)
        
    if position == 1: #1 = top horizontal 
        pt0 = rg.Point3d(seg_ver.x_cor_start, 0, seg_ver.z_cor_end -chosen_beam.depth)
        pt1 = rg.Point3d(seg_ver.x_cor_end, chosen_beam.width, seg_ver.z_cor_end)
        
    # generate geometry in grasshopper
    box = rg.BoundingBox(pt0, pt1)
    brep = box.ToBrep()
    geometry_infill_horizontal.append(brep)


def bracing (height_segment, width_segment, beams_selected_bracing, waste_wood_database):
    #determine dimensions right triangle for pythagoras calculation
    bracing_width = width_segment - beams_selected_framing[0+fr_counter].width - beams_selected_framing[1+fr_counter].width  
    bracing_height = height_segment - beams_selected_framing[2+fr_counter].depth - beams_selected_framing[3+fr_counter].depth  
    bracing_length = round((bracing_width**2 + bracing_height**2)**0.5)
    
    #pick piece of waste wood from database for bracing
    chosen_beam = next(beam for beam in waste_wood_database if beam.length >= bracing_length)
    waste = chosen_beam.length - bracing_length
    waste_wood_database.remove(chosen_beam)
    structural_infill_waste.append(waste)
    beams_selected_bracing.append(chosen_beam)
    structural_infill_used.append(chosen_beam.length)
    
    #create line to allow for geometry generation in grasshopper 
    start_bracing = ([beams_selected_framing[0+fr_counter].width + seg_ver.x_cor_start, 0,seg_ver.z_cor_end-beams_selected_framing[3+fr_counter].depth])  
    end_bracing = ([seg_ver.x_cor_end-beams_selected_framing[1+fr_counter].width, 0, seg_ver.z_cor_start + beams_selected_framing[2+fr_counter].depth]) 
    line_bracing = rs.AddLine(start_bracing,end_bracing)
    lines_bracing.append(line_bracing) 
    
    #calculation 
    tan = bracing_width / bracing_height
    y = math.degrees(math.atan(tan))
    corner = 90 - y 
    extra_x = math.sin(math.radians(corner)) * (0.5 * chosen_beam.depth)
    extra_z = math.cos(math.radians(corner)) * (0.5 * chosen_beam.depth)
    
    pt1 = rg.Point3d(beams_selected_framing[0+fr_counter].width + seg_ver.x_cor_start - extra_x , 0, seg_ver.z_cor_end-beams_selected_framing[3+fr_counter].depth - extra_z)
    pt2 = rg.Point3d(seg_ver.x_cor_end-beams_selected_framing[1+fr_counter].width - extra_x , 0, seg_ver.z_cor_start + beams_selected_framing[2+fr_counter].depth - extra_z)
    
    box_1 = rg.Point3d(0,0,0)
    box_2 = rg.Point3d(beams_selected_framing[0+fr_counter].depth, -beams_selected_framing[0+fr_counter].width, bracing_length)  
    
    zaxis = pt2-pt1
    plane = rg.Plane(pt1, zaxis)
    box = rg.BoundingBox(box_1,box_2)
    bracing_geo = rg.Box(plane, box) 
    geometry_infill_bracing.append(bracing_geo)


def intersection_formula (x_position, height_segment):
    #determine the formula of the bracing so the length of the bottom and top stud can be termined on every position along the slope
    a = (height_segment - beams_selected_framing[2+fr_counter].depth - beams_selected_framing[3+fr_counter].depth) / (width_segment- beams_selected_framing[0+fr_counter].width - beams_selected_framing[1+fr_counter].width)
    b = height_segment - beams_selected_framing[2+fr_counter].depth - beams_selected_framing[3+fr_counter].depth
    y = -a * x_position + b 
    length_bottom_stud = round(y + beams_selected_framing[2+fr_counter].depth) 
    return length_bottom_stud
    
    
def select_studs (chosen_bottom_stud, bottom_stud_length, chosen_top_stud, top_stud_length, waste_wood_database, stud_position):
    #determine waste bottom stud & remove bottom studs from database
    waste = chosen_bottom_stud.length - bottom_stud_length
    waste_wood_database.remove(chosen_bottom_stud)
    structural_infill_waste.append(waste)
    beams_selected_studs.append(chosen_bottom_stud)
    structural_infill_used.append(chosen_bottom_stud.length)
    
    #generate bottom stud geometry
    pt0 = rg.Point3d(seg_ver.x_cor_start + stud_position, 0, seg_ver.z_cor_start)  
    pt1 = rg.Point3d(seg_ver.x_cor_start + stud_position + chosen_bottom_stud.width, chosen_bottom_stud.depth, seg_ver.z_cor_start + bottom_stud_length)
    x_start = seg_ver.x_cor_start + stud_position
    z_start = seg_ver.z_cor_start 
    z_end = seg_ver.z_cor_start + bottom_stud_length
    box = rg.BoundingBox(pt0, pt1)
    brep = box.ToBrep()
    geometry_infill_studs.append(brep)
    select_substructure (chosen_bottom_stud, bottom_stud_length, database_substructure, x_start, z_start, z_end)
    
    #determine waste top stud & remove top studs from database
    waste = chosen_top_stud.length - top_stud_length
    waste_wood_database.remove(chosen_top_stud)
    structural_infill_waste.append(waste)
    beams_selected_studs.append(chosen_top_stud)
    structural_infill_used.append(chosen_top_stud.length)
    
    #generate top stud geometry
    center_align = (chosen_bottom_stud.width - chosen_top_stud.width) / 2
    pt0 = rg.Point3d(seg_ver.x_cor_start + stud_position + center_align, 0, seg_ver.z_cor_start + bottom_stud_length)
    pt1 = rg.Point3d(seg_ver.x_cor_start + stud_position + center_align + chosen_top_stud.width, chosen_top_stud.depth, seg_ver.z_cor_end)
    x_start = seg_ver.x_cor_start + stud_position + center_align
    z_start = seg_ver.z_cor_start + bottom_stud_length 
    z_end = seg_ver.z_cor_end
    box = rg.BoundingBox(pt0, pt1)
    brep = box.ToBrep()
    geometry_infill_studs.append(brep)
    
    #generate substructure for stud
    select_substructure (chosen_top_stud, top_stud_length, database_substructure, x_start, z_start, z_end)


def select_substructure (beam_infill, required_length, database_substructure, x_start, z_start, z_end):
    beam_pair = [] 
    
    #determine required depth for the substructure piece so that the complete substructre is alligned
    depth_required = int(max_depth_structural_infill) + 50 - beam_infill.depth
    length_required = required_length
    
    #picks the option to complete the substructure with 1 piece
    suitable_beams = iter([beam_sub for beam_sub in database_substructure if beam_sub.depth == depth_required and beam_sub.length >= length_required])
    chosen_beam = next(suitable_beams)

    #temp list with all the possible pieces that are longer then min required length and smaller then the required length.
    beams_selected_temp = [beam.length for beam in database_substructure if 
    beam.length >= min_length_substructure_piece and beam.length < length_required and beam.depth == depth_required]

    #looks for all the options where the total length of two pieces is smaller then thet total length of 1 piece. 
    #BUGG KAN ONTSTAAN DAT ER GEEN CHOSEN BEAM IS, BELANGRIJK OM REKENING MEE TE HOUDEN
    for numbers in itertools.combinations(beams_selected_temp,2):
        if sum(numbers) >= length_required and sum(numbers) < chosen_beam.length:
            beam_pair.append(numbers)
            
    #if there is no combination of two pieces, the single piece is picked
    if beam_pair == []: 
        beams_selected_substructure.append(chosen_beam)
        database_substructure.remove(chosen_beam)
        waste = chosen_beam.length - length_required
        substructure_waste.append(waste)
        
        pt0 = rg.Point3d(x_start, beam_infill.depth, z_start)
        pt1 = rg.Point3d(x_start+chosen_beam.width, beam_infill.depth+chosen_beam.depth, z_end)
        box = rg.BoundingBox(pt0, pt1)
        brep = box.ToBrep()
        geometry_substructure.append(brep)

    #otherwise the combination that generates the least waste is selected
    else:
        beam_pair.sort(key=sum)
        beam_pair_1 = next(beam for beam in database_substructure if beam.length == beam_pair[0][0] and beam.depth == depth_required)
        beams_selected_substructure.append(beam_pair_1)
        database_substructure.remove(beam_pair_1)
        
        beam_pair_2 = next(beam for beam in database_substructure if beam.length == beam_pair[0][1] and beam.depth == depth_required)
        beams_selected_substructure.append(beam_pair_2)
        database_substructure.remove(beam_pair_2)
        
        pt0 = rg.Point3d(x_start, beam_infill.depth, z_start)
        pt1 = rg.Point3d(x_start + beam_pair_1.width, beam_infill.depth+beam_pair_1.depth, z_start + beam_pair_1.length)
        box = rg.BoundingBox(pt0, pt1)
        brep = box.ToBrep()
        geometry_substructure.append(brep)
        
        pt0 = rg.Point3d(x_start, beam_infill.depth, z_start + beam_pair_1.length)
        pt1 = rg.Point3d(x_start +beam_pair_2.width, beam_infill.depth+beam_pair_2.depth, z_end)
        box = rg.BoundingBox(pt0, pt1)
        brep = box.ToBrep()
        geometry_substructure.append(brep)
        
        waste = sum(beam_pair[0]) - length_required
        substructure_waste.append(waste)
        
    beam_pair = []


structural_infill_waste = []
substructure_waste = []
structural_infill_used = [] 

beams_selected_bracing = [] 
beams_selected_framing_hor = [] 
beams_selected_framing_ver = [] 
beams_selected_framing = []
beams_selected_studs = []

beams_selected_substructure = []  

geometry_infill_horizontal = [] 
geometry_infill_vertical = [] 
geometry_infill_studs = [] 
geometry_infill_bracing = [] 
geometry_substructure = []

total_list = [] 

lines_bracing = []

fr_counter = 0 
br_counter = 0 

if generate: 
    for seg_ver in segments: 
        width_segment = seg_ver.x_cor_end - seg_ver.x_cor_start
        height_segment = seg_ver.z_cor_end - seg_ver.z_cor_start
        
        outer_frame_vertical(height_segment, waste_wood_database, 0)
        outer_frame_vertical(height_segment, waste_wood_database, 1)
        outer_frame_horizontal(width_segment, waste_wood_database, 0)
        outer_frame_horizontal(width_segment, waste_wood_database, 1) 
        bracing(height_segment, width_segment, beams_selected_bracing, waste_wood_database)
    
        stud_position = ctc_distance
        
        while stud_position < width_segment:
            #determine required length for bottom & top stud
            bottom_stud_length = intersection_formula (stud_position, height_segment)
            top_stud_length = height_segment - bottom_stud_length 
            margin = 0 
            controle = False
            
            while controle == False:
                suitable_bottom_studs = iter([beam for beam in waste_wood_database if beam.length >= bottom_stud_length + margin])
                chosen_bottom_stud = next(suitable_bottom_studs) 
                
                #restrictions top studs based on bottom stud, top stud cannot be wider or deeper then bottom stud
                suitable_top_studs = iter([beam for beam in waste_wood_database if beam.length >= top_stud_length 
                #and beam.width <= chosen_bottom_stud.width
                and beam.depth == chosen_bottom_stud.depth 
                and beam.length < top_stud_length + 150
                and beam.id != chosen_bottom_stud.id
                ])
                
                chosen_top_stud = next(suitable_top_studs, 0)
                
                #if no top stud is suitable, a different bottom stud is selected
                if chosen_top_stud == 0:
                    margin +=1
    
                else: 
                    controle = True
                    select_studs (chosen_bottom_stud, bottom_stud_length, chosen_top_stud, top_stud_length, waste_wood_database, stud_position)
                    stud_position = stud_position + ctc_distance
    
        fr_counter += 4 
        br_counter += 1 
    
    #calculate the total waste of the structural infill + substructure
    total_waste = sum(structural_infill_waste) + sum(substructure_waste) 
    
    total_infill = beams_selected_bracing + beams_selected_framing + beams_selected_studs
    total_infill_used = sum(structural_infill_used)/1000
    total_waste_infill = sum(structural_infill_waste)/1000
    total_infill_required =  (sum(structural_infill_used)/1000)-(sum(structural_infill_waste)/1000)
    
    substructure_used = [wood.length for wood in beams_selected_substructure]
    total_substructure_used = sum(substructure_used)/1000
    total_waste_substructure = sum(substructure_waste)/1000
    total_substructure_required =  (sum(substructure_used)/1000)-(sum(substructure_waste)/1000)
    
    total_list = [total_infill_used, total_waste_infill, total_infill_required, total_substructure_used, total_waste_substructure, total_substructure_required] 
    
    
    #total_infill = beams_selected_bracing + beams_selected_framing + beams_selected_studs
    #total_infill_used = 'strucutral infill used: '+ str(sum(structural_infill_used)/1000) + 'm'
    #total_waste_infill = 'strucutral infill waste: '+ str(sum(structural_infill_waste)/1000) + 'm'
    #total_infill_required =  'structural infill required: ' + str((sum(structural_infill_used)/1000)-(sum(structural_infill_waste)/1000)) + 'm'
    
   # substructure_used = [wood.length for wood in beams_selected_substructure]
    #total_substructure_used = 'substructure used: '+ str(sum(substructure_used)/1000) + 'm'
    #total_waste_substructure = 'substructure waste: '+ str(sum(substructure_waste)/1000) + 'm'
    #total_substructure_required =  'substructure required: ' + str((sum(substructure_used)/1000)-(sum(substructure_waste)/1000)) + 'm'
    
    
    #check to see if no piece of wood was selected twice from the database
    print('\n') 
    print('structural_infill') 
    total_infill.sort(key = operator.attrgetter('id'))
    for balk in total_infill:
        balk.print_data()
    
    #check to see if no piece of wood was selected twice from the database
    print('\n') 
    print('substructure') 
    beams_selected_substructure.sort(key = operator.attrgetter('id'))
    for balk in beams_selected_substructure:
        balk.print_data()
# ---------- end structural_infill_substructure ----------

# ----
# CLADDING
cladding = GhPythonScript(
    generate=toggle,
    database_cladding=db_cladding.database_cladding,
    ctc_distance=int_22,
    cladding_segments=segments_coordinates.cladding_segments)  # -> out, total_cladding_used, total_cladding_waste, total_cladding_required; inputs database_cladding: list, cladding_segments: list
# ---------- cladding: Python ----------
import Rhino.Geometry as rg
import itertools
import math


def cladding_geometry (required_length, current_height, piece_height, x_start, x_end, z_start, z_end, height_segment):
    picked_cladding = next(clad for clad in database_cladding if clad.height == piece_height and clad.length == required_length)
    wood_selected_cladding.append(picked_cladding) 
    database_cladding.remove(picked_cladding) 

    pt0 = rg.Point3d(x_start, 250, z_start + current_height)
    pt1 = rg.Point3d(x_end, 250 + picked_cladding.depth, z_start + current_height + piece_height)
    if current_height + piece_height > height_segment:
        pt1 = rg.Point3d(x_end, 250 + picked_cladding.depth, z_end)
    box = rg.BoundingBox(pt0, pt1)
    brep = box.ToBrep()
    geometry_cladding.append(brep)


cladding_waste = [] 
geometry_cladding = []
wood_selected_cladding = []  

if generate: 
    for segment in cladding_segments: 
        height_segment = segment.z_cor_end - segment.z_cor_start
        width_segment = segment.x_cor_end - segment.x_cor_start
        x_start = segment.x_cor_start
        
        cladding_selected_temp = []  
        current_height = 0 
        marge = 0 
        
        #calculate the max allowed cladding pieces in x-direction
        max_number_pieces = int(math.floor(width_segment / (ctc_distance*2)))
        
        #marge prevents the happening of infinite while loop
        while marge < 1000:
            if current_height > height_segment:
                break
        
            #start finding cladding with the highest height cladding 
            piece_height = database_cladding[0].height
            
            #continue until it is tried with the lowest height cladding 
            while piece_height >= database_cladding[-1].height:
                #generate list with all the cladding with the same height
                cladding_same_height = [clad.length for clad in database_cladding if clad.height == piece_height and clad.length >= 2*ctc_distance]
                
                if current_height >= height_segment:
                    break
        
                #see if the total width of the wall can be covered with one piece of cladding
                for clad_len in cladding_same_height[:]:
                     if clad_len >= width_segment and clad_len <= width_segment + marge:
                        cladding_same_height.remove(clad_len)
                        waste = clad_len - width_segment
                        cladding_waste.append(waste)
                        #(required_length, current_height, piece_height, x_start, x_end, z_start)
                        cladding_geometry (clad_len, current_height, piece_height, segment.x_cor_start, segment.x_cor_end, segment.z_cor_start, segment.z_cor_end, height_segment)
                        current_height += piece_height
                        
                if current_height >= height_segment:
                            break
                
                #see if the width of the wall can be covered with n pieces of cladding, to a maximum of calculated max_number_pieces
                for x_pieces in range(2,max_number_pieces+1):
                    for numbers in itertools.combinations(cladding_same_height,x_pieces):
                        x_start = segment.x_cor_start 
                        if current_height >= height_segment:
                            break
                        if sum(numbers) >= width_segment and sum(numbers) <= width_segment + marge: #and numbers[0] in cladding_same_height and numbers[1] in cladding_same_height: ## hier is nog geen rekening gheouden met meer checks
                            check =  all(elem in cladding_same_height for elem in numbers)
                            if check:
                                for counter in range(0,x_pieces):
                                    if counter == x_pieces - 1:
                                        cladding_geometry (numbers[counter], current_height, piece_height, x_start, segment.x_cor_end, segment.z_cor_start, segment.z_cor_end, height_segment)
                                    else:
                                        cladding_geometry (numbers[counter], current_height, piece_height, x_start, x_start + numbers[counter], segment.z_cor_start, segment.z_cor_end, height_segment)
                                    x_start += numbers[counter]
                                    cladding_same_height.remove(numbers[counter])
                                
                                waste = sum(numbers) - width_segment
                                cladding_waste.append(waste)
                                current_height += piece_height
                
                piece_height -= 10 
            marge += 10
        
        #calculate the amount of waste 
        cladding_used = [length.length for length in wood_selected_cladding]
        total_cladding_used = sum(cladding_used)/1000
        total_cladding_waste = sum(cladding_waste)/1000
        total_cladding_required = (sum(cladding_used)/1000)-(sum(cladding_waste)/1000)

        #total_cladding_used = 'total cladding used: ' + str(sum(cladding_used)/1000) + 'm'
        #total_cladding_waste = 'total cladding waste: ' + str(sum(cladding_waste)/1000) + 'm'
        #total_cladding_required = 'total cladding required: ' + str((sum(cladding_used)/1000)-(sum(cladding_waste)/1000)) + 'm'
# ---------- end cladding ----------

# ----
# STRUCTURAL INFILL & SUBSTRUCTURE
structural_infill_substructure_2 = GhPythonScript(
    generate=toggle,
    segments=segments_coordinates.segments,
    ctc_distance=int_22,
    min_length_substructure_piece=int_23,
    waste_wood_database=db_structural_infill.structural_database,
    database_substructure=db_substructure.database_substructure,
    max_depth_structural_infill=int_24)  # -> out, total_infill_used, total_waste_infill, total_infill_required, total_substructure_used, total_waste_substructure, total_substructure_required; inputs segments: list, waste_wood_database: list, database_substructure: list
# ---------- structural_infill_substructure_2: Python ----------
import rhinoscriptsyntax as rs
import Rhino.Geometry as rg
import random
import math
import operator
import itertools


def outer_frame_vertical(required_length, waste_wood_database, position):
    #pick piece of wood from database for vertical outer frame (left & right) 
    chosen_beam = next(beam for beam in waste_wood_database if beam.length >= required_length)
    
    #determine additional waste with picked piece of wood
    waste = chosen_beam.length - required_length
    waste_wood_database.remove(chosen_beam)
    structural_infill_waste.append(waste)
    beams_selected_framing_ver.append(chosen_beam)
    beams_selected_framing.append(chosen_beam)
    structural_infill_used.append(chosen_beam.length)
    
    if position == 0: #0 = outerleft vertical 
        pt0 = rg.Point3d(seg_ver.x_cor_start,0, seg_ver.z_cor_start)
        pt1 = rg.Point3d(seg_ver.x_cor_start + chosen_beam.width, chosen_beam.depth, seg_ver.z_cor_end)
        x_start = seg_ver.x_cor_start
        z_start = seg_ver.z_cor_start 
        z_end = seg_ver.z_cor_end
        
    if position == 1: #1 = outerright vertical
        pt0 = rg.Point3d(seg_ver.x_cor_end -chosen_beam.width, 0, seg_ver.z_cor_start)
        pt1 = rg.Point3d(seg_ver.x_cor_end, chosen_beam.depth, seg_ver.z_cor_end)
        x_start = seg_ver.x_cor_end -chosen_beam.width
        z_start = seg_ver.z_cor_start
        z_end = seg_ver.z_cor_end
        
    # generate geometry in grasshopper
    box = rg.BoundingBox(pt0, pt1)
    brep = box.ToBrep()
    geometry_infill_vertical.append(brep)
    
    #generate substructure for stud
    select_substructure (chosen_beam, required_length, database_substructure, x_start, z_start, z_end)
    
    
def outer_frame_horizontal(required_length, waste_wood_database, position):
    #pick piece of wood from database for horizontal outerframe (top & bottom) 
    chosen_beam = next(beam for beam in waste_wood_database if beam.length >= required_length)
    
    #determine additional waste with picked piece of wood
    waste = chosen_beam.length - required_length
    waste_wood_database.remove(chosen_beam)
    structural_infill_waste.append(waste)
    beams_selected_framing_hor.append(chosen_beam)
    beams_selected_framing.append(chosen_beam)
    structural_infill_used.append(chosen_beam.length)
    
    if position == 0: #0 = bottom horizontal 
        pt0 = rg.Point3d(seg_ver.x_cor_start, 0, seg_ver.z_cor_start)
        pt1 = rg.Point3d(seg_ver.x_cor_end, chosen_beam.width, seg_ver.z_cor_start + chosen_beam.depth)
        
    if position == 1: #1 = top horizontal 
        pt0 = rg.Point3d(seg_ver.x_cor_start, 0, seg_ver.z_cor_end -chosen_beam.depth)
        pt1 = rg.Point3d(seg_ver.x_cor_end, chosen_beam.width, seg_ver.z_cor_end)
        
    # generate geometry in grasshopper
    box = rg.BoundingBox(pt0, pt1)
    brep = box.ToBrep()
    geometry_infill_horizontal.append(brep)


def bracing (height_segment, width_segment, beams_selected_bracing, waste_wood_database):
    #determine dimensions right triangle for pythagoras calculation
    bracing_width = width_segment - beams_selected_framing[0+fr_counter].width - beams_selected_framing[1+fr_counter].width  
    bracing_height = height_segment - beams_selected_framing[2+fr_counter].depth - beams_selected_framing[3+fr_counter].depth  
    bracing_length = round((bracing_width**2 + bracing_height**2)**0.5)
    
    #pick piece of waste wood from database for bracing
    chosen_beam = next(beam for beam in waste_wood_database if beam.length >= bracing_length)
    waste = chosen_beam.length - bracing_length
    waste_wood_database.remove(chosen_beam)
    structural_infill_waste.append(waste)
    beams_selected_bracing.append(chosen_beam)
    structural_infill_used.append(chosen_beam.length)
    
    #create line to allow for geometry generation in grasshopper 
    start_bracing = ([beams_selected_framing[0+fr_counter].width + seg_ver.x_cor_start, 0,seg_ver.z_cor_end-beams_selected_framing[3+fr_counter].depth])  
    end_bracing = ([seg_ver.x_cor_end-beams_selected_framing[1+fr_counter].width, 0, seg_ver.z_cor_start + beams_selected_framing[2+fr_counter].depth]) 
    line_bracing = rs.AddLine(start_bracing,end_bracing)
    lines_bracing.append(line_bracing) 
    
    #calculation 
    tan = bracing_width / bracing_height
    y = math.degrees(math.atan(tan))
    corner = 90 - y 
    extra_x = math.sin(math.radians(corner)) * (0.5 * chosen_beam.depth)
    extra_z = math.cos(math.radians(corner)) * (0.5 * chosen_beam.depth)
    
    pt1 = rg.Point3d(beams_selected_framing[0+fr_counter].width + seg_ver.x_cor_start - extra_x , 0, seg_ver.z_cor_end-beams_selected_framing[3+fr_counter].depth - extra_z)
    pt2 = rg.Point3d(seg_ver.x_cor_end-beams_selected_framing[1+fr_counter].width - extra_x , 0, seg_ver.z_cor_start + beams_selected_framing[2+fr_counter].depth - extra_z)
    
    box_1 = rg.Point3d(0,0,0)
    box_2 = rg.Point3d(beams_selected_framing[0+fr_counter].depth, -beams_selected_framing[0+fr_counter].width, bracing_length)  
    
    zaxis = pt2-pt1
    plane = rg.Plane(pt1, zaxis)
    box = rg.BoundingBox(box_1,box_2)
    bracing_geo = rg.Box(plane, box) 
    geometry_infill_bracing.append(bracing_geo)


def intersection_formula (x_position, height_segment):
    #determine the formula of the bracing so the length of the bottom and top stud can be termined on every position along the slope
    a = (height_segment - beams_selected_framing[2+fr_counter].depth - beams_selected_framing[3+fr_counter].depth) / (width_segment- beams_selected_framing[0+fr_counter].width - beams_selected_framing[1+fr_counter].width)
    b = height_segment - beams_selected_framing[2+fr_counter].depth - beams_selected_framing[3+fr_counter].depth
    y = -a * x_position + b 
    length_bottom_stud = round(y + beams_selected_framing[2+fr_counter].depth) 
    return length_bottom_stud
    
    
def select_studs (chosen_bottom_stud, bottom_stud_length, chosen_top_stud, top_stud_length, waste_wood_database, stud_position):
    #determine waste bottom stud & remove bottom studs from database
    waste = chosen_bottom_stud.length - bottom_stud_length
    waste_wood_database.remove(chosen_bottom_stud)
    structural_infill_waste.append(waste)
    beams_selected_studs.append(chosen_bottom_stud)
    structural_infill_used.append(chosen_bottom_stud.length)
    
    #generate bottom stud geometry
    pt0 = rg.Point3d(seg_ver.x_cor_start + stud_position, 0, seg_ver.z_cor_start)  
    pt1 = rg.Point3d(seg_ver.x_cor_start + stud_position + chosen_bottom_stud.width, chosen_bottom_stud.depth, seg_ver.z_cor_start + bottom_stud_length)
    x_start = seg_ver.x_cor_start + stud_position
    z_start = seg_ver.z_cor_start 
    z_end = seg_ver.z_cor_start + bottom_stud_length
    box = rg.BoundingBox(pt0, pt1)
    brep = box.ToBrep()
    geometry_infill_studs.append(brep)
    select_substructure (chosen_bottom_stud, bottom_stud_length, database_substructure, x_start, z_start, z_end)
    
    #determine waste top stud & remove top studs from database
    waste = chosen_top_stud.length - top_stud_length
    waste_wood_database.remove(chosen_top_stud)
    structural_infill_waste.append(waste)
    beams_selected_studs.append(chosen_top_stud)
    structural_infill_used.append(chosen_top_stud.length)
    
    #generate top stud geometry
    center_align = (chosen_bottom_stud.width - chosen_top_stud.width) / 2
    pt0 = rg.Point3d(seg_ver.x_cor_start + stud_position + center_align, 0, seg_ver.z_cor_start + bottom_stud_length)
    pt1 = rg.Point3d(seg_ver.x_cor_start + stud_position + center_align + chosen_top_stud.width, chosen_top_stud.depth, seg_ver.z_cor_end)
    x_start = seg_ver.x_cor_start + stud_position + center_align
    z_start = seg_ver.z_cor_start + bottom_stud_length 
    z_end = seg_ver.z_cor_end
    box = rg.BoundingBox(pt0, pt1)
    brep = box.ToBrep()
    geometry_infill_studs.append(brep)
    
    #generate substructure for stud
    select_substructure (chosen_top_stud, top_stud_length, database_substructure, x_start, z_start, z_end)


def select_substructure (beam_infill, required_length, database_substructure, x_start, z_start, z_end):
    beam_pair = [] 
    
    #determine required depth for the substructure piece so that the complete substructre is alligned
    depth_required = int(max_depth_structural_infill) + 50 - beam_infill.depth
    length_required = required_length
    
    #picks the option to complete the substructure with 1 piece
    suitable_beams = iter([beam_sub for beam_sub in database_substructure if beam_sub.depth == depth_required and beam_sub.length >= length_required])
    chosen_beam = next(suitable_beams)

    #temp list with all the possible pieces that are longer then min required length and smaller then the required length.
    beams_selected_temp = [beam.length for beam in database_substructure if 
    beam.length >= min_length_substructure_piece and beam.length < length_required and beam.depth == depth_required]

    #looks for all the options where the total length of two pieces is smaller then thet total length of 1 piece. 
    #BUGG KAN ONTSTAAN DAT ER GEEN CHOSEN BEAM IS, BELANGRIJK OM REKENING MEE TE HOUDEN
    for numbers in itertools.combinations(beams_selected_temp,2):
        if sum(numbers) >= length_required and sum(numbers) < chosen_beam.length:
            beam_pair.append(numbers)
            
    #if there is no combination of two pieces, the single piece is picked
    if beam_pair == []: 
        beams_selected_substructure.append(chosen_beam)
        database_substructure.remove(chosen_beam)
        waste = chosen_beam.length - length_required
        substructure_waste.append(waste)
        
        pt0 = rg.Point3d(x_start, beam_infill.depth, z_start)
        pt1 = rg.Point3d(x_start+chosen_beam.width, beam_infill.depth+chosen_beam.depth, z_end)
        box = rg.BoundingBox(pt0, pt1)
        brep = box.ToBrep()
        geometry_substructure.append(brep)

    #otherwise the combination that generates the least waste is selected
    else:
        beam_pair.sort(key=sum)
        beam_pair_1 = next(beam for beam in database_substructure if beam.length == beam_pair[0][0] and beam.depth == depth_required)
        beams_selected_substructure.append(beam_pair_1)
        database_substructure.remove(beam_pair_1)
        
        beam_pair_2 = next(beam for beam in database_substructure if beam.length == beam_pair[0][1] and beam.depth == depth_required)
        beams_selected_substructure.append(beam_pair_2)
        database_substructure.remove(beam_pair_2)
        
        pt0 = rg.Point3d(x_start, beam_infill.depth, z_start)
        pt1 = rg.Point3d(x_start + beam_pair_1.width, beam_infill.depth+beam_pair_1.depth, z_start + beam_pair_1.length)
        box = rg.BoundingBox(pt0, pt1)
        brep = box.ToBrep()
        geometry_substructure.append(brep)
        
        pt0 = rg.Point3d(x_start, beam_infill.depth, z_start + beam_pair_1.length)
        pt1 = rg.Point3d(x_start +beam_pair_2.width, beam_infill.depth+beam_pair_2.depth, z_end)
        box = rg.BoundingBox(pt0, pt1)
        brep = box.ToBrep()
        geometry_substructure.append(brep)
        
        waste = sum(beam_pair[0]) - length_required
        substructure_waste.append(waste)
        
    beam_pair = []


structural_infill_waste = []
substructure_waste = []
structural_infill_used = [] 

beams_selected_bracing = [] 
beams_selected_framing_hor = [] 
beams_selected_framing_ver = [] 
beams_selected_framing = []
beams_selected_studs = []

beams_selected_substructure = []  

geometry_infill_horizontal = [] 
geometry_infill_vertical = [] 
geometry_infill_studs = [] 
geometry_infill_bracing = [] 
geometry_substructure = []

total_list = [] 

lines_bracing = []

fr_counter = 0 
br_counter = 0 

if generate: 
    for seg_ver in segments: 
        width_segment = seg_ver.x_cor_end - seg_ver.x_cor_start
        height_segment = seg_ver.z_cor_end - seg_ver.z_cor_start
        
        outer_frame_vertical(height_segment, waste_wood_database, 0)
        outer_frame_vertical(height_segment, waste_wood_database, 1)
        outer_frame_horizontal(width_segment, waste_wood_database, 0)
        outer_frame_horizontal(width_segment, waste_wood_database, 1) 
        bracing(height_segment, width_segment, beams_selected_bracing, waste_wood_database)
    
        stud_position = ctc_distance
        
        while stud_position < width_segment:
            #determine required length for bottom & top stud
            bottom_stud_length = intersection_formula (stud_position, height_segment)
            top_stud_length = height_segment - bottom_stud_length 
            margin = 0 
            controle = False
            
            while controle == False:
                suitable_bottom_studs = iter([beam for beam in waste_wood_database if beam.length >= bottom_stud_length + margin])
                chosen_bottom_stud = next(suitable_bottom_studs) 
                
                #restrictions top studs based on bottom stud, top stud cannot be wider or deeper then bottom stud
                suitable_top_studs = iter([beam for beam in waste_wood_database if beam.length >= top_stud_length 
                #and beam.width <= chosen_bottom_stud.width
                #and beam.depth <= chosen_bottom_stud.depth 
                and beam.length < top_stud_length + 150
                and beam.id != chosen_bottom_stud.id
                ])
                
                chosen_top_stud = next(suitable_top_studs, 0)
                
                #if no top stud is suitable, a different bottom stud is selected
                if chosen_top_stud == 0:
                    margin +=1
    
                else: 
                    controle = True
                    select_studs (chosen_bottom_stud, bottom_stud_length, chosen_top_stud, top_stud_length, waste_wood_database, stud_position)
                    stud_position = stud_position + ctc_distance
    
        fr_counter += 4 
        br_counter += 1 
    
    #calculate the total waste of the structural infill + substructure
    total_waste = sum(structural_infill_waste) + sum(substructure_waste) 
    
    total_infill = beams_selected_bracing + beams_selected_framing + beams_selected_studs
    total_infill_used = sum(structural_infill_used)/1000
    total_waste_infill = sum(structural_infill_waste)/1000
    total_infill_required =  (sum(structural_infill_used)/1000)-(sum(structural_infill_waste)/1000)
    
    substructure_used = [wood.length for wood in beams_selected_substructure]
    total_substructure_used = sum(substructure_used)/1000
    total_waste_substructure = sum(substructure_waste)/1000
    total_substructure_required =  (sum(substructure_used)/1000)-(sum(substructure_waste)/1000)
    
    total_list = [total_infill_used, total_waste_infill, total_infill_required, total_substructure_used, total_waste_substructure, total_substructure_required] 
    
    
    #total_infill = beams_selected_bracing + beams_selected_framing + beams_selected_studs
    #total_infill_used = 'strucutral infill used: '+ str(sum(structural_infill_used)/1000) + 'm'
    #total_waste_infill = 'strucutral infill waste: '+ str(sum(structural_infill_waste)/1000) + 'm'
    #total_infill_required =  'structural infill required: ' + str((sum(structural_infill_used)/1000)-(sum(structural_infill_waste)/1000)) + 'm'
    
   # substructure_used = [wood.length for wood in beams_selected_substructure]
    #total_substructure_used = 'substructure used: '+ str(sum(substructure_used)/1000) + 'm'
    #total_waste_substructure = 'substructure waste: '+ str(sum(substructure_waste)/1000) + 'm'
    #total_substructure_required =  'substructure required: ' + str((sum(substructure_used)/1000)-(sum(substructure_waste)/1000)) + 'm'
    
    
    #check to see if no piece of wood was selected twice from the database
    print('\n') 
    print('structural_infill') 
    total_infill.sort(key = operator.attrgetter('id'))
    for balk in total_infill:
        balk.print_data()
    
    #check to see if no piece of wood was selected twice from the database
    print('\n') 
    print('substructure') 
    beams_selected_substructure.sort(key = operator.attrgetter('id'))
    for balk in beams_selected_substructure:
        balk.print_data()
# ---------- end structural_infill_substructure_2 ----------

# ----
# CLADDING
cladding_2 = GhPythonScript(
    generate=toggle,
    database_cladding=db_cladding.database_cladding,
    ctc_distance=int_22,
    cladding_segments=segments_coordinates.cladding_segments)  # -> out, total_cladding_used, total_cladding_waste, total_cladding_required; inputs database_cladding: list, cladding_segments: list; same code as cladding

panel_5 = Panel(structural_infill_substructure.total_infill_required)
panel_6 = Panel(structural_infill_substructure.total_substructure_used)
panel_7 = Panel(structural_infill_substructure.total_substructure_required)
panel_8 = Panel(structural_infill_substructure.total_infill_used)
panel_9 = Panel(structural_infill_substructure.total_waste_infill)
panel_10 = Panel(structural_infill_substructure.total_waste_substructure)

panel_11 = Panel(structural_infill_substructure_2.total_infill_required)
panel_12 = Panel(structural_infill_substructure_2.total_substructure_used)
panel_13 = Panel(structural_infill_substructure_2.total_substructure_required)
panel_14 = Panel(structural_infill_substructure_2.total_infill_used)
panel_15 = Panel(structural_infill_substructure_2.total_waste_infill)
panel_16 = Panel(structural_infill_substructure_2.total_waste_substructure)

panel_17 = Panel(cladding.total_cladding_used)
panel_18 = Panel(cladding.total_cladding_required)
panel_19 = Panel(cladding.total_cladding_waste)

panel_20 = Panel(cladding_2.total_cladding_required)
panel_21 = Panel(cladding_2.total_cladding_used)
panel_22 = Panel(cladding_2.total_cladding_waste)

merge = Merge(
    Data1=structural_infill_substructure_2.total_infill_used,
    Data2=structural_infill_substructure_2.total_waste_infill,
    Data3=structural_infill_substructure_2.total_infill_required,
    Data4=structural_infill_substructure_2.total_substructure_used,
    Data5=structural_infill_substructure_2.total_waste_substructure,
    Data6=structural_infill_substructure_2.total_substructure_required,
    Data7=cladding_2.total_cladding_used,
    Data8=cladding_2.total_cladding_waste,
    Data9=cladding_2.total_cladding_required,
    Data10=structural_infill_substructure.total_infill_used,
    Data11=structural_infill_substructure.total_waste_infill,
    Data12=structural_infill_substructure.total_infill_required,
    Data13=structural_infill_substructure.total_substructure_used,
    Data14=structural_infill_substructure.total_waste_substructure,
    Data15=structural_infill_substructure.total_substructure_required,
    Data16=cladding.total_cladding_used,
    Data17=cladding.total_cladding_waste,
    Data18=cladding.total_cladding_required)
gh_cpython = GH_CPython(x=toggle, data_input=merge)  # -> output; inputs x: list, data_input: list
#   port data_input: [required] - [type = int] - [default = None] Descripe your input here * bullet point. * bullet point
#   port output: indicate your output description here. refers to a new line.
# ---------- gh_cpython: Python ----------
from openpyxl import load_workbook
import ctypes.wintypes

CSIDL_PERSONAL = 5       # My Documents
SHGFP_TYPE_CURRENT = 0   # Get current, not default value
buf = ctypes.create_unicode_buffer(ctypes.wintypes.MAX_PATH)
ctypes.windll.shell32.SHGetFolderPathW(None, CSIDL_PERSONAL, None, SHGFP_TYPE_CURRENT, buf)


# filename
fname = buf.value + "\Exterior wall element tool\Study_scripts\playground_result.xlsx"



if x: 
    wb = load_workbook(fname)
    ws = wb.worksheets[0]

    row_data = []
    ws.append(data_input)

    wb.save(fname)

    output = 'done'
print('test')
# ---------- end gh_cpython ----------
