# Grasshopper definition structural_infill_design_hexagon.gh (Grasshopper 1.0.7)
# plug-ins: Kangaroo2 Components

length_side_triangle = Panel("50")
width_wall = Panel("4800")
length_side_hexagon = Panel("650")
height_wall = Panel("3000")
integer = Integer(10)
hexagonal = Hexagonal(Plane=PlaneXY(0, 0, 0), Size=length_side_hexagon, ExtentX=integer, ExtentY=integer)  # -> Cells, Points
integer_2 = Integer(3)
explode = Explode(Curve=hexagonal.Cells, Recursive=True)  # -> Segments, Vertices
point = Point(explode.Vertices)
polygon = Polygon(Plane=flatten(point), Radius=length_side_triangle, Segments=integer_2, FilletRadius=0)  # -> flatten(Polygon), Length
sift_pattern = SiftPattern(List=point, SiftPattern=[1, 0, 1, 0, 1, 0, 1, 1])  # -> Output0, Output1
sift_pattern_2 = SiftPattern(List=polygon.Polygon, SiftPattern=[1, 0, 1, 0, 1, 0, 1])  # -> Output0, Output1
polygon_2 = Polygon(Plane=sift_pattern.Output1, Radius=length_side_triangle, Segments=integer_2, FilletRadius=0)  # -> flatten(Polygon), Length
rotate = Rotate(Geometry=sift_pattern_2.Output0, Angle=degrees(60), Plane=flatten(sift_pattern.Output0))  # -> Geometry, Transform
rectangle = Rectangle(Plane=PlaneXY(0, 0, 0), XSize=width_wall, YSize=height_wall, Radius=0)  # -> Rectangle, Length
curve = Curve(flatten([rotate.Geometry, polygon_2.Polygon]))
clean_tree = CleanTree(RemoveNulls=True, RemoveInvalid=True, RemoveEmpty=False, Tree=curve)
curve_2 = Curve(clean_tree)
trim_with_regions = TrimWithRegions(Curve=hexagonal.Cells, Regions=curve_2)  # -> Inside, Outside
curve_3 = Curve([trim_with_regions.Outside, curve_2])
trim_with_region = TrimWithRegion(Curve=curve_3, Region=rectangle.Rectangle)  # -> Inside, Outside
explode_2 = Explode(Curve=flatten(trim_with_region.Inside), Recursive=True)  # -> Segments, Vertices
removeduplicatelines = RemoveDuplicateLines(Lines=flatten(explode_2.Segments), Tolerance=0.01)
curve_4 = Curve(flatten([removeduplicatelines, rectangle.Rectangle]))
length = Length(Curve=curve_4)
mass_addition = MassAddition(Input=length)  # -> Result, PartialResults
total_length = Panel(mass_addition.Result)
