# Grasshopper definition Exterior_wall_element_tool_JvE.gh (Grasshopper 1.0.7)
# plug-ins: Human UI, GH_CPython

# TOGGLE TRUE FOR INTERFACE
human_ui_interface = BooleanToggle(False)
toggle = BooleanToggle(False)  # disabled
toggle_2 = BooleanToggle(True)  # disabled

number_slider = Slider(371, range=0..2000)  # disabled
reset = BooleanToggle(False)  # disabled
python = PythonScript(x=toggle, Reset=reset, Delay=number_slider)  # -> Boolean; inputs Reset: Boolean; disabled
# ---------- python: Python ----------
import time
import Grasshopper as gh

def updateComponent(interval):
    
    """ Updates this component, similar to using a grasshopper timer """
    
    # Define callback action
    def callBack(e):
        ghenv.Component.ExpireSolution(False)
        
    # Get grasshopper document
    ghDoc = ghenv.Component.OnPingDocument()
    
    # Schedule this component to expire
    ghDoc.ScheduleSolution(interval,gh.Kernel.GH_Document.GH_ScheduleDelegate(callBack))

if x: 
    # Instantiate/reset persistent boolean 
    if "pb" not in globals() or Reset:
        pb = True
    
    # Flip persistent boolean 
    pb = not pb
    
    # Update component
    updateComponent(Delay)
    
    # Output boolean
    Boolean = pb
# ---------- end python ----------
panel = Panel(toggle_2)  # disabled

# ----
# RESET DATABASE
reset_database = Button()

# ----
# DB SUBSTRUCTURE
reset_database_2 = BooleanToggle(False)
database_amount = Panel("500")
min_length_mm = Panel("10")
max_length_mm = Panel("5000")
min_depth_mm = Panel("50")
max_depth_mm = Panel("90")
min_width_mm = Panel("30")
max_width_mm = Panel("60")
int = Integer(database_amount)
int_2 = Integer(min_length_mm)
int_3 = Integer(max_length_mm)
int_4 = Integer(min_width_mm)
int_5 = Integer(max_width_mm)
int_6 = Integer(max_depth_mm)
int_7 = Integer(min_depth_mm)

# ----
# DB CLADDING
reset_database_3 = BooleanToggle(True)
min_height_mm = Panel("100")
min_depth_mm_2 = Panel("10")
max_depth_mm_2 = Panel("30")
database_amount_2 = Panel("500")
min_length_mm_2 = Panel("10")
max_length_mm_2 = Panel("5000")
max_height_mm = Panel("250")
int_8 = Integer(database_amount_2)
int_9 = Integer(max_length_mm_2)
int_10 = Integer(max_depth_mm_2)
int_11 = Integer(min_length_mm_2)
int_12 = Integer(min_height_mm)
int_13 = Integer(max_height_mm)
int_14 = Integer(min_depth_mm_2)

# ----
# DATABASE INFILL
reset_database_4 = BooleanToggle(True)
min_witdh_mm = Panel("60")
database_amount_3 = Panel("500")
min_length_mm_3 = Panel("10")
max_length_mm_3 = Panel("5000")
max_width_mm_2 = Panel("90")
min_depth_mm_3 = Panel("160")
max_depth_mm_3 = Panel("200")
int_15 = Integer(database_amount_3)
int_16 = Integer(max_length_mm_3)
int_17 = Integer(min_length_mm_3)
int_18 = Integer(min_witdh_mm)
int_19 = Integer(max_width_mm_2)
int_20 = Integer(min_depth_mm_3)
int_21 = Integer(max_depth_mm_3)

# ----
# DB SUBSTRUCTURE
reset_database_5 = BooleanToggle(False)  # disabled
database_amount_4 = Panel("250")  # disabled
min_length_mm_4 = Panel("10")  # disabled
max_length_mm_4 = Panel("4000")  # disabled
min_depth_mm_4 = Panel("50")  # disabled
max_depth_mm_4 = Panel("90")  # disabled
min_width_mm_2 = Panel("30")  # disabled
max_width_mm_3 = Panel("60")  # disabled
int_22 = Integer(database_amount_4)  # disabled
int_23 = Integer(min_length_mm_4)  # disabled
int_24 = Integer(max_length_mm_4)  # disabled
int_25 = Integer(min_width_mm_2)  # disabled
int_26 = Integer(max_width_mm_3)  # disabled
int_27 = Integer(max_depth_mm_4)  # disabled
int_28 = Integer(min_depth_mm_4)  # disabled

# ----
# DB CLADDING
reset_database_6 = BooleanToggle(True)  # disabled
database_amount_5 = Panel("200")  # disabled
max_length_mm_5 = Panel("4000")  # disabled
min_height_mm_2 = Panel("100")  # disabled
min_depth_mm_5 = Panel("10")  # disabled
max_depth_mm_5 = Panel("30")  # disabled
min_length_mm_5 = Panel("10")  # disabled
max_height_mm_2 = Panel("250")  # disabled
int_29 = Integer(database_amount_5)  # disabled
int_30 = Integer(max_length_mm_5)  # disabled
int_31 = Integer(max_depth_mm_5)  # disabled
int_32 = Integer(min_length_mm_5)  # disabled
int_33 = Integer(min_height_mm_2)  # disabled
int_34 = Integer(max_height_mm_2)  # disabled
int_35 = Integer(min_depth_mm_5)  # disabled

# ----
# DATABASE INPUT
# DATABASE INFILL
reset_database_7 = BooleanToggle(True)  # disabled
min_witdh_mm_2 = Panel("60")  # disabled
max_depth_mm_6 = Panel("200")  # disabled
database_amount_6 = Panel("200")  # disabled
min_length_mm_6 = Panel("10")  # disabled
max_length_mm_6 = Panel("4000")  # disabled
max_width_mm_4 = Panel("90")  # disabled
min_depth_mm_6 = Panel("160")  # disabled
int_36 = Integer(database_amount_6)  # disabled
int_37 = Integer(max_length_mm_6)  # disabled
int_38 = Integer(min_length_mm_6)  # disabled
int_39 = Integer(min_witdh_mm_2)  # disabled
int_40 = Integer(max_width_mm_4)  # disabled
int_41 = Integer(min_depth_mm_6)  # disabled
int_42 = Integer(max_depth_mm_6)  # disabled

# ----
# CLASSES
classes = GhPythonScript()  # -> out, a; disabled
# ---------- classes: Python ----------
print('import succes') 

class beams():
    def __init__(self, length, width, depth, db_id):
        self.length = length
        self.width = width
        self.depth = depth
        self.id = db_id
        
    def print_data(self):
        print(self.length, self.width, self.depth, self.id)


class beams_substructure(beams):
    pass


class beams_cladding():
    def __init__(self, length, height, depth, db_id):
        self.length = length
        self.height = height
        self.depth = depth
        self.id = db_id


class coordinates_segments():
    def __init__(self, x_cor_start, z_cor_start, x_cor_end, z_cor_end):
        self.x_cor_start = x_cor_start
        self.z_cor_start = z_cor_start
        self.x_cor_end = x_cor_end
        self.z_cor_end = z_cor_end
        
    def print_cor(self):
        print(self.x_cor_start, self.z_cor_start, self.x_cor_end, self.z_cor_end)


class coordinates_segments_cladding(coordinates_segments):
    pass
# ---------- end classes ----------

# ---- group: DATABASE SUB STRUCTURE
py__db_substructure = GhPythonScript(
    x=reset_database,
    database_amount=int,
    min_length=int_2,
    max_length=int_3,
    min_width=int_4,
    max_width=int_5,
    min_depth=int_7,
    max_depth=int_6)  # -> out, database_substructure
# ---------- py__db_substructure: Python ----------
"""Generates the substructure data voor the database.
    Inputs:
        database_amount: number of wood in database for substructure
        min_length: minimal length in mm of wood for substructure
        max_length: maximum length in mm of wood for substructure 
        min_width: minimal width in mm of wood for substructure
        max_width: maximum width in mm of wood for substructure
        min_depth: minimal depth in mm of wood for substructure 
        max_depth: maximum depth in mm of wood for substructure
    Output:
        database_substructure: list with wood dimensions for substructure"""

import random

database_substructure = []

for i in range(0,database_amount):
    length = random.randrange(min_length, max_length+1 ,10)
    width = random.randrange(min_width, max_width+1 ,10)
    depth = random.randrange(min_depth, max_depth+1 ,10)
    piece_of_wood = (length, width, depth)
    database_substructure.append(piece_of_wood)
# ---------- end py__db_substructure ----------
panel_2 = Panel(py__db_substructure.database_substructure)

# ---- group: DATABASE CLADDING
py__db_cladding = GhPythonScript(
    x=reset_database,
    database_amount=int_8,
    min_length=int_11,
    max_length=int_9,
    min_height=int_12,
    max_height=int_13,
    min_depth=int_14,
    max_depth=int_10)  # -> out, database_cladding
# ---------- py__db_cladding: Python ----------
"""Generates the cladding data voor the database.
    Inputs:
        database_amount: number of wood in database for cladding
        min_length: minimal length in mm of wood for cladding
        max_length: maximum length in mm of wood for cladding 
        min_width: minimal width in mm of wood for cladding
        max_width: maximum width in mm of wood for cladding
        min_depth: minimal depth in mm of wood for cladding 
        max_depth: maximum depth in mm of wood for cladding
    Output:
        database_cladding: list with wood dimensions for cladding"""

import random 

database_cladding = []

for i in range(0,database_amount):
    length = random.randrange(min_length, max_length+1, 10)
    height = random.randrange(min_height, max_height+1, 10)
    depth = random.randrange(min_depth, max_depth+1, 1)
    piece_of_cladding = (length, height, depth)
    database_cladding.append(piece_of_cladding)
# ---------- end py__db_cladding ----------
panel_3 = Panel(py__db_cladding.database_cladding)

# ---- group: DATABASE STRUCTURAL
py__db_structural_infill = GhPythonScript(
    x=reset_database,
    database_amount=int_15,
    min_length=int_17,
    max_length=int_16,
    min_width=int_18,
    max_width=int_19,
    min_depth=int_20,
    max_depth=int_21)  # -> out, structural_database
# ---------- py__db_structural_infill: Python ----------
"""Generates the structural infill data voor the database.
    Inputs:
        database_amount: number of wood in database for structural infill
        min_length: minimal length in mm of wood for structural infill
        max_length: maximum length in mm of wood for structural infill 
        min_width: minimal width in mm of wood for structural infill
        max_width: maximum width in mm of wood for structural infill
        min_depth: minimal depth in mm of wood for structural infill 
        max_depth: maximum depth in mm of wood for structural infill
    Output:
        structural_database: list with wood dimensions"""

import random

structural_database = []

for i in range(0,database_amount):
    length = random.randrange(min_length, max_length+1, 10)
    width = random.randrange(min_width,max_width+1, 10)
    depth = random.randrange(min_depth,max_depth+1, 10)
    piece_of_wood =(length, width, depth)
    structural_database.append(piece_of_wood)
# ---------- end py__db_structural_infill ----------
panel_4 = Panel(py__db_structural_infill.structural_database)

# ---- group: DATABASE SUB STRUCTURE
db_substructure = GhPythonScript(
    x=toggle_2,
    database_amount=int_22,
    min_length=int_23,
    max_length=int_24,
    min_width=int_25,
    max_width=int_26,
    min_depth=int_28,
    max_depth=int_27)  # -> out, database_substructure; disabled
# ---------- db_substructure: Python ----------
import random
from class_beams import *
import operator

if x: 
    database_substructure = []
    id = 1
    
    for i in range(0,database_amount):
        length = random.randrange(min_length, max_length+1 ,10)
        width = random.randrange(min_width, max_width+1 ,10)
        depth = random.randrange(min_depth, max_depth+1 ,10)
        piece_of_wood = beams_substructure(length, width, depth, id)
        database_substructure.append(piece_of_wood)
        id += 1
        
    database_substructure.sort(key = operator.attrgetter('length'))
    database_substructure.sort(key = operator.attrgetter('depth'))
# ---------- end db_substructure ----------
panel_5 = Panel(db_substructure.database_substructure)  # disabled

# ---- group: DATABASE CLADDING
db_cladding = GhPythonScript(
    x=toggle_2,
    database_amount=int_29,
    min_length=int_32,
    max_length=int_30,
    min_height=int_33,
    max_height=int_34,
    min_depth=int_35,
    max_depth=int_31)  # -> out, database_cladding; disabled
# ---------- db_cladding: Python ----------
from class_beams import *
import operator
import random 

if x:
    database_cladding = []
    id = 1
    
    for i in range(0,database_amount):
        length = random.randrange(min_length, max_length+1, 10)
        height = random.randrange(min_height, max_height+1, 10)
        depth = random.randrange(min_depth, max_depth+1, 1)
        piece_of_cladding = beams_cladding(length, height, depth, id)
        database_cladding.append(piece_of_cladding)
        id += 1
    
    database_cladding.sort(key = operator.attrgetter('length'))
    database_cladding.sort(key = operator.attrgetter('height'), reverse = True)
# ---------- end db_cladding ----------
panel_6 = Panel(db_cladding.database_cladding)  # disabled

# ---- group: DATABASE STRUCTURAL
db_structural_infill = GhPythonScript(
    x=toggle_2,
    database_amount=int_36,
    min_length=int_38,
    max_length=int_37,
    min_width=int_39,
    max_width=int_40,
    min_depth=int_41,
    max_depth=int_42)  # -> out, structural_database; disabled
# ---------- db_structural_infill: Python ----------
import random
from class_beams import *
import operator


if x: 
    structural_database = []
    id = 1 
    
    for i in range(0,database_amount):
        length = random.randrange(min_length, max_length+1, 10)
        width = random.randrange(min_width,max_width+1, 10)
        depth = random.randrange(min_depth,max_depth+1, 10)
        piece_of_wood =beams(length, width, depth, id)
        structural_database.append(piece_of_wood)
        id += 1 
    
    
    structural_database.sort(key = operator.attrgetter('length'))
# ---------- end db_structural_infill ----------
panel_7 = Panel(db_structural_infill.structural_database)  # disabled

# ----
height = Slider(2500, range=0..10000)  # disabled
width = Slider(3000, range=0..10000)  # disabled
centre_to_centre_distance = Panel("600")  # disabled
substructure_min_length = Panel("300")  # disabled
max_depth_substructure_mm = Panel("200")  # disabled
int_43 = Integer(centre_to_centre_distance)  # disabled
int_44 = Integer(substructure_min_length)  # disabled
int_45 = Integer(max_depth_substructure_mm)  # disabled

# ----
# DATABASE INPUT
toggle_3 = BooleanToggle(True)
merge = Merge(
    Data1=py__db_structural_infill.structural_database,
    Data2=py__db_substructure.database_substructure,
    Data3=py__db_cladding.database_cladding)
py__import_data_to_db = Py_ImportDataToDb(apply=toggle_3, waste_wood_data=merge)  # -> output; inputs apply: list, waste_wood_data: list
#   port apply: [required] - type = string] - []default = ""]
# ---------- py__import_data_to_db: Python ----------
""" Combines data and sents it to PostgreSQL database.
    Inputs:
        apply: boolean toggle to sent data to database
    Output:
        output: conformation when data is sent. 

"""


def clear_data(): 
    #deletes existing data in database
    import psycopg2 as pg2
    conn = pg2.connect(database='hout', user='postgres', password='baksteen')
    cur = conn.cursor() 
    cur.execute("TRUNCATE wood_dimensions RESTART IDENTITY ")
    conn.commit()
    print('data removed')

def apply_data():
    #applies data to database
    for piece_of_wood in waste_wood_data:
        length = piece_of_wood[0]
        width = piece_of_wood[1]
        depth = piece_of_wood[2]
        strength_class = 'C18'
        collector_id = random.randint(1,6)

        cur.execute("INSERT INTO wood_dimensions(length_wood,width_wood,depth_wood,strength_class,collector_id)\
        VALUES (%s,%s,%s,%s,%s)",(length,width,depth,strength_class,collector_id));
        conn.commit()

    print('data import succes')
    return 'data import succes'
    

import psycopg2 as pg2
import random

conn = pg2.connect(database='hout', user='postgres', password='baksteen')
cur = conn.cursor()

if apply == True:
    clear_data()
    output = apply_data()
# ---------- end py__import_data_to_db ----------
panel_8 = Panel(py__import_data_to_db)

# ----
# SEGMENT CALCULATION
segments_coordinates = GhPythonScript(width_wall=width, height_wall=height, database_infill=db_structural_infill.structural_database, ctc_distance=int_43)  # -> out, rectangles, segments, cladding_segments; inputs database_infill: list; disabled
# ---------- segments_coordinates: Python ----------
import Rhino.Geometry as rg
import math
from class_beams import *

rectangles = [] 
segments = []
pt0 = rg.Point3d(0, 0, 0)
height_point = rg.Point3d(0, 1, 0)
zaxis = height_point-pt0
plane = rg.Plane(pt0, zaxis)

width_segments = [] 
cladding_segments = [] 

#er moet nog wel rekening mee gehouden dat de database kleiner word!!!!
def number_segments(x_start, z_start, x_end, z_end): 
    width_element = x_end - x_start
    height_element = z_end - z_start
    max_width = int((database_infill[-1].length**2 - height_element**2)**0.5)

    while max_width < width_element:
        segment_width = math.floor(max_width / ctc_distance) * ctc_distance 
        width_element -= segment_width
        segment = coordinates_segments(x_start, z_start, x_start + segment_width, z_end)
        segments.append(segment)
        x_start = x_start + segment_width
        
    if max_width > width_element:
        segment = coordinates_segments(x_start, z_start, x_end, z_end)
        segments.append(segment)

def rectangle_wall(width_wall, height_wall):
    pt0 = rg.Point3d(0, 0, 0)
    pt1 = rg.Point3d(width_wall, 0, height_wall)
    rectangle = rg.Rectangle3d(plane,pt0, pt1)
    rectangles.append(rectangle) 


def rectangle_door(start_door, width_door, height_door):
    pt0 = rg.Point3d(start_door, 0, 0)
    pt1 = rg.Point3d(start_door + width_door, 0, height_door)
    rectangle = rg.Rectangle3d(plane,pt0, pt1)
    rectangles.append(rectangle) 


def rectangle_window(start_x_window, start_z_window, width_window, height_window): 
    pt0 = rg.Point3d(start_x_window, 0, start_z_window)
    pt1 = rg.Point3d(start_x_window + width_window, 0, start_z_window + height_window)
    rectangle = rg.Rectangle3d(plane,pt0, pt1)
    rectangles.append(rectangle) 


if door == False and window == False:
    rectangle_wall(width_wall, height_wall) 
    number_segments(0, 0, width_wall, height_wall)
    cladding_segments.append(coordinates_segments_cladding(0, 0, width_wall, height_wall))

if door == True and window == False:
    rectangle_wall(width_wall, height_wall) 
    rectangle_door(start_door, width_door, height_door)
    
    #number_segments(start_door, 0, start_door + width_door, height_door)
    number_segments(0, 0, start_door, height_wall)
    number_segments(start_door, height_door, start_door + width_door, height_wall)
    number_segments(start_door + width_door, 0, width_wall, height_wall)
    
    cladding_segments.append(coordinates_segments_cladding(0, 0, start_door, height_door))
    cladding_segments.append(coordinates_segments_cladding(start_door + width_door, 0, width_wall, height_door))
    cladding_segments.append(coordinates_segments_cladding(0, height_door, width_wall, height_wall))

if door == False and window == True: 
    rectangle_wall(width_wall, height_wall) 
    rectangle_window(start_x_window, start_z_window, width_window, height_window)
    
    number_segments(0, 0, start_x_window, height_wall)
    number_segments(start_x_window, 0, start_x_window + width_window, start_z_window)
    number_segments(start_x_window, start_z_window + height_window, start_x_window + width_window, height_wall)
    number_segments(start_x_window + width_window, 0, width_wall, height_wall)
    
    cladding_segments.append(coordinates_segments_cladding(0, 0, width_wall, start_z_window))
    cladding_segments.append(coordinates_segments_cladding(0, start_z_window + height_window, width_wall, height_wall))
    cladding_segments.append(coordinates_segments_cladding(0, start_z_window, start_x_window, start_z_window + height_window))
    cladding_segments.append(coordinates_segments_cladding(start_x_window + width_window, start_z_window, width_wall, start_z_window + height_window))

if door == True and window == True:
    rectangle_wall(width_wall, height_wall) 
    rectangle_door(start_door, width_door, height_door)
    rectangle_window(start_x_window, start_z_window, width_window, height_window)
    
    if start_x_window < start_door:
        number_segments(0, 0, start_x_window, height_wall)
        number_segments(start_x_window, 0, start_x_window + width_window, start_z_window)
        number_segments(start_x_window, start_z_window + height_window, start_x_window + width_window, height_wall)
        number_segments(start_x_window + width_window, 0, start_door, height_wall)
        number_segments(start_door, height_door, start_door + width_door, height_wall)
        number_segments(start_door + width_door, 0, width_wall, height_wall)
        
        cladding_segments.append(coordinates_segments_cladding(0, 0, start_door, start_z_window))
        cladding_segments.append(coordinates_segments_cladding(0, start_z_window + height_window, start_door, height_wall))
        cladding_segments.append(coordinates_segments_cladding(0, start_z_window, start_x_window, start_z_window + height_window))
        cladding_segments.append(coordinates_segments_cladding(start_x_window + width_window, start_z_window, start_door, start_z_window + height_window))
        cladding_segments.append(coordinates_segments_cladding(start_door + width_door, 0, width_wall, height_door))
        cladding_segments.append(coordinates_segments_cladding(start_door, height_door, width_wall, height_wall))
        
    if start_x_window > start_door:
        number_segments(0, 0, start_door, height_wall)
        number_segments(start_door, height_door, start_door + width_door, height_wall)
        number_segments(start_door + width_door, 0, start_x_window, height_wall)
        number_segments(start_x_window, 0, start_x_window + width_window, start_z_window)
        number_segments(start_x_window, start_z_window + height_window, start_x_window + width_window, height_wall)
        number_segments(start_x_window + width_window, 0, width_wall, height_wall)
        
        cladding_segments.append(coordinates_segments_cladding(0, 0, start_door, height_door))
        cladding_segments.append(coordinates_segments_cladding(0, height_door, start_door + width_door, height_wall))
        cladding_segments.append(coordinates_segments_cladding(start_door + width_door, 0, width_wall, start_z_window)) 
        cladding_segments.append(coordinates_segments_cladding(start_door + width_door, start_z_window, start_x_window, start_z_window + height_window)) 
        cladding_segments.append(coordinates_segments_cladding(start_door + width_door, start_z_window + height_window, width_wall, height_wall)) 
        cladding_segments.append(coordinates_segments_cladding(start_x_window + width_window, start_z_window, width_wall, start_z_window + height_window))
# ---------- end segments_coordinates ----------

# ----
# SEARCH QUERY
panel_9 = Panel("SELECT length_wood, width_wood, depth_wood, wood_id FROM wood_dimensions WHERE depth_wood >= 160 AND depth_wood <= 200;")
panel_10 = Panel("SELECT length_wood, width_wood, depth_wood, wood_id FROM wood_dimensions WHERE depth_wood >= 50 AND depth_wood <= 90;")
panel_11 = Panel("SELECT length_wood, width_wood, depth_wood, wood_id FROM wood_dimensions WHERE depth_wood >= 10 AND depth_wood <= 30;")

# ----
# DATABASE OUTPUT
py__extract_data_from_db = Py_ExtractDataFromDb(x=reset_database, structural_query=panel_9, substructure_query=panel_10, cladding_query=panel_11)  # -> database, check; inputs x: list
# ---------- py__extract_data_from_db: Python ----------
""" Extracts data from PostgreSQL database.
    Inputs:
        x: reset toggle to extract new data
        structural_query: query to select wood suitable for structural infill
        substructure_query: query to select wood suitable for the substructure
        cladding_query: query to select wood suitable for the cladding
    Output:
        database: list of extracted data 
        check: first line of data to check if data was extracted

"""
import psycopg2 as pg2
import ctypes.wintypes
import pickle



def import_data(query, database): 
    cur.execute(query)
    conn.commit()
    data_set = cur.fetchall()
    print('data imported')
    for data in data_set:
        database.append(data)
        

database_infill = [] 
database_substructure = [] 
database_cladding = [] 

conn = pg2.connect(
    database='hout',
    user = 'postgres', 
    password = 'baksteen')
cur = conn.cursor()

import_data(structural_query, database_infill)
import_data(substructure_query, database_substructure)
import_data(cladding_query, database_cladding)

total_database = (database_infill, database_substructure, database_cladding)

CSIDL_PERSONAL = 5       # My Documents
SHGFP_TYPE_CURRENT = 0   # Get current, not default value
buf = ctypes.create_unicode_buffer(ctypes.wintypes.MAX_PATH)
ctypes.windll.shell32.SHGetFolderPathW(None, CSIDL_PERSONAL, None, SHGFP_TYPE_CURRENT, buf)


# filename
fname = buf.value + "\Exterior wall element tool\database_pickle"
print(fname)
#fname = "C:/Users/jvane/OneDrive/Building Technology/GRADUATION/GRASSHOPPER/database_pickle"
# filehandle
fhandle = open(fname, 'wb')
# dump data to file
pickle.dump(total_database, fhandle, protocol=2)
# close file
fhandle.close()
# output file
database = fname

check = database_infill[0]
print(check)
check = database_substructure[0]
print(check)
check = database_cladding[0]
print(check)
# ---------- end py__extract_data_from_db ----------
panel_12 = Panel(py__extract_data_from_db.check)

centre_to_centre_distance_2 = Panel("600")
substructure_min_length_2 = Panel("300")
depth_wall_element = Panel("250")
int_46 = Integer(centre_to_centre_distance_2)
int_47 = Integer(substructure_min_length_2)
int_48 = Integer(depth_wall_element)

# ----
# CLASSES
py__classes = GhPythonScript()  # -> out, a
# ---------- py__classes: Python ----------
print('import succes') 

class wood_structural():
    def __init__(self, length, width, depth, db_id):
        self.length = length
        self.width = width
        self.depth = depth
        self.id = db_id
        
    def print_data(self):
        print(self.length, self.width, self.depth, self.id)


class wood_substructure(wood_structural):
    pass


class wood_cladding():
    def __init__(self, length, height, depth, db_id):
        self.length = length
        self.height = height
        self.depth = depth
        self.id = db_id


class coordinates_segments():
    def __init__(self, x_cor_start, z_cor_start, x_cor_end, z_cor_end):
        self.x_cor_start = x_cor_start
        self.z_cor_start = z_cor_start
        self.x_cor_end = x_cor_end
        self.z_cor_end = z_cor_end
        
    def print_cor(self):
        print(self.x_cor_start, self.z_cor_start, self.x_cor_end, self.z_cor_end)


class coordinates_segments_cladding(coordinates_segments):
    pass
# ---------- end py__classes ----------

# ----
# WALL DIMENSIONS
width_2 = Slider(4000, range=2000..10000)
height_2 = Slider(2500, range=2000..5000)
width_door = Slider(900, range=800..1600)
height_door = Slider(2200, range=2000..3000)
position_door = Slider(2600, range=0..10000)
width_window = Slider(2500, range=0..10000)
height_window = Slider(1000, range=0..10000)
position_window_x = Slider(4000, range=0..10000)
position_window_y = Slider(1000, range=0..10000)
slider = CreateSlider(Slider=width_2, ShowBounds=False, ShowTicks=False, ShowTooltip=False, ShowValLabel=True, showLabel=True)
slider_2 = CreateSlider(Slider=height_2, SnapValue=100, ShowBounds=False, ShowTicks=False, ShowTooltip=False, ShowValLabel=True, showLabel=True)
slider_3 = CreateSlider(Slider=width_door, SnapValue=10, ShowBounds=False, ShowTicks=False, ShowTooltip=False, ShowValLabel=True, showLabel=True)
slider_4 = CreateSlider(
    Slider=height_door,
    SnapValue=10,
    ShowBounds=False,
    ShowTicks=False,
    ShowTooltip=False,
    ShowValLabel=True,
    showLabel=True)
slider_5 = CreateSlider(Slider=position_door, ShowBounds=False, ShowTicks=False, ShowTooltip=False, ShowValLabel=True, showLabel=True)
slider_6 = CreateSlider(
    Slider=width_window,
    SnapValue=10,
    ShowBounds=False,
    ShowTicks=False,
    ShowTooltip=False,
    ShowValLabel=True,
    showLabel=True)
slider_7 = CreateSlider(
    Slider=height_window,
    SnapValue=10,
    ShowBounds=False,
    ShowTicks=False,
    ShowTooltip=False,
    ShowValLabel=True,
    showLabel=True)
slider_8 = CreateSlider(
    Slider=position_window_x,
    SnapValue=10,
    ShowBounds=False,
    ShowTicks=False,
    ShowTooltip=False,
    ShowValLabel=True,
    showLabel=True)
slider_9 = CreateSlider(
    Slider=position_window_y,
    SnapValue=10,
    ShowBounds=False,
    ShowTicks=False,
    ShowTooltip=False,
    ShowValLabel=True,
    showLabel=True)
values = ValueListener(Elements=slider, SomeProperty=True)  # -> Values, Indices
values_2 = ValueListener(Elements=slider_2, SomeProperty=True)  # -> Values, Indices
values_3 = ValueListener(Elements=slider_3, SomeProperty=True)  # -> Values, Indices
values_4 = ValueListener(Elements=slider_4, SomeProperty=True)  # -> Values, Indices
values_5 = ValueListener(Elements=slider_5, SomeProperty=True)  # -> Values, Indices
values_6 = ValueListener(Elements=slider_6, SomeProperty=True)  # -> Values, Indices
values_7 = ValueListener(Elements=slider_7, SomeProperty=True)  # -> Values, Indices
values_8 = ValueListener(Elements=slider_8, SomeProperty=True)  # -> Values, Indices
values_9 = ValueListener(Elements=slider_9, SomeProperty=True)  # -> Values, Indices

py__distribute_data = GhPythonScript(database=py__extract_data_from_db.database)  # -> out, structural_database, database_substructure, database_cladding
# ---------- py__distribute_data: Python ----------
"""distributes the data from the database in 3 classes and designated list.
    Inputs:
        database: list with data
    Output:
        structural_database: list with wood in structural class
        database_substructure: list with wood in substructure class
        database_cladding: list with wood in cladding class"""


import ctypes.wintypes
import sys

CSIDL_PERSONAL = 5       # My Documents
SHGFP_TYPE_CURRENT = 0   # Get current, not default value
buf = ctypes.create_unicode_buffer(ctypes.wintypes.MAX_PATH)
ctypes.windll.shell32.SHGetFolderPathW(None, CSIDL_PERSONAL, None, SHGFP_TYPE_CURRENT, buf)

install_path = buf.value + "\Exterior wall element tool\wood_classes"
sys.path.append(install_path)

from classes_wood import * 
import pickle
import operator

fhandle = open(database, 'rb')
total_database = pickle.load(fhandle)
fhandle.close()

database_infill_list = total_database[0]
database_substructure_list = total_database[1]
database_cladding_list = total_database[2]

structural_database = []
database_substructure = []
database_cladding = []

for wood in database_infill_list:
    piece_of_wood = wood_structural(wood[0], wood[1], wood[2], wood[3])
    structural_database.append(piece_of_wood)

structural_database.sort(key = operator.attrgetter('length'))

for wood in database_substructure_list:
    piece_of_wood = wood_substructure(wood[0], wood[1], wood[2], wood[3])
    database_substructure.append(piece_of_wood)

database_substructure.sort(key = operator.attrgetter('length'))
database_substructure.sort(key = operator.attrgetter('depth'))

for wood in database_cladding_list:
    piece_of_cladding = wood_cladding(wood[0], wood[1], wood[2], wood[3])
    database_cladding.append(piece_of_cladding)

database_cladding.sort(key = operator.attrgetter('length'))
database_cladding.sort(key = operator.attrgetter('height'), reverse = True)
# ---------- end py__distribute_data ----------

# ----
# STRUCTURAL INFILL & SUBSTRUCTURE
structural_infill_substructure = GhPythonScript(
    generate=toggle_2,
    segments=segments_coordinates.segments,
    ctc_distance=int_43,
    min_length_substructure_piece=int_44,
    waste_wood_database=db_structural_infill.structural_database,
    database_substructure=db_substructure.database_substructure,
    max_depth_structural_infill=int_45)  # -> out, total_infill_used, total_waste_infill, total_infill_required, total_substructure_used, total_waste_substructure, total_substructure_required; inputs segments: list, waste_wood_database: list, database_substructure: list; disabled
# ---------- structural_infill_substructure: Python ----------
import rhinoscriptsyntax as rs
import Rhino.Geometry as rg
import random
import math
import operator
import itertools


def outer_frame_vertical(required_length, waste_wood_database, position):
    #pick piece of wood from database for vertical outer frame (left & right) 
    chosen_beam = next(beam for beam in waste_wood_database if beam.length >= required_length)
    
    #determine additional waste with picked piece of wood
    waste = chosen_beam.length - required_length
    waste_wood_database.remove(chosen_beam)
    structural_infill_waste.append(waste)
    beams_selected_framing_ver.append(chosen_beam)
    beams_selected_framing.append(chosen_beam)
    structural_infill_used.append(chosen_beam.length)
    
    if position == 0: #0 = outerleft vertical 
        pt0 = rg.Point3d(seg_ver.x_cor_start,0, seg_ver.z_cor_start)
        pt1 = rg.Point3d(seg_ver.x_cor_start + chosen_beam.width, chosen_beam.depth, seg_ver.z_cor_end)
        x_start = seg_ver.x_cor_start
        z_start = seg_ver.z_cor_start 
        z_end = seg_ver.z_cor_end
        
    if position == 1: #1 = outerright vertical
        pt0 = rg.Point3d(seg_ver.x_cor_end -chosen_beam.width, 0, seg_ver.z_cor_start)
        pt1 = rg.Point3d(seg_ver.x_cor_end, chosen_beam.depth, seg_ver.z_cor_end)
        x_start = seg_ver.x_cor_end -chosen_beam.width
        z_start = seg_ver.z_cor_start
        z_end = seg_ver.z_cor_end
        
    # generate geometry in grasshopper
    box = rg.BoundingBox(pt0, pt1)
    brep = box.ToBrep()
    geometry_infill_vertical.append(brep)
    
    #generate substructure for stud
    select_substructure (chosen_beam, required_length, database_substructure, x_start, z_start, z_end)
    
    
def outer_frame_horizontal(required_length, waste_wood_database, position):
    #pick piece of wood from database for horizontal outerframe (top & bottom) 
    chosen_beam = next(beam for beam in waste_wood_database if beam.length >= required_length)
    
    #determine additional waste with picked piece of wood
    waste = chosen_beam.length - required_length
    waste_wood_database.remove(chosen_beam)
    structural_infill_waste.append(waste)
    beams_selected_framing_hor.append(chosen_beam)
    beams_selected_framing.append(chosen_beam)
    structural_infill_used.append(chosen_beam.length)
    
    if position == 0: #0 = bottom horizontal 
        pt0 = rg.Point3d(seg_ver.x_cor_start, 0, seg_ver.z_cor_start)
        pt1 = rg.Point3d(seg_ver.x_cor_end, chosen_beam.width, seg_ver.z_cor_start + chosen_beam.depth)
        
    if position == 1: #1 = top horizontal 
        pt0 = rg.Point3d(seg_ver.x_cor_start, 0, seg_ver.z_cor_end -chosen_beam.depth)
        pt1 = rg.Point3d(seg_ver.x_cor_end, chosen_beam.width, seg_ver.z_cor_end)
        
    # generate geometry in grasshopper
    box = rg.BoundingBox(pt0, pt1)
    brep = box.ToBrep()
    geometry_infill_horizontal.append(brep)


def bracing (height_segment, width_segment, beams_selected_bracing, waste_wood_database):
    #determine dimensions right triangle for pythagoras calculation
    bracing_width = width_segment - beams_selected_framing[0+fr_counter].width - beams_selected_framing[1+fr_counter].width  
    bracing_height = height_segment - beams_selected_framing[2+fr_counter].depth - beams_selected_framing[3+fr_counter].depth  
    bracing_length = round((bracing_width**2 + bracing_height**2)**0.5)
    
    #pick piece of waste wood from database for bracing
    chosen_beam = next(beam for beam in waste_wood_database if beam.length >= bracing_length)
    waste = chosen_beam.length - bracing_length
    waste_wood_database.remove(chosen_beam)
    structural_infill_waste.append(waste)
    beams_selected_bracing.append(chosen_beam)
    structural_infill_used.append(chosen_beam.length)
    
    #create line to allow for geometry generation in grasshopper 
    start_bracing = ([beams_selected_framing[0+fr_counter].width + seg_ver.x_cor_start, 0,seg_ver.z_cor_end-beams_selected_framing[3+fr_counter].depth])  
    end_bracing = ([seg_ver.x_cor_end-beams_selected_framing[1+fr_counter].width, 0, seg_ver.z_cor_start + beams_selected_framing[2+fr_counter].depth]) 
    line_bracing = rs.AddLine(start_bracing,end_bracing)
    lines_bracing.append(line_bracing) 
    
    #calculation 
    tan = bracing_width / bracing_height
    y = math.degrees(math.atan(tan))
    corner = 90 - y 
    extra_x = math.sin(math.radians(corner)) * (0.5 * chosen_beam.depth)
    extra_z = math.cos(math.radians(corner)) * (0.5 * chosen_beam.depth)
    
    pt1 = rg.Point3d(beams_selected_framing[0+fr_counter].width + seg_ver.x_cor_start - extra_x , 0, seg_ver.z_cor_end-beams_selected_framing[3+fr_counter].depth - extra_z)
    pt2 = rg.Point3d(seg_ver.x_cor_end-beams_selected_framing[1+fr_counter].width - extra_x , 0, seg_ver.z_cor_start + beams_selected_framing[2+fr_counter].depth - extra_z)
    
    box_1 = rg.Point3d(0,0,0)
    box_2 = rg.Point3d(beams_selected_framing[0+fr_counter].depth, -beams_selected_framing[0+fr_counter].width, bracing_length)  
    
    zaxis = pt2-pt1
    plane = rg.Plane(pt1, zaxis)
    box = rg.BoundingBox(box_1,box_2)
    bracing_geo = rg.Box(plane, box) 
    geometry_infill_bracing.append(bracing_geo)


def intersection_formula (x_position, height_segment):
    #determine the formula of the bracing so the length of the bottom and top stud can be termined on every position along the slope
    a = (height_segment - beams_selected_framing[2+fr_counter].depth - beams_selected_framing[3+fr_counter].depth) / (width_segment- beams_selected_framing[0+fr_counter].width - beams_selected_framing[1+fr_counter].width)
    b = height_segment - beams_selected_framing[2+fr_counter].depth - beams_selected_framing[3+fr_counter].depth
    y = -a * x_position + b 
    length_bottom_stud = round(y + beams_selected_framing[2+fr_counter].depth) 
    return length_bottom_stud
    
    
def select_studs (chosen_bottom_stud, bottom_stud_length, chosen_top_stud, top_stud_length, waste_wood_database, stud_position):
    #determine waste bottom stud & remove bottom studs from database
    waste = chosen_bottom_stud.length - bottom_stud_length
    waste_wood_database.remove(chosen_bottom_stud)
    structural_infill_waste.append(waste)
    beams_selected_studs.append(chosen_bottom_stud)
    structural_infill_used.append(chosen_bottom_stud.length)
    
    #generate bottom stud geometry
    pt0 = rg.Point3d(seg_ver.x_cor_start + stud_position, 0, seg_ver.z_cor_start)  
    pt1 = rg.Point3d(seg_ver.x_cor_start + stud_position + chosen_bottom_stud.width, chosen_bottom_stud.depth, seg_ver.z_cor_start + bottom_stud_length)
    x_start = seg_ver.x_cor_start + stud_position
    z_start = seg_ver.z_cor_start 
    z_end = seg_ver.z_cor_start + bottom_stud_length
    box = rg.BoundingBox(pt0, pt1)
    brep = box.ToBrep()
    geometry_infill_studs.append(brep)
    select_substructure (chosen_bottom_stud, bottom_stud_length, database_substructure, x_start, z_start, z_end)
    
    #determine waste top stud & remove top studs from database
    waste = chosen_top_stud.length - top_stud_length
    waste_wood_database.remove(chosen_top_stud)
    structural_infill_waste.append(waste)
    beams_selected_studs.append(chosen_top_stud)
    structural_infill_used.append(chosen_top_stud.length)
    
    #generate top stud geometry
    center_align = (chosen_bottom_stud.width - chosen_top_stud.width) / 2
    pt0 = rg.Point3d(seg_ver.x_cor_start + stud_position + center_align, 0, seg_ver.z_cor_start + bottom_stud_length)
    pt1 = rg.Point3d(seg_ver.x_cor_start + stud_position + center_align + chosen_top_stud.width, chosen_top_stud.depth, seg_ver.z_cor_end)
    x_start = seg_ver.x_cor_start + stud_position + center_align
    z_start = seg_ver.z_cor_start + bottom_stud_length 
    z_end = seg_ver.z_cor_end
    box = rg.BoundingBox(pt0, pt1)
    brep = box.ToBrep()
    geometry_infill_studs.append(brep)
    
    #generate substructure for stud
    select_substructure (chosen_top_stud, top_stud_length, database_substructure, x_start, z_start, z_end)


def select_substructure (beam_infill, required_length, database_substructure, x_start, z_start, z_end):
    beam_pair = [] 
    
    #determine required depth for the substructure piece so that the complete substructre is alligned
    depth_required = int(max_depth_structural_infill) + 50 - beam_infill.depth
    length_required = required_length
    
    #picks the option to complete the substructure with 1 piece
    suitable_beams = iter([beam_sub for beam_sub in database_substructure if beam_sub.depth == depth_required and beam_sub.length >= length_required])
    chosen_beam = next(suitable_beams)

    #temp list with all the possible pieces that are longer then min required length and smaller then the required length.
    beams_selected_temp = [beam.length for beam in database_substructure if 
    beam.length >= min_length_substructure_piece and beam.length < length_required and beam.depth == depth_required]

    #looks for all the options where the total length of two pieces is smaller then thet total length of 1 piece. 
    #BUGG KAN ONTSTAAN DAT ER GEEN CHOSEN BEAM IS, BELANGRIJK OM REKENING MEE TE HOUDEN
    for numbers in itertools.combinations(beams_selected_temp,2):
        if sum(numbers) >= length_required and sum(numbers) < chosen_beam.length:
            beam_pair.append(numbers)
            
    #if there is no combination of two pieces, the single piece is picked
    if beam_pair == []: 
        beams_selected_substructure.append(chosen_beam)
        database_substructure.remove(chosen_beam)
        waste = chosen_beam.length - length_required
        substructure_waste.append(waste)
        
        pt0 = rg.Point3d(x_start, beam_infill.depth, z_start)
        pt1 = rg.Point3d(x_start+chosen_beam.width, beam_infill.depth+chosen_beam.depth, z_end)
        box = rg.BoundingBox(pt0, pt1)
        brep = box.ToBrep()
        geometry_substructure.append(brep)

    #otherwise the combination that generates the least waste is selected
    else:
        beam_pair.sort(key=sum)
        beam_pair_1 = next(beam for beam in database_substructure if beam.length == beam_pair[0][0] and beam.depth == depth_required)
        beams_selected_substructure.append(beam_pair_1)
        database_substructure.remove(beam_pair_1)
        
        beam_pair_2 = next(beam for beam in database_substructure if beam.length == beam_pair[0][1] and beam.depth == depth_required)
        beams_selected_substructure.append(beam_pair_2)
        database_substructure.remove(beam_pair_2)
        
        pt0 = rg.Point3d(x_start, beam_infill.depth, z_start)
        pt1 = rg.Point3d(x_start + beam_pair_1.width, beam_infill.depth+beam_pair_1.depth, z_start + beam_pair_1.length)
        box = rg.BoundingBox(pt0, pt1)
        brep = box.ToBrep()
        geometry_substructure.append(brep)
        
        pt0 = rg.Point3d(x_start, beam_infill.depth, z_start + beam_pair_1.length)
        pt1 = rg.Point3d(x_start +beam_pair_2.width, beam_infill.depth+beam_pair_2.depth, z_end)
        box = rg.BoundingBox(pt0, pt1)
        brep = box.ToBrep()
        geometry_substructure.append(brep)
        
        waste = sum(beam_pair[0]) - length_required
        substructure_waste.append(waste)
        
    beam_pair = []


structural_infill_waste = []
substructure_waste = []
structural_infill_used = [] 

beams_selected_bracing = [] 
beams_selected_framing_hor = [] 
beams_selected_framing_ver = [] 
beams_selected_framing = []
beams_selected_studs = []

beams_selected_substructure = []  

geometry_infill_horizontal = [] 
geometry_infill_vertical = [] 
geometry_infill_studs = [] 
geometry_infill_bracing = [] 
geometry_substructure = []

total_list = [] 

lines_bracing = []

fr_counter = 0 
br_counter = 0 

if generate: 
    for seg_ver in segments: 
        width_segment = seg_ver.x_cor_end - seg_ver.x_cor_start
        height_segment = seg_ver.z_cor_end - seg_ver.z_cor_start
        
        outer_frame_vertical(height_segment, waste_wood_database, 0)
        outer_frame_vertical(height_segment, waste_wood_database, 1)
        outer_frame_horizontal(width_segment, waste_wood_database, 0)
        outer_frame_horizontal(width_segment, waste_wood_database, 1) 
        bracing(height_segment, width_segment, beams_selected_bracing, waste_wood_database)
    
        stud_position = ctc_distance
        
        while stud_position < width_segment:
            #determine required length for bottom & top stud
            bottom_stud_length = intersection_formula (stud_position, height_segment)
            top_stud_length = height_segment - bottom_stud_length 
            margin = 0 
            controle = False
            
            while controle == False:
                suitable_bottom_studs = iter([beam for beam in waste_wood_database if beam.length >= bottom_stud_length + margin])
                chosen_bottom_stud = next(suitable_bottom_studs) 
                
                #restrictions top studs based on bottom stud, top stud cannot be wider or deeper then bottom stud
                suitable_top_studs = iter([beam for beam in waste_wood_database if beam.length >= top_stud_length 
                #and beam.width <= chosen_bottom_stud.width
                and beam.depth == chosen_bottom_stud.depth 
                and beam.length < top_stud_length + 150
                and beam.id != chosen_bottom_stud.id
                ])
                
                chosen_top_stud = next(suitable_top_studs, 0)
                
                #if no top stud is suitable, a different bottom stud is selected
                if chosen_top_stud == 0:
                    margin +=1
    
                else: 
                    controle = True
                    select_studs (chosen_bottom_stud, bottom_stud_length, chosen_top_stud, top_stud_length, waste_wood_database, stud_position)
                    stud_position = stud_position + ctc_distance
    
        fr_counter += 4 
        br_counter += 1 
    
    #calculate the total waste of the structural infill + substructure
    total_waste = sum(structural_infill_waste) + sum(substructure_waste) 
    
    total_infill = beams_selected_bracing + beams_selected_framing + beams_selected_studs
    total_infill_used = sum(structural_infill_used)/1000
    total_waste_infill = sum(structural_infill_waste)/1000
    total_infill_required =  (sum(structural_infill_used)/1000)-(sum(structural_infill_waste)/1000)
    
    substructure_used = [wood.length for wood in beams_selected_substructure]
    total_substructure_used = sum(substructure_used)/1000
    total_waste_substructure = sum(substructure_waste)/1000
    total_substructure_required =  (sum(substructure_used)/1000)-(sum(substructure_waste)/1000)
    
    total_list = [total_infill_used, total_waste_infill, total_infill_required, total_substructure_used, total_waste_substructure, total_substructure_required] 
    
    
    #total_infill = beams_selected_bracing + beams_selected_framing + beams_selected_studs
    #total_infill_used = 'strucutral infill used: '+ str(sum(structural_infill_used)/1000) + 'm'
    #total_waste_infill = 'strucutral infill waste: '+ str(sum(structural_infill_waste)/1000) + 'm'
    #total_infill_required =  'structural infill required: ' + str((sum(structural_infill_used)/1000)-(sum(structural_infill_waste)/1000)) + 'm'
    
   # substructure_used = [wood.length for wood in beams_selected_substructure]
    #total_substructure_used = 'substructure used: '+ str(sum(substructure_used)/1000) + 'm'
    #total_waste_substructure = 'substructure waste: '+ str(sum(substructure_waste)/1000) + 'm'
    #total_substructure_required =  'substructure required: ' + str((sum(substructure_used)/1000)-(sum(substructure_waste)/1000)) + 'm'
    
    
    #check to see if no piece of wood was selected twice from the database
    print('\n') 
    print('structural_infill') 
    total_infill.sort(key = operator.attrgetter('id'))
    for balk in total_infill:
        balk.print_data()
    
    #check to see if no piece of wood was selected twice from the database
    print('\n') 
    print('substructure') 
    beams_selected_substructure.sort(key = operator.attrgetter('id'))
    for balk in beams_selected_substructure:
        balk.print_data()
# ---------- end structural_infill_substructure ----------

# ----
# CLADDING
cladding = GhPythonScript(
    generate=toggle_2,
    database_cladding=db_cladding.database_cladding,
    ctc_distance=int_43,
    cladding_segments=segments_coordinates.cladding_segments)  # -> out, total_cladding_used, total_cladding_waste, total_cladding_required; inputs database_cladding: list, cladding_segments: list; disabled
# ---------- cladding: Python ----------
import Rhino.Geometry as rg
import itertools
import math
from class_beams import *

def cladding_geometry (required_length, current_height, piece_height, x_start, x_end, z_start, z_end, height_segment):
    picked_cladding = next(clad for clad in database_cladding if clad.height == piece_height and clad.length == required_length)
    wood_selected_cladding.append(picked_cladding) 
    database_cladding.remove(picked_cladding) 

    pt0 = rg.Point3d(x_start, 250, z_start + current_height)
    pt1 = rg.Point3d(x_end, 250 + picked_cladding.depth, z_start + current_height + piece_height)
    if current_height + piece_height > height_segment:
        pt1 = rg.Point3d(x_end, 250 + picked_cladding.depth, z_end)
    box = rg.BoundingBox(pt0, pt1)
    brep = box.ToBrep()
    geometry_cladding.append(brep)


cladding_waste = [] 
geometry_cladding = []
wood_selected_cladding = []  

if generate: 
    for segment in cladding_segments: 
        height_segment = segment.z_cor_end - segment.z_cor_start
        width_segment = segment.x_cor_end - segment.x_cor_start
        x_start = segment.x_cor_start
        
        cladding_selected_temp = []  
        current_height = 0 
        marge = 0 
        
        #calculate the max allowed cladding pieces in x-direction
        max_number_pieces = int(math.floor(width_segment / (ctc_distance*2)))
        
        #marge prevents the happening of infinite while loop
        while marge < 1000:
            if current_height > height_segment:
                break
        
            #start finding cladding with the highest height cladding 
            piece_height = database_cladding[0].height
            
            #continue until it is tried with the lowest height cladding 
            while piece_height >= database_cladding[-1].height:
                #generate list with all the cladding with the same height
                cladding_same_height = [clad.length for clad in database_cladding if clad.height == piece_height and clad.length >= 2*ctc_distance]
                
                if current_height >= height_segment:
                    break
        
                #see if the total width of the wall can be covered with one piece of cladding
                for clad_len in cladding_same_height[:]:
                     if clad_len >= width_segment and clad_len <= width_segment + marge:
                        cladding_same_height.remove(clad_len)
                        waste = clad_len - width_segment
                        cladding_waste.append(waste)
                        #(required_length, current_height, piece_height, x_start, x_end, z_start)
                        cladding_geometry (clad_len, current_height, piece_height, segment.x_cor_start, segment.x_cor_end, segment.z_cor_start, segment.z_cor_end, height_segment)
                        current_height += piece_height
                        
                if current_height >= height_segment:
                            break
                
                #see if the width of the wall can be covered with n pieces of cladding, to a maximum of calculated max_number_pieces
                for x_pieces in range(2,max_number_pieces+1):
                    for numbers in itertools.combinations(cladding_same_height,x_pieces):
                        x_start = segment.x_cor_start 
                        if current_height >= height_segment:
                            break
                        if sum(numbers) >= width_segment and sum(numbers) <= width_segment + marge: #and numbers[0] in cladding_same_height and numbers[1] in cladding_same_height: ## hier is nog geen rekening gheouden met meer checks
                            check =  all(elem in cladding_same_height for elem in numbers)
                            if check:
                                for counter in range(0,x_pieces):
                                    if counter == x_pieces - 1:
                                        cladding_geometry (numbers[counter], current_height, piece_height, x_start, segment.x_cor_end, segment.z_cor_start, segment.z_cor_end, height_segment)
                                    else:
                                        cladding_geometry (numbers[counter], current_height, piece_height, x_start, x_start + numbers[counter], segment.z_cor_start, segment.z_cor_end, height_segment)
                                    x_start += numbers[counter]
                                    cladding_same_height.remove(numbers[counter])
                                
                                waste = sum(numbers) - width_segment
                                cladding_waste.append(waste)
                                current_height += piece_height
                
                piece_height -= 10 
            marge += 10
        
        #calculate the amount of waste 
        cladding_used = [length.length for length in wood_selected_cladding]
        total_cladding_used = sum(cladding_used)/1000
        total_cladding_waste = sum(cladding_waste)/1000
        total_cladding_required = (sum(cladding_used)/1000)-(sum(cladding_waste)/1000)

        #total_cladding_used = 'total cladding used: ' + str(sum(cladding_used)/1000) + 'm'
        #total_cladding_waste = 'total cladding waste: ' + str(sum(cladding_waste)/1000) + 'm'
        #total_cladding_required = 'total cladding required: ' + str((sum(cladding_used)/1000)-(sum(cladding_waste)/1000)) + 'm'
# ---------- end cladding ----------

# ----
# STRUCTURAL INFILL & SUBSTRUCTURE
structural_infill_substructure_2 = GhPythonScript(
    generate=toggle_2,
    segments=segments_coordinates.segments,
    ctc_distance=int_43,
    min_length_substructure_piece=int_44,
    waste_wood_database=db_structural_infill.structural_database,
    database_substructure=db_substructure.database_substructure,
    max_depth_structural_infill=int_45)  # -> out, total_infill_used, total_waste_infill, total_infill_required, total_substructure_used, total_waste_substructure, total_substructure_required; inputs segments: list, waste_wood_database: list, database_substructure: list; disabled
# ---------- structural_infill_substructure_2: Python ----------
import rhinoscriptsyntax as rs
import Rhino.Geometry as rg
import random
import math
import operator
import itertools


def outer_frame_vertical(required_length, waste_wood_database, position):
    #pick piece of wood from database for vertical outer frame (left & right) 
    chosen_beam = next(beam for beam in waste_wood_database if beam.length >= required_length)
    
    #determine additional waste with picked piece of wood
    waste = chosen_beam.length - required_length
    waste_wood_database.remove(chosen_beam)
    structural_infill_waste.append(waste)
    beams_selected_framing_ver.append(chosen_beam)
    beams_selected_framing.append(chosen_beam)
    structural_infill_used.append(chosen_beam.length)
    
    if position == 0: #0 = outerleft vertical 
        pt0 = rg.Point3d(seg_ver.x_cor_start,0, seg_ver.z_cor_start)
        pt1 = rg.Point3d(seg_ver.x_cor_start + chosen_beam.width, chosen_beam.depth, seg_ver.z_cor_end)
        x_start = seg_ver.x_cor_start
        z_start = seg_ver.z_cor_start 
        z_end = seg_ver.z_cor_end
        
    if position == 1: #1 = outerright vertical
        pt0 = rg.Point3d(seg_ver.x_cor_end -chosen_beam.width, 0, seg_ver.z_cor_start)
        pt1 = rg.Point3d(seg_ver.x_cor_end, chosen_beam.depth, seg_ver.z_cor_end)
        x_start = seg_ver.x_cor_end -chosen_beam.width
        z_start = seg_ver.z_cor_start
        z_end = seg_ver.z_cor_end
        
    # generate geometry in grasshopper
    box = rg.BoundingBox(pt0, pt1)
    brep = box.ToBrep()
    geometry_infill_vertical.append(brep)
    
    #generate substructure for stud
    select_substructure (chosen_beam, required_length, database_substructure, x_start, z_start, z_end)
    
    
def outer_frame_horizontal(required_length, waste_wood_database, position):
    #pick piece of wood from database for horizontal outerframe (top & bottom) 
    chosen_beam = next(beam for beam in waste_wood_database if beam.length >= required_length)
    
    #determine additional waste with picked piece of wood
    waste = chosen_beam.length - required_length
    waste_wood_database.remove(chosen_beam)
    structural_infill_waste.append(waste)
    beams_selected_framing_hor.append(chosen_beam)
    beams_selected_framing.append(chosen_beam)
    structural_infill_used.append(chosen_beam.length)
    
    if position == 0: #0 = bottom horizontal 
        pt0 = rg.Point3d(seg_ver.x_cor_start, 0, seg_ver.z_cor_start)
        pt1 = rg.Point3d(seg_ver.x_cor_end, chosen_beam.width, seg_ver.z_cor_start + chosen_beam.depth)
        
    if position == 1: #1 = top horizontal 
        pt0 = rg.Point3d(seg_ver.x_cor_start, 0, seg_ver.z_cor_end -chosen_beam.depth)
        pt1 = rg.Point3d(seg_ver.x_cor_end, chosen_beam.width, seg_ver.z_cor_end)
        
    # generate geometry in grasshopper
    box = rg.BoundingBox(pt0, pt1)
    brep = box.ToBrep()
    geometry_infill_horizontal.append(brep)


def bracing (height_segment, width_segment, beams_selected_bracing, waste_wood_database):
    #determine dimensions right triangle for pythagoras calculation
    bracing_width = width_segment - beams_selected_framing[0+fr_counter].width - beams_selected_framing[1+fr_counter].width  
    bracing_height = height_segment - beams_selected_framing[2+fr_counter].depth - beams_selected_framing[3+fr_counter].depth  
    bracing_length = round((bracing_width**2 + bracing_height**2)**0.5)
    
    #pick piece of waste wood from database for bracing
    chosen_beam = next(beam for beam in waste_wood_database if beam.length >= bracing_length)
    waste = chosen_beam.length - bracing_length
    waste_wood_database.remove(chosen_beam)
    structural_infill_waste.append(waste)
    beams_selected_bracing.append(chosen_beam)
    structural_infill_used.append(chosen_beam.length)
    
    #create line to allow for geometry generation in grasshopper 
    start_bracing = ([beams_selected_framing[0+fr_counter].width + seg_ver.x_cor_start, 0,seg_ver.z_cor_end-beams_selected_framing[3+fr_counter].depth])  
    end_bracing = ([seg_ver.x_cor_end-beams_selected_framing[1+fr_counter].width, 0, seg_ver.z_cor_start + beams_selected_framing[2+fr_counter].depth]) 
    line_bracing = rs.AddLine(start_bracing,end_bracing)
    lines_bracing.append(line_bracing) 
    
    #calculation 
    tan = bracing_width / bracing_height
    y = math.degrees(math.atan(tan))
    corner = 90 - y 
    extra_x = math.sin(math.radians(corner)) * (0.5 * chosen_beam.depth)
    extra_z = math.cos(math.radians(corner)) * (0.5 * chosen_beam.depth)
    
    pt1 = rg.Point3d(beams_selected_framing[0+fr_counter].width + seg_ver.x_cor_start - extra_x , 0, seg_ver.z_cor_end-beams_selected_framing[3+fr_counter].depth - extra_z)
    pt2 = rg.Point3d(seg_ver.x_cor_end-beams_selected_framing[1+fr_counter].width - extra_x , 0, seg_ver.z_cor_start + beams_selected_framing[2+fr_counter].depth - extra_z)
    
    box_1 = rg.Point3d(0,0,0)
    box_2 = rg.Point3d(beams_selected_framing[0+fr_counter].depth, -beams_selected_framing[0+fr_counter].width, bracing_length)  
    
    zaxis = pt2-pt1
    plane = rg.Plane(pt1, zaxis)
    box = rg.BoundingBox(box_1,box_2)
    bracing_geo = rg.Box(plane, box) 
    geometry_infill_bracing.append(bracing_geo)


def intersection_formula (x_position, height_segment):
    #determine the formula of the bracing so the length of the bottom and top stud can be termined on every position along the slope
    a = (height_segment - beams_selected_framing[2+fr_counter].depth - beams_selected_framing[3+fr_counter].depth) / (width_segment- beams_selected_framing[0+fr_counter].width - beams_selected_framing[1+fr_counter].width)
    b = height_segment - beams_selected_framing[2+fr_counter].depth - beams_selected_framing[3+fr_counter].depth
    y = -a * x_position + b 
    length_bottom_stud = round(y + beams_selected_framing[2+fr_counter].depth) 
    return length_bottom_stud
    
    
def select_studs (chosen_bottom_stud, bottom_stud_length, chosen_top_stud, top_stud_length, waste_wood_database, stud_position):
    #determine waste bottom stud & remove bottom studs from database
    waste = chosen_bottom_stud.length - bottom_stud_length
    waste_wood_database.remove(chosen_bottom_stud)
    structural_infill_waste.append(waste)
    beams_selected_studs.append(chosen_bottom_stud)
    structural_infill_used.append(chosen_bottom_stud.length)
    
    #generate bottom stud geometry
    pt0 = rg.Point3d(seg_ver.x_cor_start + stud_position, 0, seg_ver.z_cor_start)  
    pt1 = rg.Point3d(seg_ver.x_cor_start + stud_position + chosen_bottom_stud.width, chosen_bottom_stud.depth, seg_ver.z_cor_start + bottom_stud_length)
    x_start = seg_ver.x_cor_start + stud_position
    z_start = seg_ver.z_cor_start 
    z_end = seg_ver.z_cor_start + bottom_stud_length
    box = rg.BoundingBox(pt0, pt1)
    brep = box.ToBrep()
    geometry_infill_studs.append(brep)
    select_substructure (chosen_bottom_stud, bottom_stud_length, database_substructure, x_start, z_start, z_end)
    
    #determine waste top stud & remove top studs from database
    waste = chosen_top_stud.length - top_stud_length
    waste_wood_database.remove(chosen_top_stud)
    structural_infill_waste.append(waste)
    beams_selected_studs.append(chosen_top_stud)
    structural_infill_used.append(chosen_top_stud.length)
    
    #generate top stud geometry
    center_align = (chosen_bottom_stud.width - chosen_top_stud.width) / 2
    pt0 = rg.Point3d(seg_ver.x_cor_start + stud_position + center_align, 0, seg_ver.z_cor_start + bottom_stud_length)
    pt1 = rg.Point3d(seg_ver.x_cor_start + stud_position + center_align + chosen_top_stud.width, chosen_top_stud.depth, seg_ver.z_cor_end)
    x_start = seg_ver.x_cor_start + stud_position + center_align
    z_start = seg_ver.z_cor_start + bottom_stud_length 
    z_end = seg_ver.z_cor_end
    box = rg.BoundingBox(pt0, pt1)
    brep = box.ToBrep()
    geometry_infill_studs.append(brep)
    
    #generate substructure for stud
    select_substructure (chosen_top_stud, top_stud_length, database_substructure, x_start, z_start, z_end)


def select_substructure (beam_infill, required_length, database_substructure, x_start, z_start, z_end):
    beam_pair = [] 
    
    #determine required depth for the substructure piece so that the complete substructre is alligned
    depth_required = int(max_depth_structural_infill) + 50 - beam_infill.depth
    length_required = required_length
    
    #picks the option to complete the substructure with 1 piece
    suitable_beams = iter([beam_sub for beam_sub in database_substructure if beam_sub.depth == depth_required and beam_sub.length >= length_required])
    chosen_beam = next(suitable_beams)

    #temp list with all the possible pieces that are longer then min required length and smaller then the required length.
    beams_selected_temp = [beam.length for beam in database_substructure if 
    beam.length >= min_length_substructure_piece and beam.length < length_required and beam.depth == depth_required]

    #looks for all the options where the total length of two pieces is smaller then thet total length of 1 piece. 
    #BUGG KAN ONTSTAAN DAT ER GEEN CHOSEN BEAM IS, BELANGRIJK OM REKENING MEE TE HOUDEN
    for numbers in itertools.combinations(beams_selected_temp,2):
        if sum(numbers) >= length_required and sum(numbers) < chosen_beam.length:
            beam_pair.append(numbers)
            
    #if there is no combination of two pieces, the single piece is picked
    if beam_pair == []: 
        beams_selected_substructure.append(chosen_beam)
        database_substructure.remove(chosen_beam)
        waste = chosen_beam.length - length_required
        substructure_waste.append(waste)
        
        pt0 = rg.Point3d(x_start, beam_infill.depth, z_start)
        pt1 = rg.Point3d(x_start+chosen_beam.width, beam_infill.depth+chosen_beam.depth, z_end)
        box = rg.BoundingBox(pt0, pt1)
        brep = box.ToBrep()
        geometry_substructure.append(brep)

    #otherwise the combination that generates the least waste is selected
    else:
        beam_pair.sort(key=sum)
        beam_pair_1 = next(beam for beam in database_substructure if beam.length == beam_pair[0][0] and beam.depth == depth_required)
        beams_selected_substructure.append(beam_pair_1)
        database_substructure.remove(beam_pair_1)
        
        beam_pair_2 = next(beam for beam in database_substructure if beam.length == beam_pair[0][1] and beam.depth == depth_required)
        beams_selected_substructure.append(beam_pair_2)
        database_substructure.remove(beam_pair_2)
        
        pt0 = rg.Point3d(x_start, beam_infill.depth, z_start)
        pt1 = rg.Point3d(x_start + beam_pair_1.width, beam_infill.depth+beam_pair_1.depth, z_start + beam_pair_1.length)
        box = rg.BoundingBox(pt0, pt1)
        brep = box.ToBrep()
        geometry_substructure.append(brep)
        
        pt0 = rg.Point3d(x_start, beam_infill.depth, z_start + beam_pair_1.length)
        pt1 = rg.Point3d(x_start +beam_pair_2.width, beam_infill.depth+beam_pair_2.depth, z_end)
        box = rg.BoundingBox(pt0, pt1)
        brep = box.ToBrep()
        geometry_substructure.append(brep)
        
        waste = sum(beam_pair[0]) - length_required
        substructure_waste.append(waste)
        
    beam_pair = []


structural_infill_waste = []
substructure_waste = []
structural_infill_used = [] 

beams_selected_bracing = [] 
beams_selected_framing_hor = [] 
beams_selected_framing_ver = [] 
beams_selected_framing = []
beams_selected_studs = []

beams_selected_substructure = []  

geometry_infill_horizontal = [] 
geometry_infill_vertical = [] 
geometry_infill_studs = [] 
geometry_infill_bracing = [] 
geometry_substructure = []

total_list = [] 

lines_bracing = []

fr_counter = 0 
br_counter = 0 

if generate: 
    for seg_ver in segments: 
        width_segment = seg_ver.x_cor_end - seg_ver.x_cor_start
        height_segment = seg_ver.z_cor_end - seg_ver.z_cor_start
        
        outer_frame_vertical(height_segment, waste_wood_database, 0)
        outer_frame_vertical(height_segment, waste_wood_database, 1)
        outer_frame_horizontal(width_segment, waste_wood_database, 0)
        outer_frame_horizontal(width_segment, waste_wood_database, 1) 
        bracing(height_segment, width_segment, beams_selected_bracing, waste_wood_database)
    
        stud_position = ctc_distance
        
        while stud_position < width_segment:
            #determine required length for bottom & top stud
            bottom_stud_length = intersection_formula (stud_position, height_segment)
            top_stud_length = height_segment - bottom_stud_length 
            margin = 0 
            controle = False
            
            while controle == False:
                suitable_bottom_studs = iter([beam for beam in waste_wood_database if beam.length >= bottom_stud_length + margin])
                chosen_bottom_stud = next(suitable_bottom_studs) 
                
                #restrictions top studs based on bottom stud, top stud cannot be wider or deeper then bottom stud
                suitable_top_studs = iter([beam for beam in waste_wood_database if beam.length >= top_stud_length 
                and beam.width <= chosen_bottom_stud.width
                and beam.depth == chosen_bottom_stud.depth 
                and beam.length < top_stud_length + 150
                and beam.id != chosen_bottom_stud.id
                ])
                
                chosen_top_stud = next(suitable_top_studs, 0)
                
                #if no top stud is suitable, a different bottom stud is selected
                if chosen_top_stud == 0:
                    margin +=1
    
                else: 
                    controle = True
                    select_studs (chosen_bottom_stud, bottom_stud_length, chosen_top_stud, top_stud_length, waste_wood_database, stud_position)
                    stud_position = stud_position + ctc_distance
    
        fr_counter += 4 
        br_counter += 1 
    
    #calculate the total waste of the structural infill + substructure
    total_waste = sum(structural_infill_waste) + sum(substructure_waste) 
    
    total_infill = beams_selected_bracing + beams_selected_framing + beams_selected_studs
    total_infill_used = sum(structural_infill_used)/1000
    total_waste_infill = sum(structural_infill_waste)/1000
    total_infill_required =  (sum(structural_infill_used)/1000)-(sum(structural_infill_waste)/1000)
    
    substructure_used = [wood.length for wood in beams_selected_substructure]
    total_substructure_used = sum(substructure_used)/1000
    total_waste_substructure = sum(substructure_waste)/1000
    total_substructure_required =  (sum(substructure_used)/1000)-(sum(substructure_waste)/1000)
    
    total_list = [total_infill_used, total_waste_infill, total_infill_required, total_substructure_used, total_waste_substructure, total_substructure_required] 
    
    
    #total_infill = beams_selected_bracing + beams_selected_framing + beams_selected_studs
    #total_infill_used = 'strucutral infill used: '+ str(sum(structural_infill_used)/1000) + 'm'
    #total_waste_infill = 'strucutral infill waste: '+ str(sum(structural_infill_waste)/1000) + 'm'
    #total_infill_required =  'structural infill required: ' + str((sum(structural_infill_used)/1000)-(sum(structural_infill_waste)/1000)) + 'm'
    
   # substructure_used = [wood.length for wood in beams_selected_substructure]
    #total_substructure_used = 'substructure used: '+ str(sum(substructure_used)/1000) + 'm'
    #total_waste_substructure = 'substructure waste: '+ str(sum(substructure_waste)/1000) + 'm'
    #total_substructure_required =  'substructure required: ' + str((sum(substructure_used)/1000)-(sum(substructure_waste)/1000)) + 'm'
    
    
    #check to see if no piece of wood was selected twice from the database
    print('\n') 
    print('structural_infill') 
    total_infill.sort(key = operator.attrgetter('id'))
    for balk in total_infill:
        balk.print_data()
    
    #check to see if no piece of wood was selected twice from the database
    print('\n') 
    print('substructure') 
    beams_selected_substructure.sort(key = operator.attrgetter('id'))
    for balk in beams_selected_substructure:
        balk.print_data()
# ---------- end structural_infill_substructure_2 ----------

# ----
# STRUCTURAL INFILL & SUBSTRUCTURE
structural_infill_substructure_3 = GhPythonScript(
    generate=toggle_2,
    segments=segments_coordinates.segments,
    ctc_distance=int_43,
    min_length_substructure_piece=int_44,
    waste_wood_database=db_structural_infill.structural_database,
    database_substructure=db_substructure.database_substructure,
    max_depth_structural_infill=int_45)  # -> out, total_infill_used, total_waste_infill, total_infill_required, total_substructure_used, total_waste_substructure, total_substructure_required; inputs segments: list, waste_wood_database: list, database_substructure: list; disabled
# ---------- structural_infill_substructure_3: Python ----------
import rhinoscriptsyntax as rs
import Rhino.Geometry as rg
import random
import math
import operator
import itertools


def outer_frame_vertical(required_length, waste_wood_database, position):
    #pick piece of wood from database for vertical outer frame (left & right) 
    chosen_beam = next(beam for beam in waste_wood_database if beam.length >= required_length)
    
    #determine additional waste with picked piece of wood
    waste = chosen_beam.length - required_length
    waste_wood_database.remove(chosen_beam)
    structural_infill_waste.append(waste)
    beams_selected_framing_ver.append(chosen_beam)
    beams_selected_framing.append(chosen_beam)
    structural_infill_used.append(chosen_beam.length)
    
    if position == 0: #0 = outerleft vertical 
        pt0 = rg.Point3d(seg_ver.x_cor_start,0, seg_ver.z_cor_start)
        pt1 = rg.Point3d(seg_ver.x_cor_start + chosen_beam.width, chosen_beam.depth, seg_ver.z_cor_end)
        x_start = seg_ver.x_cor_start
        z_start = seg_ver.z_cor_start 
        z_end = seg_ver.z_cor_end
        
    if position == 1: #1 = outerright vertical
        pt0 = rg.Point3d(seg_ver.x_cor_end -chosen_beam.width, 0, seg_ver.z_cor_start)
        pt1 = rg.Point3d(seg_ver.x_cor_end, chosen_beam.depth, seg_ver.z_cor_end)
        x_start = seg_ver.x_cor_end -chosen_beam.width
        z_start = seg_ver.z_cor_start
        z_end = seg_ver.z_cor_end
        
    # generate geometry in grasshopper
    box = rg.BoundingBox(pt0, pt1)
    brep = box.ToBrep()
    geometry_infill_vertical.append(brep)
    
    #generate substructure for stud
    select_substructure (chosen_beam, required_length, database_substructure, x_start, z_start, z_end)
    
    
def outer_frame_horizontal(required_length, waste_wood_database, position):
    #pick piece of wood from database for horizontal outerframe (top & bottom) 
    chosen_beam = next(beam for beam in waste_wood_database if beam.length >= required_length)
    
    #determine additional waste with picked piece of wood
    waste = chosen_beam.length - required_length
    waste_wood_database.remove(chosen_beam)
    structural_infill_waste.append(waste)
    beams_selected_framing_hor.append(chosen_beam)
    beams_selected_framing.append(chosen_beam)
    structural_infill_used.append(chosen_beam.length)
    
    if position == 0: #0 = bottom horizontal 
        pt0 = rg.Point3d(seg_ver.x_cor_start, 0, seg_ver.z_cor_start)
        pt1 = rg.Point3d(seg_ver.x_cor_end, chosen_beam.width, seg_ver.z_cor_start + chosen_beam.depth)
        
    if position == 1: #1 = top horizontal 
        pt0 = rg.Point3d(seg_ver.x_cor_start, 0, seg_ver.z_cor_end -chosen_beam.depth)
        pt1 = rg.Point3d(seg_ver.x_cor_end, chosen_beam.width, seg_ver.z_cor_end)
        
    # generate geometry in grasshopper
    box = rg.BoundingBox(pt0, pt1)
    brep = box.ToBrep()
    geometry_infill_horizontal.append(brep)


def bracing (height_segment, width_segment, beams_selected_bracing, waste_wood_database):
    #determine dimensions right triangle for pythagoras calculation
    bracing_width = width_segment - beams_selected_framing[0+fr_counter].width - beams_selected_framing[1+fr_counter].width  
    bracing_height = height_segment - beams_selected_framing[2+fr_counter].depth - beams_selected_framing[3+fr_counter].depth  
    bracing_length = round((bracing_width**2 + bracing_height**2)**0.5)
    
    #pick piece of waste wood from database for bracing
    chosen_beam = next(beam for beam in waste_wood_database if beam.length >= bracing_length)
    waste = chosen_beam.length - bracing_length
    waste_wood_database.remove(chosen_beam)
    structural_infill_waste.append(waste)
    beams_selected_bracing.append(chosen_beam)
    structural_infill_used.append(chosen_beam.length)
    
    #create line to allow for geometry generation in grasshopper 
    start_bracing = ([beams_selected_framing[0+fr_counter].width + seg_ver.x_cor_start, 0,seg_ver.z_cor_end-beams_selected_framing[3+fr_counter].depth])  
    end_bracing = ([seg_ver.x_cor_end-beams_selected_framing[1+fr_counter].width, 0, seg_ver.z_cor_start + beams_selected_framing[2+fr_counter].depth]) 
    line_bracing = rs.AddLine(start_bracing,end_bracing)
    lines_bracing.append(line_bracing) 
    
    #calculation 
    tan = bracing_width / bracing_height
    y = math.degrees(math.atan(tan))
    corner = 90 - y 
    extra_x = math.sin(math.radians(corner)) * (0.5 * chosen_beam.depth)
    extra_z = math.cos(math.radians(corner)) * (0.5 * chosen_beam.depth)
    
    pt1 = rg.Point3d(beams_selected_framing[0+fr_counter].width + seg_ver.x_cor_start - extra_x , 0, seg_ver.z_cor_end-beams_selected_framing[3+fr_counter].depth - extra_z)
    pt2 = rg.Point3d(seg_ver.x_cor_end-beams_selected_framing[1+fr_counter].width - extra_x , 0, seg_ver.z_cor_start + beams_selected_framing[2+fr_counter].depth - extra_z)
    
    box_1 = rg.Point3d(0,0,0)
    box_2 = rg.Point3d(beams_selected_framing[0+fr_counter].depth, -beams_selected_framing[0+fr_counter].width, bracing_length)  
    
    zaxis = pt2-pt1
    plane = rg.Plane(pt1, zaxis)
    box = rg.BoundingBox(box_1,box_2)
    bracing_geo = rg.Box(plane, box) 
    geometry_infill_bracing.append(bracing_geo)


def intersection_formula (x_position, height_segment):
    #determine the formula of the bracing so the length of the bottom and top stud can be termined on every position along the slope
    a = (height_segment - beams_selected_framing[2+fr_counter].depth - beams_selected_framing[3+fr_counter].depth) / (width_segment- beams_selected_framing[0+fr_counter].width - beams_selected_framing[1+fr_counter].width)
    b = height_segment - beams_selected_framing[2+fr_counter].depth - beams_selected_framing[3+fr_counter].depth
    y = -a * x_position + b 
    length_bottom_stud = round(y + beams_selected_framing[2+fr_counter].depth) 
    return length_bottom_stud
    
    
def select_studs (chosen_bottom_stud, bottom_stud_length, chosen_top_stud, top_stud_length, waste_wood_database, stud_position):
    #determine waste bottom stud & remove bottom studs from database
    waste = chosen_bottom_stud.length - bottom_stud_length
    waste_wood_database.remove(chosen_bottom_stud)
    structural_infill_waste.append(waste)
    beams_selected_studs.append(chosen_bottom_stud)
    structural_infill_used.append(chosen_bottom_stud.length)
    
    #generate bottom stud geometry
    pt0 = rg.Point3d(seg_ver.x_cor_start + stud_position, 0, seg_ver.z_cor_start)  
    pt1 = rg.Point3d(seg_ver.x_cor_start + stud_position + chosen_bottom_stud.width, chosen_bottom_stud.depth, seg_ver.z_cor_start + bottom_stud_length)
    x_start = seg_ver.x_cor_start + stud_position
    z_start = seg_ver.z_cor_start 
    z_end = seg_ver.z_cor_start + bottom_stud_length
    box = rg.BoundingBox(pt0, pt1)
    brep = box.ToBrep()
    geometry_infill_studs.append(brep)
    select_substructure (chosen_bottom_stud, bottom_stud_length, database_substructure, x_start, z_start, z_end)
    
    #determine waste top stud & remove top studs from database
    waste = chosen_top_stud.length - top_stud_length
    waste_wood_database.remove(chosen_top_stud)
    structural_infill_waste.append(waste)
    beams_selected_studs.append(chosen_top_stud)
    structural_infill_used.append(chosen_top_stud.length)
    
    #generate top stud geometry
    center_align = (chosen_bottom_stud.width - chosen_top_stud.width) / 2
    pt0 = rg.Point3d(seg_ver.x_cor_start + stud_position + center_align, 0, seg_ver.z_cor_start + bottom_stud_length)
    pt1 = rg.Point3d(seg_ver.x_cor_start + stud_position + center_align + chosen_top_stud.width, chosen_top_stud.depth, seg_ver.z_cor_end)
    x_start = seg_ver.x_cor_start + stud_position + center_align
    z_start = seg_ver.z_cor_start + bottom_stud_length 
    z_end = seg_ver.z_cor_end
    box = rg.BoundingBox(pt0, pt1)
    brep = box.ToBrep()
    geometry_infill_studs.append(brep)
    
    #generate substructure for stud
    select_substructure (chosen_top_stud, top_stud_length, database_substructure, x_start, z_start, z_end)


def select_substructure (beam_infill, required_length, database_substructure, x_start, z_start, z_end):
    beam_pair = [] 
    
    #determine required depth for the substructure piece so that the complete substructre is alligned
    depth_required = int(max_depth_structural_infill) + 50 - beam_infill.depth
    length_required = required_length
    
    #picks the option to complete the substructure with 1 piece
    suitable_beams = iter([beam_sub for beam_sub in database_substructure if beam_sub.depth == depth_required and beam_sub.length >= length_required])
    chosen_beam = next(suitable_beams)

    #temp list with all the possible pieces that are longer then min required length and smaller then the required length.
    beams_selected_temp = [beam.length for beam in database_substructure if 
    beam.length >= min_length_substructure_piece and beam.length < length_required and beam.depth == depth_required]

    #looks for all the options where the total length of two pieces is smaller then thet total length of 1 piece. 
    #BUGG KAN ONTSTAAN DAT ER GEEN CHOSEN BEAM IS, BELANGRIJK OM REKENING MEE TE HOUDEN
    for numbers in itertools.combinations(beams_selected_temp,2):
        if sum(numbers) >= length_required and sum(numbers) < chosen_beam.length:
            beam_pair.append(numbers)
            
    #if there is no combination of two pieces, the single piece is picked
    if beam_pair == []: 
        beams_selected_substructure.append(chosen_beam)
        database_substructure.remove(chosen_beam)
        waste = chosen_beam.length - length_required
        substructure_waste.append(waste)
        
        pt0 = rg.Point3d(x_start, beam_infill.depth, z_start)
        pt1 = rg.Point3d(x_start+chosen_beam.width, beam_infill.depth+chosen_beam.depth, z_end)
        box = rg.BoundingBox(pt0, pt1)
        brep = box.ToBrep()
        geometry_substructure.append(brep)

    #otherwise the combination that generates the least waste is selected
    else:
        beam_pair.sort(key=sum)
        beam_pair_1 = next(beam for beam in database_substructure if beam.length == beam_pair[0][0] and beam.depth == depth_required)
        beams_selected_substructure.append(beam_pair_1)
        database_substructure.remove(beam_pair_1)
        
        beam_pair_2 = next(beam for beam in database_substructure if beam.length == beam_pair[0][1] and beam.depth == depth_required)
        beams_selected_substructure.append(beam_pair_2)
        database_substructure.remove(beam_pair_2)
        
        pt0 = rg.Point3d(x_start, beam_infill.depth, z_start)
        pt1 = rg.Point3d(x_start + beam_pair_1.width, beam_infill.depth+beam_pair_1.depth, z_start + beam_pair_1.length)
        box = rg.BoundingBox(pt0, pt1)
        brep = box.ToBrep()
        geometry_substructure.append(brep)
        
        pt0 = rg.Point3d(x_start, beam_infill.depth, z_start + beam_pair_1.length)
        pt1 = rg.Point3d(x_start +beam_pair_2.width, beam_infill.depth+beam_pair_2.depth, z_end)
        box = rg.BoundingBox(pt0, pt1)
        brep = box.ToBrep()
        geometry_substructure.append(brep)
        
        waste = sum(beam_pair[0]) - length_required
        substructure_waste.append(waste)
        
    beam_pair = []


structural_infill_waste = []
substructure_waste = []
structural_infill_used = [] 

beams_selected_bracing = [] 
beams_selected_framing_hor = [] 
beams_selected_framing_ver = [] 
beams_selected_framing = []
beams_selected_studs = []

beams_selected_substructure = []  

geometry_infill_horizontal = [] 
geometry_infill_vertical = [] 
geometry_infill_studs = [] 
geometry_infill_bracing = [] 
geometry_substructure = []

total_list = [] 

lines_bracing = []

fr_counter = 0 
br_counter = 0 

if generate: 
    for seg_ver in segments: 
        width_segment = seg_ver.x_cor_end - seg_ver.x_cor_start
        height_segment = seg_ver.z_cor_end - seg_ver.z_cor_start
        
        outer_frame_vertical(height_segment, waste_wood_database, 0)
        outer_frame_vertical(height_segment, waste_wood_database, 1)
        outer_frame_horizontal(width_segment, waste_wood_database, 0)
        outer_frame_horizontal(width_segment, waste_wood_database, 1) 
        bracing(height_segment, width_segment, beams_selected_bracing, waste_wood_database)
    
        stud_position = ctc_distance
        
        while stud_position < width_segment:
            #determine required length for bottom & top stud
            bottom_stud_length = intersection_formula (stud_position, height_segment)
            top_stud_length = height_segment - bottom_stud_length 
            margin = 0 
            controle = False
            
            while controle == False:
                suitable_bottom_studs = iter([beam for beam in waste_wood_database if beam.length >= bottom_stud_length + margin])
                chosen_bottom_stud = next(suitable_bottom_studs) 
                
                #restrictions top studs based on bottom stud, top stud cannot be wider or deeper then bottom stud
                suitable_top_studs = iter([beam for beam in waste_wood_database if beam.length >= top_stud_length 
                #and beam.width <= chosen_bottom_stud.width
                #and beam.depth <= chosen_bottom_stud.depth 
                and beam.length < top_stud_length + 150
                and beam.id != chosen_bottom_stud.id
                ])
                
                chosen_top_stud = next(suitable_top_studs, 0)
                
                #if no top stud is suitable, a different bottom stud is selected
                if chosen_top_stud == 0:
                    margin +=1
    
                else: 
                    controle = True
                    select_studs (chosen_bottom_stud, bottom_stud_length, chosen_top_stud, top_stud_length, waste_wood_database, stud_position)
                    stud_position = stud_position + ctc_distance
    
        fr_counter += 4 
        br_counter += 1 
    
    #calculate the total waste of the structural infill + substructure
    total_waste = sum(structural_infill_waste) + sum(substructure_waste) 
    
    total_infill = beams_selected_bracing + beams_selected_framing + beams_selected_studs
    total_infill_used = sum(structural_infill_used)/1000
    total_waste_infill = sum(structural_infill_waste)/1000
    total_infill_required =  (sum(structural_infill_used)/1000)-(sum(structural_infill_waste)/1000)
    
    substructure_used = [wood.length for wood in beams_selected_substructure]
    total_substructure_used = sum(substructure_used)/1000
    total_waste_substructure = sum(substructure_waste)/1000
    total_substructure_required =  (sum(substructure_used)/1000)-(sum(substructure_waste)/1000)
    
    total_list = [total_infill_used, total_waste_infill, total_infill_required, total_substructure_used, total_waste_substructure, total_substructure_required] 
    
    
    #total_infill = beams_selected_bracing + beams_selected_framing + beams_selected_studs
    #total_infill_used = 'strucutral infill used: '+ str(sum(structural_infill_used)/1000) + 'm'
    #total_waste_infill = 'strucutral infill waste: '+ str(sum(structural_infill_waste)/1000) + 'm'
    #total_infill_required =  'structural infill required: ' + str((sum(structural_infill_used)/1000)-(sum(structural_infill_waste)/1000)) + 'm'
    
   # substructure_used = [wood.length for wood in beams_selected_substructure]
    #total_substructure_used = 'substructure used: '+ str(sum(substructure_used)/1000) + 'm'
    #total_waste_substructure = 'substructure waste: '+ str(sum(substructure_waste)/1000) + 'm'
    #total_substructure_required =  'substructure required: ' + str((sum(substructure_used)/1000)-(sum(substructure_waste)/1000)) + 'm'
    
    
    #check to see if no piece of wood was selected twice from the database
    print('\n') 
    print('structural_infill') 
    total_infill.sort(key = operator.attrgetter('id'))
    for balk in total_infill:
        balk.print_data()
    
    #check to see if no piece of wood was selected twice from the database
    print('\n') 
    print('substructure') 
    beams_selected_substructure.sort(key = operator.attrgetter('id'))
    for balk in beams_selected_substructure:
        balk.print_data()
# ---------- end structural_infill_substructure_3 ----------
# ----
# CLADDING
cladding_2 = GhPythonScript(
    generate=toggle_2,
    database_cladding=db_cladding.database_cladding,
    ctc_distance=int_43,
    cladding_segments=segments_coordinates.cladding_segments)  # -> out, total_cladding_used, total_cladding_waste, total_cladding_required; inputs database_cladding: list, cladding_segments: list; disabled; same code as cladding

# ----
# CLADDING
cladding_3 = GhPythonScript(
    generate=toggle_2,
    database_cladding=db_cladding.database_cladding,
    ctc_distance=int_43,
    cladding_segments=segments_coordinates.cladding_segments)  # -> out, total_cladding_used, total_cladding_waste, total_cladding_required; inputs database_cladding: list, cladding_segments: list; disabled; same code as cladding

panel_13 = Panel(structural_infill_substructure.total_infill_required)  # disabled
panel_14 = Panel(structural_infill_substructure.total_substructure_used)  # disabled
panel_15 = Panel(structural_infill_substructure.total_substructure_required)  # disabled
panel_16 = Panel(structural_infill_substructure.total_infill_used)  # disabled
panel_17 = Panel(structural_infill_substructure.total_waste_infill)  # disabled
panel_18 = Panel(structural_infill_substructure.total_waste_substructure)  # disabled

panel_19 = Panel(structural_infill_substructure_2.total_infill_required)  # disabled
panel_20 = Panel(structural_infill_substructure_2.total_substructure_used)  # disabled
panel_21 = Panel(structural_infill_substructure_2.total_substructure_required)  # disabled
panel_22 = Panel(structural_infill_substructure_2.total_infill_used)  # disabled
panel_23 = Panel(structural_infill_substructure_2.total_waste_infill)  # disabled
panel_24 = Panel(structural_infill_substructure_2.total_waste_substructure)  # disabled

panel_25 = Panel(structural_infill_substructure_3.total_infill_required)  # disabled
panel_26 = Panel(structural_infill_substructure_3.total_substructure_used)  # disabled
panel_27 = Panel(structural_infill_substructure_3.total_substructure_required)  # disabled
panel_28 = Panel(structural_infill_substructure_3.total_infill_used)  # disabled
panel_29 = Panel(structural_infill_substructure_3.total_waste_infill)  # disabled
panel_30 = Panel(structural_infill_substructure_3.total_waste_substructure)  # disabled

panel_31 = Panel(cladding.total_cladding_used)  # disabled
panel_32 = Panel(cladding.total_cladding_required)  # disabled
panel_33 = Panel(cladding.total_cladding_waste)  # disabled

panel_34 = Panel(cladding_2.total_cladding_used)  # disabled
panel_35 = Panel(cladding_2.total_cladding_required)  # disabled
panel_36 = Panel(cladding_2.total_cladding_waste)  # disabled

panel_37 = Panel(cladding_3.total_cladding_used)  # disabled
panel_38 = Panel(cladding_3.total_cladding_required)  # disabled
panel_39 = Panel(cladding_3.total_cladding_waste)  # disabled

merge_2 = Merge(
    Data1=structural_infill_substructure_3.total_infill_used,
    Data2=structural_infill_substructure_3.total_waste_infill,
    Data3=structural_infill_substructure_3.total_infill_required,
    Data4=structural_infill_substructure_3.total_substructure_used,
    Data5=structural_infill_substructure_3.total_waste_substructure,
    Data6=structural_infill_substructure_3.total_substructure_required,
    Data7=cladding_2.total_cladding_used,
    Data8=cladding_2.total_cladding_waste,
    Data9=cladding_2.total_cladding_required,
    Data10=structural_infill_substructure.total_infill_used,
    Data11=structural_infill_substructure.total_waste_infill,
    Data12=structural_infill_substructure.total_infill_required,
    Data13=structural_infill_substructure.total_substructure_used,
    Data14=structural_infill_substructure.total_waste_substructure,
    Data15=structural_infill_substructure.total_substructure_required,
    Data16=cladding.total_cladding_used,
    Data17=cladding.total_cladding_waste,
    Data18=cladding.total_cladding_required,
    Data19=structural_infill_substructure_2.total_infill_used,
    Data20=structural_infill_substructure_2.total_waste_infill,
    Data21=structural_infill_substructure_2.total_infill_required,
    Data22=structural_infill_substructure_2.total_substructure_used,
    Data23=structural_infill_substructure_2.total_waste_substructure,
    Data24=structural_infill_substructure_2.total_substructure_required,
    Data25=cladding_3.total_cladding_used,
    Data26=cladding_3.total_cladding_waste,
    Data27=cladding_3.total_cladding_required)  # disabled
gh_cpython = GH_CPython(x=toggle_2, data_input=merge_2)  # -> output; inputs x: list, data_input: list; disabled
#   port data_input: [required] - [type = int] - [default = None] Descripe your input here * bullet point. * bullet point
#   port output: indicate your output description here. refers to a new line.
# ---------- gh_cpython: Python ----------
from openpyxl import load_workbook
if x: 
    wb = load_workbook('C:/Users/jvane/OneDrive/Building Technology/GRADUATION/GRASSHOPPER/Test_write.xlsx')
    ws = wb.worksheets[0]

    row_data = []
    ws.append(data_input)

    wb.save('C:/Users/jvane/OneDrive/Building Technology/GRADUATION/GRASSHOPPER/Test_write.xlsx')

    output = 'done'
print('test')
# ---------- end gh_cpython ----------

# ----
# HUMAN UI
# (INTERFACE)
number_slider_2 = Slider(2, range=0..10)

# ---- group: DOOR
checkbox = CreateCheckbox(Label="ADD DOOR", StartingValue=False)
merge_3 = Merge(Data1=checkbox, Data2=slider_3, Data3=slider_4, Data4=slider_5)
values_10 = ValueListener(Elements=checkbox, SomeProperty=True)  # -> Values, Indices
expander = CreateExpander(UIElements=merge_3, Header="DIMENSIONS DOOR", Open=True)

# ---- group: WINDOW
checkbox_2 = CreateCheckbox(Label="ADD WINDOW", StartingValue=False)
merge_4 = Merge(Data1=checkbox_2, Data2=slider_6, Data3=slider_7, Data4=slider_8, Data5=slider_9)
expander_2 = CreateExpander(UIElements=merge_4, Header="WINDOW", Open=True)
values_11 = ValueListener(Elements=checkbox_2, SomeProperty=True)  # -> Values, Indices

# ----
# SEGMENT CALCULATION
py__divide_wall_in_segments = GhPythonScript(
    width_wall=values.Values,
    height_wall=values_2.Values,
    door=values_10.Values,
    start_door=values_5.Values,
    width_door=values_3.Values,
    height_door=values_4.Values,
    start_x_window=values_8.Values,
    start_z_window=values_9.Values,
    width_window=values_6.Values,
    height_window=values_7.Values,
    database_infill=py__distribute_data.structural_database,
    ctc_distance=int_46,
    window=values_11.Values)  # -> out, rectangles, segments, cladding_segments; inputs database_infill: list
# ---------- py__divide_wall_in_segments: Python ----------
"""Divides the wall in multiple segments
    Inputs:
        width_wall: width of the wall in mm 
        height_wall: height of the wall in mm 
        door: boolean toggle, if True apply door
        start_door: x coordinate of start door
        height_door: height of the door in mm 
        start_x_window: x coordinate where window starts
        start_z_window: z coordinate where window starts
        width_window: width of the window in mm
        height_window: height of the window in mm 
        database_infill: list with wood for structural infill
        ctc_distance: centre to centre distance between studs in mm
        window: boolean toggle, if True apply window
    Output:
        rectangle: list with rectangle geometry for preview in Rhino
        segments: list with dimensions and positions of segments for structural infill & substructure 
        cladding_segments: list with dimensions and positions of segments for cladding
        database_substructure: list with wood in substructure class
        database_cladding: list with wood in cladding class"""
        
import Rhino.Geometry as rg
import math
from classes_wood import * 

rectangles = [] 
segments = []
pt0 = rg.Point3d(0, 0, 0)
height_point = rg.Point3d(0, 1, 0)
zaxis = height_point-pt0
plane = rg.Plane(pt0, zaxis)

width_segments = [] 
cladding_segments = [] 

def number_segments(x_start, z_start, x_end, z_end): 
    """Calculate how many segments are required for these dimensions"""
    width_element = x_end - x_start
    height_element = z_end - z_start
    max_width = int((database_infill[-1].length**2 - height_element**2)**0.5)

    while max_width < width_element:
        segment_width = math.floor(max_width / ctc_distance) * ctc_distance 
        width_element -= segment_width
        segment = coordinates_segments(x_start, z_start, x_start + segment_width, z_end)
        segments.append(segment)
        x_start = x_start + segment_width
        
    if max_width > width_element:
        segment = coordinates_segments(x_start, z_start, x_end, z_end)
        segments.append(segment)

def rectangle_wall(width_wall, height_wall):
    """Generate 2d outline of wall for preview in Rhino """
    pt0 = rg.Point3d(0, 0, 0)
    pt1 = rg.Point3d(width_wall, 0, height_wall)
    rectangle = rg.Rectangle3d(plane,pt0, pt1)
    rectangles.append(rectangle) 


def rectangle_door(start_door, width_door, height_door):
    """Generate 2d outline of door for preview in Rhino """
    pt0 = rg.Point3d(start_door, 0, 0)
    pt1 = rg.Point3d(start_door + width_door, 0, height_door)
    rectangle = rg.Rectangle3d(plane,pt0, pt1)
    rectangles.append(rectangle) 


def rectangle_window(start_x_window, start_z_window, width_window, height_window): 
    """Generate 2d outline of window for preview in Rhino """
    pt0 = rg.Point3d(start_x_window, 0, start_z_window)
    pt1 = rg.Point3d(start_x_window + width_window, 0, start_z_window + height_window)
    rectangle = rg.Rectangle3d(plane,pt0, pt1)
    rectangles.append(rectangle) 


if door == False and window == False:
    rectangle_wall(width_wall, height_wall) 
    number_segments(0, 0, width_wall, height_wall)
    cladding_segments.append(coordinates_segments_cladding(0, 0, width_wall, height_wall))

if door == True and window == False:
    rectangle_wall(width_wall, height_wall) 
    rectangle_door(start_door, width_door, height_door)
    
    number_segments(0, 0, start_door, height_wall)
    number_segments(start_door, height_door, start_door + width_door, height_wall)
    number_segments(start_door + width_door, 0, width_wall, height_wall)
    
    cladding_segments.append(coordinates_segments_cladding(0, 0, start_door, height_door))
    cladding_segments.append(coordinates_segments_cladding(start_door + width_door, 0, width_wall, height_door))
    cladding_segments.append(coordinates_segments_cladding(0, height_door, width_wall, height_wall))

if door == False and window == True: 
    rectangle_wall(width_wall, height_wall) 
    rectangle_window(start_x_window, start_z_window, width_window, height_window)
    
    number_segments(0, 0, start_x_window, height_wall)
    number_segments(start_x_window, 0, start_x_window + width_window, start_z_window)
    number_segments(start_x_window, start_z_window + height_window, start_x_window + width_window, height_wall)
    number_segments(start_x_window + width_window, 0, width_wall, height_wall)
    
    cladding_segments.append(coordinates_segments_cladding(0, 0, width_wall, start_z_window))
    cladding_segments.append(coordinates_segments_cladding(0, start_z_window + height_window, width_wall, height_wall))
    cladding_segments.append(coordinates_segments_cladding(0, start_z_window, start_x_window, start_z_window + height_window))
    cladding_segments.append(coordinates_segments_cladding(start_x_window + width_window, start_z_window, width_wall, start_z_window + height_window))

if door == True and window == True:
    rectangle_wall(width_wall, height_wall) 
    rectangle_door(start_door, width_door, height_door)
    rectangle_window(start_x_window, start_z_window, width_window, height_window)
    
    if start_x_window < start_door:
        number_segments(0, 0, start_x_window, height_wall)
        number_segments(start_x_window, 0, start_x_window + width_window, start_z_window)
        number_segments(start_x_window, start_z_window + height_window, start_x_window + width_window, height_wall)
        number_segments(start_x_window + width_window, 0, start_door, height_wall)
        number_segments(start_door, height_door, start_door + width_door, height_wall)
        number_segments(start_door + width_door, 0, width_wall, height_wall)
        
        cladding_segments.append(coordinates_segments_cladding(0, 0, start_door, start_z_window))
        cladding_segments.append(coordinates_segments_cladding(0, start_z_window + height_window, start_door, height_wall))
        cladding_segments.append(coordinates_segments_cladding(0, start_z_window, start_x_window, start_z_window + height_window))
        cladding_segments.append(coordinates_segments_cladding(start_x_window + width_window, start_z_window, start_door, start_z_window + height_window))
        cladding_segments.append(coordinates_segments_cladding(start_door + width_door, 0, width_wall, height_door))
        cladding_segments.append(coordinates_segments_cladding(start_door, height_door, width_wall, height_wall))
        
    else:
        number_segments(0, 0, start_door, height_wall)
        number_segments(start_door, height_door, start_door + width_door, height_wall)
        number_segments(start_door + width_door, 0, start_x_window, height_wall)
        number_segments(start_x_window, 0, start_x_window + width_window, start_z_window)
        number_segments(start_x_window, start_z_window + height_window, start_x_window + width_window, height_wall)
        number_segments(start_x_window + width_window, 0, width_wall, height_wall)
        
        cladding_segments.append(coordinates_segments_cladding(0, 0, start_door, height_door))
        cladding_segments.append(coordinates_segments_cladding(0, height_door, start_door + width_door, height_wall))
        cladding_segments.append(coordinates_segments_cladding(start_door + width_door, 0, width_wall, start_z_window)) 
        cladding_segments.append(coordinates_segments_cladding(start_door + width_door, start_z_window, start_x_window, start_z_window + height_window)) 
        cladding_segments.append(coordinates_segments_cladding(start_door + width_door, start_z_window + height_window, width_wall, height_wall)) 
        cladding_segments.append(coordinates_segments_cladding(start_x_window + width_window, start_z_window, width_wall, start_z_window + height_window))
# ---------- end py__divide_wall_in_segments ----------

# ---- group: checkbox
checkbox_3 = CreateCheckbox(Label="EXPORT 3D MODELS ", StartingValue=False)
checkbox_4 = CreateCheckbox(Label="BAKE GEOMETRY", StartingValue=False)
checkbox_5 = CreateCheckbox(Label="PREVIEW 3D MODEL", StartingValue=False)
values_12 = ValueListener(Elements=checkbox_4, SomeProperty=True)  # -> Values, Indices
values_13 = ValueListener(Elements=checkbox_3, SomeProperty=True)  # -> Values, Indices
values_14 = ValueListener(Elements=checkbox_5, SomeProperty=True)  # -> Values, Indices

# ----
# STRUCTURAL INFILL & SUBSTRUCTURE
py__structural_infill_substructure = GhPythonScript(
    generate=values_14.Values,
    segments=py__divide_wall_in_segments.segments,
    ctc_distance=int_46,
    min_length_substructure_piece=int_47,
    waste_wood_database=py__distribute_data.structural_database,
    database_substructure=py__distribute_data.database_substructure,
    depth_wall_element=int_48)  # -> geometry_infill_vertical, geometry_infill_horizontal, geometry_infill_bracing, geometry_infill_studs, geometry_substructure, geometry_infill_booldifference, total_infill_used, total_waste_infill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; inputs segments: list, waste_wood_database: list, database_substructure: list
# ---------- py__structural_infill_substructure: Python ----------
"""Generates the geometry for the structural infill & substructure and calculates the waste
    Inputs:
        generate: Boolean toggle, if True apply
        segments: list with dimensions and positions of segments
        ctc_distance: centre to centre distance between studs in mm
        min_lenght_substructure_piece: minimal length that a piece of substructure can have in mm
        waste_wood_database: list with wood for structural infill
        database_substructure: list with wood for substructure
        depth_wall_element: depth of the exterior wall element in mm 

    Output:
        geometry_infill_vertical: list with breps for vertical frame
        geometry_infill_horizontal: list with breps for horizontal frame
        geometry_infill_bracing: list with breps for bracing 
        geometry_infill_studs: list with brep for studs
        total_infill_used: meter of wood used for structural infill
        total_waste_infill: waste in meter for structural infill
        total_infill_required: meter of wood required for structural infill
        total_substructure_used: meter of wood used for substructure
        total_waste_substructure: waste in meter for substructure
        total_substructure_required: meter of wood required for substructure 
        beams_selected_framing_ver: list of wood selected for vertical framing
        beams_selected_framing_hor: list of wood selected for horizontal framing
        beams_selected_bracing: list of wood selected for bracing
        beams_selected_studs: list of wood selected for studs
        beams_selected_substructure: list of wood selected for substructure
        """

import rhinoscriptsyntax as rs
import Rhino.Geometry as rg
import random
import math
import operator
import itertools


def outer_frame_vertical(required_length, waste_wood_database, position, difference):
    """Selects wood from db and generates geometry for vertical frame"""
    #pick piece of wood from database for vertical outer frame (left & right) 
    chosen_beam = next(beam for beam in waste_wood_database if beam.length >= required_length)
    
    #determine additional waste with picked piece of wood
    waste = chosen_beam.length - required_length
    waste_wood_database.remove(chosen_beam)
    structural_infill_waste.append(waste)
    beams_selected_framing_ver.append(chosen_beam)
    beams_selected_framing.append(chosen_beam)
    structural_infill_used.append(chosen_beam.length)
    
    if position == 'left': #0 = outerleft vertical 
        pt0 = rg.Point3d(seg_ver.x_cor_start,0, seg_ver.z_cor_start)
        pt1 = rg.Point3d(seg_ver.x_cor_start + chosen_beam.width, chosen_beam.depth, seg_ver.z_cor_end)
        x_start = seg_ver.x_cor_start
        z_start = seg_ver.z_cor_start 
        z_end = seg_ver.z_cor_end
        
    if position == 'right': #1 = outerright vertical
        pt0 = rg.Point3d(seg_ver.x_cor_end -chosen_beam.width, 0, seg_ver.z_cor_start)
        pt1 = rg.Point3d(seg_ver.x_cor_end, chosen_beam.depth, seg_ver.z_cor_end)
        x_start = seg_ver.x_cor_end -chosen_beam.width
        z_start = seg_ver.z_cor_start
        z_end = seg_ver.z_cor_end
        
    # generate geometry in grasshopper
    box = rg.BoundingBox(pt0, pt1)
    brep = box.ToBrep()
    geometry_infill_vertical.append(brep)
    
    if difference:
       geometry_infill_booldifference.append(brep)
    
    #generate substructure for stud
    select_substructure (chosen_beam, required_length, database_substructure, x_start, z_start, z_end)



def inner_studs(required_length, waste_wood_database, stud_position):
    """Selects wood from db and generates geometry for vertical frame"""
    #pick piece of wood from database for vertical outer frame (left & right) 
    chosen_beam = next(beam for beam in waste_wood_database if beam.length >= required_length)

    waste = chosen_beam.length - required_length
    waste_wood_database.remove(chosen_beam)
    structural_infill_waste.append(waste)
    beams_selected_studs.append(chosen_beam)
    structural_infill_used.append(chosen_beam.length)
    
    #generate bottom stud geometry
    pt0 = rg.Point3d(seg_ver.x_cor_start + stud_position, 0, seg_ver.z_cor_start)  
    pt1 = rg.Point3d(seg_ver.x_cor_start + stud_position + chosen_beam.width, chosen_beam.depth, seg_ver.z_cor_start + required_length)
    x_start = seg_ver.x_cor_start + stud_position
    z_start = seg_ver.z_cor_start 
    z_end = seg_ver.z_cor_start + required_length
    box = rg.BoundingBox(pt0, pt1)
    brep = box.ToBrep()
    geometry_infill_studs.append(brep)
    select_substructure (chosen_beam, required_length, database_substructure, x_start, z_start, z_end)



def outer_frame_horizontal(required_length, waste_wood_database, position):
    """Selects wood from db and generates geometry for horizontal frame"""
    #pick piece of wood from database for horizontal outerframe (top & bottom) 
    chosen_beam = next(beam for beam in waste_wood_database if beam.length >= required_length)
    
    #determine additional waste with picked piece of wood
    waste = chosen_beam.length - required_length
    waste_wood_database.remove(chosen_beam)
    structural_infill_waste.append(waste)
    beams_selected_framing_hor.append(chosen_beam)
    beams_selected_framing.append(chosen_beam)
    structural_infill_used.append(chosen_beam.length)
    
    if position == 'bottom': 
        pt0 = rg.Point3d(seg_ver.x_cor_start, 0, seg_ver.z_cor_start)
        pt1 = rg.Point3d(seg_ver.x_cor_end, chosen_beam.width, seg_ver.z_cor_start + chosen_beam.depth)
        
    if position == 'top':  
        pt0 = rg.Point3d(seg_ver.x_cor_start, 0, seg_ver.z_cor_end -chosen_beam.depth)
        pt1 = rg.Point3d(seg_ver.x_cor_end, chosen_beam.width, seg_ver.z_cor_end)
        
    # generate geometry in grasshopper
    box = rg.BoundingBox(pt0, pt1)
    brep = box.ToBrep()
    geometry_infill_horizontal.append(brep)
    




def bracing (height_segment, width_segment, beams_selected_bracing, waste_wood_database):
    """Selects wood from db and generates geometry for bracing"""
    #determine dimensions right triangle for pythagoras calculation
    bracing_width = width_segment - beams_selected_framing[0+fr_counter].width - beams_selected_framing[1+fr_counter].width  
    bracing_height = height_segment - beams_selected_framing[2+fr_counter].depth - beams_selected_framing[3+fr_counter].depth  
    bracing_length = round((bracing_width**2 + bracing_height**2)**0.5)
    
    #pick piece of waste wood from database for bracing
    chosen_beam = next(beam for beam in waste_wood_database if beam.length >= bracing_length)
    #print(chosen_beam.depth)
    waste = chosen_beam.length - bracing_length
    waste_wood_database.remove(chosen_beam)
    structural_infill_waste.append(waste)
    beams_selected_bracing.append(chosen_beam)
    structural_infill_used.append(chosen_beam.length)
    
    #calculation 
    tan = bracing_width / bracing_height
    y = math.degrees(math.atan(tan))
    corner = 90 - y 
    extra_x = math.sin(math.radians(corner)) * (0.5 * chosen_beam.depth)
    extra_z = math.cos(math.radians(corner)) * (0.5 * chosen_beam.depth)
    
    pt1 = rg.Point3d(beams_selected_framing[0+fr_counter].width + seg_ver.x_cor_start - extra_x , 0, seg_ver.z_cor_end - beams_selected_framing[3+fr_counter].depth - extra_z)
    pt2 = rg.Point3d(seg_ver.x_cor_end-beams_selected_framing[1+fr_counter].width - extra_x , 0, seg_ver.z_cor_start + beams_selected_framing[2+fr_counter].depth - extra_z)
    
    if tan < 1:
        box_1 = rg.Point3d(0,0,0) 
        box_2 = rg.Point3d(chosen_beam.depth, chosen_beam.width, -bracing_length)
        zaxis = pt1-pt2
    
    if tan >= 1:
        box_1 = rg.Point3d(0,0,0) 
        box_2 = rg.Point3d(chosen_beam.depth, -chosen_beam.width, bracing_length)
        zaxis = pt2-pt1

    plane = rg.Plane(pt1, zaxis)
    box = rg.BoundingBox(box_1,box_2)
    bracing_geo = rg.Box(plane, box) 
    geometry_infill_bracing.append(bracing_geo)


def intersection_formula (x_position, height_segment):
    """Formula to determine height of the studs"""
    #determine the formula of the bracing so the length of the bottom and top stud can be termined on every position along the slope
    a = (height_segment - beams_selected_framing[2+fr_counter].depth - beams_selected_framing[3+fr_counter].depth) / (width_segment- beams_selected_framing[0+fr_counter].width - beams_selected_framing[1+fr_counter].width)
    b = height_segment - beams_selected_framing[2+fr_counter].depth - beams_selected_framing[3+fr_counter].depth
    y = -a * x_position + b 
    length_bottom_stud = round(y + beams_selected_framing[2+fr_counter].depth) 
    return length_bottom_stud
    
    
def select_studs (chosen_bottom_stud, bottom_stud_length, chosen_top_stud, top_stud_length, waste_wood_database, stud_position):
    """Selects wood from db and generates geometry for studs"""
    #determine waste bottom stud & remove bottom studs from database
    waste = chosen_bottom_stud.length - bottom_stud_length
    waste_wood_database.remove(chosen_bottom_stud)
    structural_infill_waste.append(waste)
    beams_selected_studs.append(chosen_bottom_stud)
    structural_infill_used.append(chosen_bottom_stud.length)
    
    #generate bottom stud geometry
    pt0 = rg.Point3d(seg_ver.x_cor_start + stud_position, 0, seg_ver.z_cor_start)  
    pt1 = rg.Point3d(seg_ver.x_cor_start + stud_position + chosen_bottom_stud.width, chosen_bottom_stud.depth, seg_ver.z_cor_start + bottom_stud_length)
    x_start = seg_ver.x_cor_start + stud_position
    z_start = seg_ver.z_cor_start 
    z_end = seg_ver.z_cor_start + bottom_stud_length
    box = rg.BoundingBox(pt0, pt1)
    brep = box.ToBrep()
    geometry_infill_studs.append(brep)
    select_substructure (chosen_bottom_stud, bottom_stud_length, database_substructure, x_start, z_start, z_end)
    
    #determine waste top stud & remove top studs from database
    waste = chosen_top_stud.length - top_stud_length
    waste_wood_database.remove(chosen_top_stud)
    structural_infill_waste.append(waste)
    beams_selected_studs.append(chosen_top_stud)
    structural_infill_used.append(chosen_top_stud.length)
    
    #generate top stud geometry
    center_align = (chosen_bottom_stud.width - chosen_top_stud.width) / 2
    pt0 = rg.Point3d(seg_ver.x_cor_start + stud_position + center_align, 0, seg_ver.z_cor_start + bottom_stud_length)
    pt1 = rg.Point3d(seg_ver.x_cor_start + stud_position + center_align + chosen_top_stud.width, chosen_top_stud.depth, seg_ver.z_cor_end)
    x_start = seg_ver.x_cor_start + stud_position + center_align
    z_start = seg_ver.z_cor_start + bottom_stud_length 
    z_end = seg_ver.z_cor_end
    box = rg.BoundingBox(pt0, pt1)
    brep = box.ToBrep()
    geometry_infill_studs.append(brep)
    
    #generate substructure for stud
    select_substructure (chosen_top_stud, top_stud_length, database_substructure, x_start, z_start, z_end)


def select_substructure (beam_infill, required_length, database_substructure, x_start, z_start, z_end):
    """Selects wood from db and generates geometry for substructure"""
    beam_pair = []
    
    #determine required depth for the substructure piece so that the complete substructre is alligned
    depth_required = depth_wall_element - beam_infill.depth
    length_required = required_length
    
    #picks the option to complete the substructure with 1 piece
    suitable_beams = iter([beam_sub for beam_sub in database_substructure if beam_sub.depth == depth_required and beam_sub.length >= length_required])
    chosen_beam = next(suitable_beams)

    #temp list with all the possible pieces that are longer then min required length and smaller then the required length.
    beams_selected_temp = [beam.length for beam in database_substructure if 
    beam.length >= min_length_substructure_piece and beam.length < length_required and beam.depth == depth_required]

    #looks for all the options where the total length of two pieces is smaller then thet total length of 1 piece. 
    #BUGG KAN ONTSTAAN DAT ER GEEN CHOSEN BEAM IS, BELANGRIJK OM REKENING MEE TE HOUDEN
    for numbers in itertools.combinations(beams_selected_temp,2):
        if sum(numbers) >= length_required and sum(numbers) < chosen_beam.length:
            beam_pair.append(numbers)
            
    #if there is no combination of two pieces, the single piece is picked
    if beam_pair == []: 
        beams_selected_substructure.append(chosen_beam)
        database_substructure.remove(chosen_beam)
        waste = chosen_beam.length - length_required
        substructure_waste.append(waste)
        
        pt0 = rg.Point3d(x_start, beam_infill.depth, z_start)
        pt1 = rg.Point3d(x_start+chosen_beam.width, beam_infill.depth+chosen_beam.depth, z_end)
        box = rg.BoundingBox(pt0, pt1)
        brep = box.ToBrep()
        geometry_substructure.append(brep)

    #otherwise the combination that generates the least waste is selected
    else:
        beam_pair.sort(key=sum)
        beam_pair_1 = next(beam for beam in database_substructure if beam.length == beam_pair[0][0] and beam.depth == depth_required)
        beams_selected_substructure.append(beam_pair_1)
        database_substructure.remove(beam_pair_1)
        
        beam_pair_2 = next(beam for beam in database_substructure if beam.length == beam_pair[0][1] and beam.depth == depth_required)
        beams_selected_substructure.append(beam_pair_2)
        database_substructure.remove(beam_pair_2)
        
        pt0 = rg.Point3d(x_start, beam_infill.depth, z_start)
        pt1 = rg.Point3d(x_start + beam_pair_1.width, beam_infill.depth+beam_pair_1.depth, z_start + beam_pair_1.length)
        box = rg.BoundingBox(pt0, pt1)
        brep = box.ToBrep()
        geometry_substructure.append(brep)
        
        pt0 = rg.Point3d(x_start, beam_infill.depth, z_start + beam_pair_1.length)
        pt1 = rg.Point3d(x_start +beam_pair_2.width, beam_infill.depth+beam_pair_2.depth, z_end)
        box = rg.BoundingBox(pt0, pt1)
        brep = box.ToBrep()
        geometry_substructure.append(brep)
        
        waste = sum(beam_pair[0]) - length_required
        substructure_waste.append(waste)
        
    beam_pair = []


structural_infill_waste = []
substructure_waste = []
structural_infill_used = [] 

beams_selected_bracing = [] 
beams_selected_framing_hor = [] 
beams_selected_framing_ver = [] 
beams_selected_framing = []
beams_selected_studs = []

beams_selected_substructure = []  

geometry_infill_booldifference = []
geometry_infill_horizontal = [] 
geometry_infill_vertical = []  
geometry_infill_studs = [] 
geometry_infill_bracing = [] 
geometry_substructure = []

fr_counter = 0 
br_counter = 0 

if generate: 
    for seg_ver in segments: 
        width_segment = seg_ver.x_cor_end - seg_ver.x_cor_start
        height_segment = seg_ver.z_cor_end - seg_ver.z_cor_start
        difference = True
        
        if height_segment < 1500 or width_segment < ctc_distance:
            difference = False
        
        outer_frame_vertical(height_segment, waste_wood_database, 'left', difference)
        outer_frame_vertical(height_segment, waste_wood_database, 'right', difference)
        outer_frame_horizontal(width_segment, waste_wood_database, 'bottom')
        outer_frame_horizontal(width_segment, waste_wood_database, 'top')  

        if height_segment < 1500 or width_segment < ctc_distance:
            stud_step = 450
            stud_position = stud_step
            #stud_position = 0
            while stud_position < width_segment:
                print(stud_position) 
                print(width_segment)
                #determine required length for bottom & top stud
                stud_length = height_segment
                inner_studs(stud_length, waste_wood_database, stud_position)
                stud_position = stud_position + stud_step
                print(stud_position)
                
            fr_counter += 4 
            #inner_studs(stud_length, waste_wood_database, width_segment)
        
        else: 
            bracing(height_segment, width_segment, beams_selected_bracing, waste_wood_database)
        
            stud_position = ctc_distance
            
            while stud_position < width_segment:
                #determine required length for bottom & top stud
                bottom_stud_length = intersection_formula (stud_position, height_segment)
                top_stud_length = height_segment - bottom_stud_length 
                margin = 0 
                controle = False
                
                while controle == False:
                    suitable_bottom_studs = iter([beam for beam in waste_wood_database if beam.length >= bottom_stud_length + margin])
                    chosen_bottom_stud = next(suitable_bottom_studs) 
                    #print(margin)
                    #print('ahh') 
                    
                    #restrictions top studs based on bottom stud, top stud cannot be wider or deeper then bottom stud
                    suitable_top_studs = iter([beam for beam in waste_wood_database if beam.length >= top_stud_length 
                    and beam.width <= chosen_bottom_stud.width
                    and beam.depth == chosen_bottom_stud.depth 
                    and beam.length < top_stud_length + 150
                    and beam.id != chosen_bottom_stud.id
                    ])
                    
                    chosen_top_stud = next(suitable_top_studs, 0)
                    
                    #if no top stud is suitable, a different bottom stud is selected
                    if chosen_top_stud == 0:
                        margin +=1
        
                    else: 
                        controle = True
                        select_studs (chosen_bottom_stud, bottom_stud_length, chosen_top_stud, top_stud_length, waste_wood_database, stud_position)
                        stud_position = stud_position + ctc_distance
        
            fr_counter += 4 
            br_counter += 1 
    
    #calculate the total waste of the structural infill + substructure
    total_waste = sum(structural_infill_waste) + sum(substructure_waste) 
    
    total_infill = beams_selected_bracing + beams_selected_framing + beams_selected_studs
    total_infill_used = 'strucutral infill used: '+ str(sum(structural_infill_used)/1000) + 'm'
    total_waste_infill = 'strucutral infill waste: '+ str(sum(structural_infill_waste)/1000) + 'm'
    total_infill_required =  'structural infill required: ' + str((sum(structural_infill_used)/1000)-(sum(structural_infill_waste)/1000)) + 'm'
    
    substructure_used = [wood.length for wood in beams_selected_substructure]
    total_substructure_used = 'substructure used: '+ str(sum(substructure_used)/1000) + 'm'
    total_waste_substructure = 'substructure waste: '+ str(sum(substructure_waste)/1000) + 'm'
    total_substructure_required =  'substructure required: ' + str((sum(substructure_used)/1000)-(sum(substructure_waste)/1000)) + 'm'
    
    #check to see if no piece of wood was selected twice from the database
    print('\n') 
    print('structural_infill') 
    total_infill.sort(key = operator.attrgetter('id'))
    for balk in total_infill:
        balk.print_data()
    
    #check to see if no piece of wood was selected twice from the database
    print('\n') 
    print('substructure') 
    beams_selected_substructure.sort(key = operator.attrgetter('id'))
    for balk in beams_selected_substructure:
        balk.print_data()
# ---------- end py__structural_infill_substructure ----------
panel_40 = Panel(py__structural_infill_substructure.total_substructure_required)
panel_41 = Panel(py__structural_infill_substructure.total_infill_used)
panel_42 = Panel(py__structural_infill_substructure.total_waste_infill)
panel_43 = Panel(py__structural_infill_substructure.total_infill_required)
panel_44 = Panel(py__structural_infill_substructure.total_substructure_used)
panel_45 = Panel(py__structural_infill_substructure.total_waste_substructure)

# ----
# CLADDING
py__cladding = GhPythonScript(
    generate=values_14.Values,
    database_cladding=py__distribute_data.database_cladding,
    ctc_distance=int_46,
    cladding_segments=py__divide_wall_in_segments.cladding_segments)  # -> out, geometry_cladding, total_cladding_waste, total_cladding_used, total_cladding_required, wood_selected_cladding; inputs database_cladding: list, cladding_segments: list
# ---------- py__cladding: Python ----------
"""Generates the geometry for the cladding and calculates the waste
    Inputs:
        generate: Boolean toggle, if True apply
        database_cladding: list with wood for cladding
        ctc_distance: centre to centre distance between studs in mm
        cladding_segments: list with dimensions and positions of segments for cladding

    Output:
        geometry_claddingl: list with breps for cladding
        total_cladding_waste: waste in meter for cladding
        total_claddding_used: meter of wood used for cladding
        total_cladding_required: meter of wood required for cladding
        wood_selected_cladding: list of wood selected for cladding
        """

import Rhino.Geometry as rg
import itertools
import math
#from class_beams import *

def cladding_geometry (required_length, current_height, piece_height, x_start, x_end, z_start, z_end, height_segment):
    """Selects wood from db and generates geometry for cladding"""
    picked_cladding = next(clad for clad in database_cladding if clad.height == piece_height and clad.length == required_length)
    wood_selected_cladding.append(picked_cladding) 
    database_cladding.remove(picked_cladding) 

    pt0 = rg.Point3d(x_start, 250, z_start + current_height)
    pt1 = rg.Point3d(x_end, 250 + picked_cladding.depth, z_start + current_height + piece_height)
    if current_height + piece_height > height_segment:
        pt1 = rg.Point3d(x_end, 250 + picked_cladding.depth, z_end)
    box = rg.BoundingBox(pt0, pt1)
    brep = box.ToBrep()
    geometry_cladding.append(brep)


cladding_waste = [] 
geometry_cladding = []
wood_selected_cladding = []  

if generate: 
    for segment in cladding_segments: 
        height_segment = segment.z_cor_end - segment.z_cor_start
        width_segment = segment.x_cor_end - segment.x_cor_start
        x_start = segment.x_cor_start
        
        cladding_selected_temp = []  
        current_height = 0 
        marge = 0 
        
        #calculate the max allowed cladding pieces in x-direction
        max_number_pieces = int(math.floor(width_segment / (ctc_distance*2)))
        
        #marge prevents the happening of infinite while loop
        while marge < 1000:
            if current_height > height_segment:
                break
        
            #start finding cladding with the highest height cladding 
            piece_height = database_cladding[0].height
            
            #continue until it is tried with the lowest height cladding 
            while piece_height >= database_cladding[-1].height:
                #generate list with all the cladding with the same height
                cladding_same_height = [clad.length for clad in database_cladding if clad.height == piece_height and clad.length >= 2*ctc_distance]
                
                if current_height >= height_segment:
                    break
        
                #see if the total width of the wall can be covered with one piece of cladding
                for clad_len in cladding_same_height[:]:
                     if clad_len >= width_segment and clad_len <= width_segment + marge:
                        cladding_same_height.remove(clad_len)
                        waste = clad_len - width_segment
                        cladding_waste.append(waste)
                        #(required_length, current_height, piece_height, x_start, x_end, z_start)
                        cladding_geometry (clad_len, current_height, piece_height, segment.x_cor_start, segment.x_cor_end, segment.z_cor_start, segment.z_cor_end, height_segment)
                        current_height += piece_height
                        
                if current_height >= height_segment:
                            break
                
                #see if the width of the wall can be covered with n pieces of cladding, to a maximum of calculated max_number_pieces
                for x_pieces in range(2,max_number_pieces+1):
                    for numbers in itertools.combinations(cladding_same_height,x_pieces):
                        x_start = segment.x_cor_start 
                        if current_height >= height_segment:
                            break
                        if sum(numbers) >= width_segment and sum(numbers) <= width_segment + marge: #and numbers[0] in cladding_same_height and numbers[1] in cladding_same_height: ## hier is nog geen rekening gheouden met meer checks
                            check =  all(elem in cladding_same_height for elem in numbers)
                            if check:
                                for counter in range(0,x_pieces):
                                    if counter == x_pieces - 1:
                                        cladding_geometry (numbers[counter], current_height, piece_height, x_start, segment.x_cor_end, segment.z_cor_start, segment.z_cor_end, height_segment)
                                    else:
                                        cladding_geometry (numbers[counter], current_height, piece_height, x_start, x_start + numbers[counter], segment.z_cor_start, segment.z_cor_end, height_segment)
                                    x_start += numbers[counter]
                                    cladding_same_height.remove(numbers[counter])
                                
                                waste = sum(numbers) - width_segment
                                cladding_waste.append(waste)
                                current_height += piece_height
                
                piece_height -= 10 
            marge += 10
        
        #calculate the amount of waste 
        cladding_used = [length.length for length in wood_selected_cladding]
        total_cladding_used = 'total cladding used: ' + str(sum(cladding_used)/1000) + 'm'
        total_cladding_waste = 'total cladding waste: ' + str(sum(cladding_waste)/1000) + 'm'
        total_cladding_required = 'total cladding required: ' + str((sum(cladding_used)/1000)-(sum(cladding_waste)/1000)) + 'm'
# ---------- end py__cladding ----------
panel_46 = Panel(py__cladding.total_cladding_required)
panel_47 = Panel(py__cladding.total_cladding_waste)
panel_48 = Panel(py__cladding.total_cladding_used)

# ---- group: calculations
label = CreateLabel(LabelText="Placeholder", LabelSize=12, Justification=0)
label_2 = CreateLabel(LabelText="Placeholder", LabelSize=12, Justification=0)
label_3 = CreateLabel(LabelText="Placeholder", LabelSize=12, Justification=0)
label_4 = CreateLabel(LabelText="Placeholder", LabelSize=12, Justification=0)
label_5 = CreateLabel(LabelText="Placeholder", LabelSize=12, Justification=0)
label_6 = CreateLabel(LabelText="Placeholder", LabelSize=12, Justification=0)
merge_5 = Merge(
    Data1=panel_43,
    Data2=panel_41,
    Data3=panel_42,
    Data4=panel_40,
    Data5=panel_44,
    Data6=panel_45,
    Data7=panel_46,
    Data8=panel_48,
    Data9=panel_47)  # -> flatten(Result)
label_7 = CreateLabel(LabelText="Placeholder", LabelSize=12, Justification=0)
label_8 = CreateLabel(LabelText="Placeholder", LabelSize=12, Justification=0)
label_9 = CreateLabel(LabelText="Placeholder", LabelSize=12, Justification=0)
separator = CreateSeparator(Thickness=number_slider_2, Horizontal=True, Color=RGB(0, 0, 0))
separator_2 = CreateSeparator(Thickness=number_slider_2, Horizontal=True, Color=RGB(0, 0, 0))
setlabel = SetLabelContents(LabelToModify=[label_2, label_3, label, label_5, label_6, label_4, label_7, label_9, label_8], NewLabelContents=merge_5)
merge_6 = Merge(
    Data1=label_2,
    Data2=label_3,
    Data3=label,
    Data4=separator_2,
    Data5=label_5,
    Data6=label_6,
    Data7=label_4,
    Data8=separator,
    Data9=label_7,
    Data10=label_9,
    Data11=label_8)
expander_3 = CreateExpander(UIElements=merge_6, Header="CALCULATIONS", Open=True)

# ---- group: DIMENISIONS WALL
label_10 = CreateLabel(LabelText="DIMENSIONS WALL", LabelSize=Slider(15, range=0..20), Justification=0)
merge_7 = Merge(Data1=label_10, Data3=slider, Data4=slider_2, Data5=checkbox_5, Data6=checkbox_4, Data7=checkbox_3)

# ----
brep = Brep(py__structural_infill_substructure.geometry_infill_booldifference)

merge_8 = Merge(Data1=merge_7, Data2=expander_3, Data3=expander, Data4=expander_2)
launchwin = LaunchWindow(Show=human_ui_interface, Name="Control Window", Width=370, Height=400, ChildStatus=0, EnableHorizScroll=False)
addelems = AddElements(Window=launchwin, Elements=flatten(merge_8), DoVLChecking=True)  # -> AddedElements, ElementNames

# ----
# BAKING & GEOMETRY EXPORT
brep_2 = Brep(py__structural_infill_substructure.geometry_infill_bracing)
brep_3 = Brep(py__structural_infill_substructure.geometry_infill_studs)
brep_4 = Brep(py__structural_infill_substructure.geometry_infill_horizontal)
brep_5 = Brep(py__structural_infill_substructure.geometry_infill_vertical)
py__booleandifference = GhPythonScript(generate=values_12.Values, bracing=brep_2, studs=brep_3, framing=brep, horizontal_frame=brep_4, vertical_frame=brep_5)  # -> out, bracing_geo, vertical_frame_geo, studs_geo, next_step; inputs bracing: list of Brep, studs: list of Brep, framing: list of Brep, horizontal_frame: list of Brep, vertical_frame: list of Brep
# ---------- py__booleandifference: Python ----------
"""Peformes a BooleanDifference operation on the breps
    Inputs:
        generate: Boolean toggle, if True apply
        bracing: list with breps used for bracing
        studs: list with breps used for the studs
        horizontal_frame: list with breps used for the horizontal frame
        vertical_frame: list with breps used for the vertical frame

    Output:
        bracing_geo: list with modified breps for bracing
        vertical_frame_geo: list with modified breps for the vertical frame
        studs_goe: list with modified breps for the studs 
        next_step: Boolean toggle, allow next step to happen when boolean difference is complete
"""

import Rhino.Geometry as rg

if generate: 

    bracing_geo = rg.Brep.CreateBooleanDifference(bracing, horizontal_frame, 0.01)
    bracing_geo = rg.Brep.CreateBooleanDifference(bracing_geo, framing, 0.01)
    vertical_frame_diff = rg.Brep.CreateBooleanDifference(vertical_frame, horizontal_frame, 0.01)
    vertical_frame_geo = rg.Brep.CreateBooleanDifference(vertical_frame_diff, bracing_geo, 0.01)
    studs_diff = rg.Brep.CreateBooleanDifference(studs, horizontal_frame, 0.01)
    studs_geo = rg.Brep.CreateBooleanDifference(studs_diff, bracing_geo, 0.01)

    #removes any unwanted geometry that is generated when the bracing sticks out of the wall element. 
    bracing_geo = [brep for brep in bracing_geo if brep.GetVolume() > 100000]
    
    #This assures that the export or bake can only happens when the Boolean difference is complete 
    next_step = True
    

else: 
    next_step = False
# ---------- end py__booleandifference ----------
brep_6 = Brep(py__booleandifference.vertical_frame_geo)
brep_7 = Brep(py__cladding.geometry_cladding)
brep_8 = Brep(brep_4)
brep_9 = Brep(py__booleandifference.studs_geo)
brep_10 = Brep(py__structural_infill_substructure.geometry_substructure)

brep_11 = Brep(py__booleandifference.bracing_geo)

brep_12 = Brep(flatten([brep_8, brep_6, brep_10, brep_7, brep_9, brep_11]))
py__export_geometry_to_3dm_files = GhPythonScript(
    export=values_13.Values,
    active=py__booleandifference.next_step,
    bracing_geo=brep_11,
    vertical_frame_geo=brep_6,
    horizontal_frame_geo=brep_8,
    studs_geo=brep_9,
    substructure_geo=brep_10,
    cladding_geo=brep_7,
    beams_selected_framing_ver=py__structural_infill_substructure.beams_selected_framing_ver,
    beams_selected_framing_hor=py__structural_infill_substructure.beams_selected_framing_hor,
    beams_selected_bracing=py__structural_infill_substructure.beams_selected_bracing,
    beams_selected_studs=py__structural_infill_substructure.beams_selected_studs,
    beams_selected_substructure=py__structural_infill_substructure.beams_selected_substructure,
    wood_selected_cladding=py__cladding.wood_selected_cladding,
    layer="Layer 01")  # -> id_list, toggle; inputs bracing_geo: list, vertical_frame_geo: list, horizontal_frame_geo: list, studs_geo: list, substructure_geo: list, cladding_geo: list, beams_selected_framing_ver: list, beams_selected_framing_hor: list, beams_selected_bracing: list, beams_selected_studs: list, beams_selected_substructure: list, wood_selected_cladding: list
# ---------- py__export_geometry_to_3dm_files: Python ----------
"""exports each baked brep to a seperate 3dm file 
    Inputs:
        active: Boolean toggle, if True apply
        bracing_geo: list with breps for bracing
        vertical_frame_geo: list with breps for the vertical frame
        horizontal_frame_geo: list with breps for the vertical frame
        studs_geo: list with breps for the studs 
        substructure_geo: list with breps for the substructure
        cladding_geo: list with breps for the cladding
        beams_selected_framing_ver: list of wood selected for vertical framing
        beams_selected_framing_hor: list of wood selected for horizontal framing
        beams_selected_bracing: list of wood selected for bracing
        beams_selected_studs: list of wood selected for studs
        beams_selected_substructure: list of wood selected for substructure
        wood_selected_cladding: list of wood selected for cladding
        layer: layer where geometry needs to be baked in
        save_dir: location where to exported 3dm files need to be saved

    Output:
        id_list: list with all the id numbers of the exported wood
        toggle: Boolean toggle, allow next step to happen when export is complete
"""
import ctypes.wintypes
import rhinoscriptsyntax as rs
import scriptcontext as sc
import Rhino   

def export_file (geometry, wood_list):
    """Bakes brep to Rhino and exports it to 3dm file"""
    counter = 0 
    for brep in geometry:
        id_list.append(wood_list[counter].id)
        brep_id = brep
        sc.doc = ghdoc
        doc_object = rs.coercerhinoobject(brep_id)
        baked_geo = doc_object.Geometry
        attributes = doc_object.Attributes
        sc.doc = Rhino.RhinoDoc.ActiveDoc
        rs.UnselectAllObjects()
        baked_obj = sc.doc.Objects.Add(baked_geo, attributes)
        rs.ObjectLayer(baked_obj, layer)
        rs.SelectObject(baked_obj)
        filepath = save_dir + 'id_' + str(wood_list[counter].id)
        rs.Command('_-Export "'+ filepath + '.3dm" _Enter _Enter')
        counter += 1 

id_list = [] 
toggle = False

CSIDL_PERSONAL = 5       # My Documents
SHGFP_TYPE_CURRENT = 0   # Get current, not default value
buf = ctypes.create_unicode_buffer(ctypes.wintypes.MAX_PATH)
ctypes.windll.shell32.SHGetFolderPathW(None, CSIDL_PERSONAL, None, SHGFP_TYPE_CURRENT, buf)

save_dir = buf.value + "\\Exterior wall element tool\\Exported 3dm files\\"

#export every geometry to a folder with the correlating ID number as file name
if export and active: 
    rs.UnselectAllObjects()
    export_file(vertical_frame_geo, beams_selected_framing_ver)
    export_file(horizontal_frame_geo, beams_selected_framing_hor)
    export_file(studs_geo, beams_selected_studs)
    export_file(bracing_geo, beams_selected_bracing)
    export_file(substructure_geo, beams_selected_substructure)
    export_file(cladding_geo, wood_selected_cladding)
        
    sc.doc = Rhino.RhinoDoc.ActiveDoc
    objs = rs.ObjectsByLayer(layer)
    rs.DeleteObjects(objs)
    toggle = True
# ---------- end py__export_geometry_to_3dm_files ----------
py__bake_geometry = GhPythonScript(active=py__booleandifference.next_step, geometry=brep_12, layer="Default")  # inputs geometry: list
# ---------- py__bake_geometry: Python ----------
"""Bakes the geometry to a rhino file
    Inputs:
        active: Boolean toggle, if True apply
        geometry: list with breps
        layer: layer where geometry needs to be baked in
"""
import rhinoscriptsyntax as rs
import scriptcontext as sc
import Rhino   

if active: 
    for brep in geometry:
        brep_id = brep
        sc.doc = ghdoc
        doc_object = rs.coercerhinoobject(brep_id)
        baked_geo = doc_object.Geometry
        attributes = doc_object.Attributes
        sc.doc = Rhino.RhinoDoc.ActiveDoc
        baked_geo = sc.doc.Objects.Add(baked_geo, attributes)

#remove the baked geometry when the toggle is off
else: 
    sc.doc = Rhino.RhinoDoc.ActiveDoc
    objs = rs.ObjectsByLayer(layer)
    rs.DeleteObjects(objs)
# ---------- end py__bake_geometry ----------

panel_49 = Panel(py__export_geometry_to_3dm_files.id_list)
py__remove_used_wood_from_db = Py_RemoveUsedWoodFromDb(apply=py__export_geometry_to_3dm_files.toggle, id_list=py__export_geometry_to_3dm_files.id_list)  # inputs apply: list, id_list: list
#   port apply: [required] - type = string] - []default = ""]
# ---------- py__remove_used_wood_from_db: Python ----------
""" Deletes used wood from SQL database.
    Inputs:
        apply: boolean toggle to start data the sciprt
        id_list: List with id numbers of the wood that needs to be deleted
    Output:
        output: conformation when data is removed. 

"""


def delete_id(id_number): 
    #deletes existing data in database  
    cur.execute("DELETE FROM wood_dimensions WHERE wood_id = (%s)", (id_number,));
    conn.commit()
    print(str(id_number) + ' removed')


import psycopg2 as pg2
import random


if apply == True:
    conn = pg2.connect(database='hout', user='postgres', password='baksteen')
    cur = conn.cursor()
    for id_number in id_list:
        delete_id(id_number)
# ---------- end py__remove_used_wood_from_db ----------
